# Grasshopper definition mesh_subdiv_ghpy.gh (Grasshopper 1.0.7)

mesh = Mesh(<mesh referenced from the Rhino model>)
mesh_2 = Mesh(<mesh referenced from the Rhino model>)
weld = WeldMesh(Mesh=mesh_2, Angle=3.141592654)
weld_2 = WeldMesh(Mesh=mesh, Angle=3.141592654)
id = Guid(mesh)
id_2 = Guid(mesh_2)
mesh_from_guid_2 = GhPythonScript(x=weld)  # -> out, a, b
# ---------- mesh_from_guid_2: Python ----------
import compas
from compas.datastructures import Mesh
import compas_rhino.helpers
from compas_ghpython.artists import MeshArtist

"""
definition for refering mesh into ghpyhton from rhino

attr:
    x: mesh to reference
       type hint :ghdoc
    
    weld the mesh with 180 degree for merging the coincident verticies before
"""

def mesh_from_guid_2(guid):
    vertices, faces = compas_rhino.get_mesh_vertices_and_faces(guid)
    faces = [face[:-1] if face[-2] == face[-1] else face for face in faces]
    mesh  = Mesh.from_vertices_and_faces(vertices, faces)
    
    return mesh

mesh = mesh_from_guid_2(x)
mesh.summary()


# ironpyhton mesh output
a = mesh


# mesh.artist output

artist = MeshArtist(mesh)
artist.draw_faces(join_faces=True)
artist.draw_vertices(color={key: '#ff0000' for key in mesh.vertices_on_boundary()})
artist.draw_edges()

b = artist.draw_mesh(color=None)
# ---------- end mesh_from_guid_2 ----------
mesh_from_guid_2_2 = GhPythonScript(x=weld_2)  # -> out, a, b; same code as mesh_from_guid_2
number_slider = Slider(3, range=1..3)
number_slider_2 = Slider(5, range=0..10)
python = GhPythonScript(mesh=mesh_from_guid_2.a, k=Slider(3, range=1..3), fixed=Toggle(False))  # -> out, subd_mesh, drawing; inputs k: Int32, fixed: Boolean
# ---------- python: Python ----------
import compas
from compas.datastructures import Mesh
from compas_ghpython.artists import MeshArtist
#import numpy


if fixed == True:
    boundary_vert = mesh.vertices_on_boundaries()
    boundary_vert = [val for sublist in boundary_vert for val in sublist]
else: boundary_vert = None

print (boundary_vert)
#
#def numpy_flat(a):
#    return list(numpy.array(a).flat)

#boundary_flat_list = numpy_flat(boundary_vert)

#print(boundary_flat_list)

subd_mesh = compas.datastructures.mesh_subdivide_catmullclark(mesh, k, fixed=boundary_vert)



artist = MeshArtist(subd_mesh)
artist.draw_faces(join_faces=True)
artist.draw_vertices(color={key: '#ff0000' for key in mesh.vertices_on_boundary()})
artist.draw_edges()

drawing = artist.draw_mesh(color=None)
# ---------- end python ----------
python_2 = GhPythonScript(mesh=mesh_from_guid_2_2.a, k=Slider(5, range=0..10), fixed=Toggle(False))  # -> out, subd_mesh, drawing; inputs k: Int32, fixed: Boolean; disabled; same code as python
panel = Panel(python_2.drawing)
geo = Geometry(python.drawing)
crv = Curve(<curve referenced from the Rhino model>)
python_3 = GhPythonScript(start=Button(), boundary=crv, length=Slider(2, range=0..10))  # -> out, a; inputs start: Boolean, boundary: Curve
# ---------- python_3: Python ----------
"""Remeshing 2D in Grasshopper
    Inputs:
        boundary: A boundary curve
        length: The target length of mesh edges
        start: Computes the solution if `True`.
    Output:
        mesh: The Rhino mesh
"""
from __future__ import print_function
from __future__ import division

import rhinoscriptsyntax as rs
from scriptcontext import sticky as st

from threading import Thread

import compas_ghpython

from compas.datastructures import Mesh
from compas.datastructures import trimesh_remesh
from compas.geometry import delaunay_from_points

# define keys to store data in Gh component

guid = str(ghenv.Component.InstanceGuid)  # unique key
mesh_key = "mesh_" + guid  # key for compas mesh
rmesh_key = "rmesh_" + guid  # key for rhino mesh
running_key = "running_" + guid

# the callback is to update the Gh component


def callback(mesh, k, args):

    # draw a rhino mesh and save in sticky dictionary
    st[rmesh_key] = compas_ghpython.mesh_draw(mesh)

    # update the Gh component
    compas_ghpython.update_component(ghenv, 1)

# the remeshing algorithm should run in a thread


def threaded_function():
    trimesh_remesh(st[mesh_key],
                   target=length,
                   kmax=500,
                   allow_boundary_split=True,
                   allow_boundary_swap=True,
                   callback=callback)
    st[running_key] = False


if running_key not in st:
    st[running_key] = False

if mesh_key not in st or start:

    # divide the boundary curve into segments of a specific length
    points = rs.DivideCurve(boundary, rs.CurveLength(boundary) / length)

    # generate a delaunay triangulation from the points on the boundary
    faces = delaunay_from_points(points, boundary=points)

    # save mesh into sticky dictionary
    st[mesh_key] = Mesh.from_vertices_and_faces(points, faces)

# start or restart

if start and st[running_key] is False:
    thread = Thread(target=threaded_function)
    thread.start()
    st[running_key] = True

# make the result visible in the outlet 'mesh'

if rmesh_key in st:
    mesh = st[rmesh_key]
# ---------- end python_3 ----------
