# Grasshopper definition week_2_infilled_prototype_2.gh (Grasshopper 1.0.7)
# plug-ins: ClipperComponents

brep = Brep(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)
scale = Scale(Geometry=brep, Center=Point(0, 0, 0), Factor=Slider(0.75, range=0..1))  # -> Geometry, Transform
number_slider = Slider(4.5, range=0..10)
bbox = BoundingBox(Content=scale.Geometry, Plane=PlaneXY(0, 0, 0))  # -> Box, Box_2
debox = DeconstructBox(Box=bbox.Box)  # -> Plane, X, Y, Z
dedomain = DeconstructDomain(Domain=debox.Z)  # -> Start, End
addition = Addition(A=dedomain.Start, B=dedomain.End)
division = Division(A=addition, B=number_slider)
series = Series(Start=Slider(0.5, range=0..0.5), Step=number_slider, Count=division)
pt = ConstructPoint(XCoordinate=0, YCoordinate=0, ZCoordinate=series)
xy = XYPlane(Origin=pt)
sec = BrepPlane(Brep=scale.Geometry, Plane=xy)  # -> flatten(Curves), Points

# ---- group: Offset inwards / Closed planar curves
crv = Curve(graft(sec.Curves))  # disabled

# ----
polyoffset = PolylineOffset(Polylines=graft(sec.Curves), Distance=series, Plane=graft(xy), Tolerance=0.001, ClosedFillet=1, OpenFillet=1, Miter=2)  # -> Contour, Holes
toggle = BooleanToggle(True)
clean = CleanTree(RemoveNulls=toggle, RemoveInvalid=toggle, RemoveEmpty=toggle, Tree=polyoffset.Holes)
crv_2 = Curve(polyoffset.Holes)
division_2 = Division(A=number_slider, B=2)  # disabled
pt_2 = Point()
trim = TrimTree(Tree=clean, Depth=1)  # -> simplify(Tree)
multiplication = Multiplication(A=division_2, B=50)  # disabled
seam = Seam()

# ---- group: SEAM PT
pt_3 = Point(Point(-18.10108975, -15.28359502, 0))

# ---- group: 2ND LAYER CHANGE SEAM
crv_cp = CurveClosestPoint(Point=pt_3, Curve=trim)  # -> Point, Parameter, Distance
seam_2 = Seam(Curve=trim, Seam=crv_cp.Parameter)

# ----
panel = Panel("""False
True""")
toggle_2 = BooleanToggle(True)

# ---- group: Offset inwards
number_slider_2 = Slider(2.73, range=0..10)  # disabled
divdist = DivideDistance(Curve=crv, Distance=number_slider_2)  # -> Points, Tangents, Parameters; disabled
voronoi = Voronoi(Points=divdist.Points, BruteForceOverride=False)  # disabled
xy_2 = XYPlane(Origin=Point(0, 0, 0))  # disabled
trim_2 = TrimWithRegion(Curve=voronoi, Region=crv, Plane=xy_2)  # -> Inside, Outside; disabled
explode = Explode(Curve=trim_2.Inside, Recursive=True)  # -> Segments, Vertices; disabled
trim_3 = TrimTree(Tree=explode.Segments, Depth=2)  # disabled
colom = CollisionOneMany(Collider=trim_3, Obstacles=crv)  # -> Collision, Index; disabled
dispatch = Dispatch(List=trim_3, DispatchPattern=colom.Collision)  # -> ListA, ListB; disabled
series_2 = Series(Start=division_2, Step=division_2, Count=multiplication)  # disabled
xy_3 = XYPlane(Origin=Point(0, 0, 0))  # disabled
polyoffset_2 = PolylineOffset(Polylines=crv, Distance=series_2, Plane=xy_3, Tolerance=0.001, ClosedFillet=1, OpenFillet=1, Miter=2)  # -> Contour, Holes; disabled

# ---- group: Offset inwards / Medial axis
# Medial axis
crv_3 = Curve(dispatch.ListB)  # disabled

# ---- group: Offset inwards / Veins
# Veins
crv_4 = Curve(dispatch.ListA)  # disabled

# ---- group: Offset inwards (continued)
len = Length(Curve=crv_4)  # disabled
sort = SortList(Keys=len)  # -> Keys, ValuesA; disabled
item = ListItem(List=sort.Keys, Index=-1, WTrue=True)  # disabled
division_3 = Division(A=item, B=division_2)  # disabled
round = Round(Number=division_3)  # -> Nearest, Floor, Ceiling; disabled

# ----
crv_5 = Curve(polyoffset_2.Holes)  # disabled

# ---- group: Smooth and spiralized
crv_6 = Curve(seam_2)

# ---- group: Smooth and spiralized / SPIRAL
# SPIRAL
divdist_2 = DivideDistance(Curve=crv_6, Distance=Slider(3, range=0..100))  # -> Points, Tangents, Parameters
trim_4 = TrimTree(Tree=divdist_2.Points, Depth=1)
pline = PolyLine(Vertices=trim_4, CFalse=False)

# ---- group: Smooth and spiralized (continued)
smoothpline = SmoothPolyline(Polyline=pline, Strength=Slider(0.2, range=0..1), Times=1)
spiral_crv = Curve(flatten(smoothpline))

# ----
dispatch_2 = Dispatch(List=spiral_crv, DispatchPattern=invert(panel))  # -> ListA, ListB
sift = SiftPattern(List=spiral_crv, SiftPattern=[0, 1])  # -> Output0, Output1
flip = FlipCurve(Curve=dispatch_2.ListB)  # -> Curve, Flag
weave = Weave(Pattern=panel, Stream0=dispatch_2.ListA, Stream1=flip.Curve, NullGaps=False)
merge = Merge(Data1=dispatch_2.ListA, Data2=flip.Curve)
clean_2 = CleanTree(RemoveNulls=toggle_2, RemoveInvalid=toggle_2, RemoveEmpty=toggle_2, Tree=flip.Curve)
nullrep = ReplaceNulls(Items=sift.Output0, Replacements=clean_2)  # -> Items, Count
item_2 = ListItem(List=weave, Index=Slider(50, range=0..70), Wrap=True)
crv_7 = Curve(item_2)
divdist_3 = DivideDistance(Curve=weave, Distance=Slider(5, range=0..100))  # -> Points, Tangents, Parameters
output = DataOutput(
    DataInput=divdist_3.Points,
    Destination="C:\Users\a\repos\mini_eggshell\design\group_04\week_2_infilled_prototype_2-1.ghdata",
    RelativePath="C:\Users\a\repos\mini_eggshell\design\group_04\week_2_infilled_prototype_2-1.ghdata|week_2_infilled_prototype_2-1.ghdata")
