# Grasshopper definition clay_extruder_endEffector_V5.gh (Grasshopper 1.0.7)

crv = Curve(<curve referenced from the Rhino model>)
crv_2 = Curve(<curve referenced from the Rhino model>)
crv_3 = Curve(<curve referenced from the Rhino model>)
crv_4 = Curve(<curve referenced from the Rhino model>)
crv_5 = Curve(<curve referenced from the Rhino model>)
crv_6 = Curve(<curve referenced from the Rhino model>)
crv_7 = Curve(<curve referenced from the Rhino model>)
crv_8 = Curve(<curve referenced from the Rhino model>)
curvepoint = PointOnCurve(crv_7, parameter=0.5)
curvepoint_2 = PointOnCurve(crv_8, parameter=0.5)
curvepoint_3 = PointOnCurve(crv, parameter=0.5)
curvepoint_4 = PointOnCurve(crv_2, parameter=0.5)
end = EndPoints(Curve=crv_7)  # -> Start, End
end_2 = EndPoints(Curve=crv_8)  # -> Start, End
end_3 = EndPoints(Curve=crv)  # -> Start, End
end_4 = EndPoints(Curve=crv_2)  # -> Start, End
curvepoint_5 = PointOnCurve(crv_3, parameter=0.5)
curvepoint_6 = PointOnCurve(crv_4, parameter=0.5)
curvepoint_7 = PointOnCurve(crv_5, parameter=0.5)
curvepoint_8 = PointOnCurve(crv_6, parameter=0.5)
end_5 = EndPoints(Curve=crv_3)  # -> Start, End
end_6 = EndPoints(Curve=crv_4)  # -> Start, End
end_7 = EndPoints(Curve=crv_5)  # -> Start, End
end_8 = EndPoints(Curve=crv_6)  # -> Start, End
number_slider = Slider(18, range=0..100)
number_slider_2 = Slider(45, range=0..100)
number_slider_3 = Slider(10, range=0..100)
number_slider_4 = Slider(28, range=0..100)
number_slider_5 = Slider(18, range=0..100)
number_slider_6 = Slider(38, range=0..100)
X = UnitX(Factor=number_slider)
Z = UnitZ(Factor=number_slider_2)
X_2 = UnitX(Factor=number_slider_3)
Z_2 = UnitZ(Factor=number_slider_4)
X_3 = UnitX(Factor=number_slider_5)
Z_3 = UnitZ(Factor=number_slider_6)
X_4 = UnitX(Factor=number_slider)
Z_4 = UnitZ(Factor=number_slider_2)
X_5 = UnitX(Factor=number_slider_3)
Z_5 = UnitZ(Factor=number_slider_4)
X_6 = UnitX(Factor=number_slider_5)
Z_6 = UnitZ(Factor=number_slider_6)
X_7 = UnitX(Factor=Slider(10, range=0..100))
Z_7 = UnitZ(Factor=Slider(28, range=0..100))
X_8 = UnitX(Factor=Slider(4, range=0..100))
Z_8 = UnitZ(Factor=Slider(67, range=0..100))
neg = Negative(Value=X)
neg_2 = Negative(Value=Z)
neg_3 = Negative(Value=X_2)
neg_4 = Negative(Value=Z_2)
neg_5 = Negative(Value=X_3)
neg_6 = Negative(Value=Z_3)
neg_7 = Negative(Value=X_4)
neg_8 = Negative(Value=Z_4)
neg_9 = Negative(Value=X_5)
neg_10 = Negative(Value=Z_5)
neg_11 = Negative(Value=X_6)
neg_12 = Negative(Value=Z_6)
neg_13 = Negative(Value=X_7)
neg_14 = Negative(Value=Z_7)
neg_15 = Negative(Value=X_8)
neg_16 = Negative(Value=Z_8)
bzspan = BezierSpan(StartPoint=end_2.Start, StartTangent=neg, EndPoint=end.Start, EndTangent=neg_2)  # -> Curve, Length, Domain
bzspan_2 = BezierSpan(StartPoint=end_2.End, StartTangent=neg_3, EndPoint=end.End, EndTangent=neg_4)  # -> Curve, Length, Domain
bzspan_3 = BezierSpan(StartPoint=curvepoint_2, StartTangent=neg_5, EndPoint=curvepoint, EndTangent=neg_6)  # -> Curve, Length, Domain
bzspan_4 = BezierSpan(StartPoint=end_4.Start, StartTangent=neg_7, EndPoint=end_3.Start, EndTangent=neg_8)  # -> Curve, Length, Domain
bzspan_5 = BezierSpan(StartPoint=end_4.End, StartTangent=neg_9, EndPoint=end_3.End, EndTangent=neg_10)  # -> Curve, Length, Domain
bzspan_6 = BezierSpan(StartPoint=curvepoint_4, StartTangent=neg_11, EndPoint=curvepoint_3, EndTangent=neg_12)  # -> Curve, Length, Domain
bzspan_7 = BezierSpan(StartPoint=curvepoint_6, StartTangent=neg_13, EndPoint=curvepoint_5, EndTangent=neg_14)  # -> Curve, Length, Domain
bzspan_8 = BezierSpan(StartPoint=curvepoint_8, StartTangent=neg_15, EndPoint=curvepoint_7, EndTangent=neg_16)  # -> Curve, Length, Domain
curvepoint_9 = PointOnCurve([bzspan.Curve, bzspan_3.Curve, bzspan_2.Curve], parameter=0.5)
curvepoint_10 = PointOnCurve([bzspan_4.Curve, bzspan_6.Curve, bzspan_5.Curve], parameter=0.5)
curvepoint_11 = PointOnCurve([bzspan_4.Curve, bzspan_6.Curve, bzspan_5.Curve], parameter=0.5)
curvepoint_12 = PointOnCurve([bzspan_4.Curve, bzspan_8.Curve, bzspan.Curve], parameter=0.5)
curvepoint_13 = PointOnCurve([bzspan_5.Curve, bzspan_7.Curve, bzspan_2.Curve], parameter=0.5)
intcrv = Interpolate(Vertices=curvepoint_9, Degree=3, Periodic=False, KnotStyle=1)  # -> Curve, Length, Domain
intcrv_2 = Interpolate(Vertices=curvepoint_10, Degree=3, Periodic=False, KnotStyle=1)  # -> Curve, Length, Domain
intcrv_3 = Interpolate(Vertices=curvepoint_13, Degree=3, Periodic=False, KnotStyle=1)  # -> Curve, Length, Domain
intcrv_4 = Interpolate(Vertices=curvepoint_12, Degree=3, Periodic=False, KnotStyle=1)  # -> Curve, Length, Domain
merge = Merge(Data1=crv_8, Data2=intcrv.Curve, Data3=crv_7)
merge_2 = Merge(Data1=bzspan_2.Curve, Data2=bzspan_3.Curve, Data3=bzspan.Curve)
merge_3 = Merge(Data1=crv_2, Data2=intcrv_2.Curve, Data3=crv)
merge_4 = Merge(Data1=bzspan_5.Curve, Data2=bzspan_6.Curve, Data3=bzspan_4.Curve)
merge_5 = Merge(Data1=crv_4, Data2=intcrv_3.Curve, Data3=crv_3)
merge_6 = Merge(Data1=crv_6, Data2=intcrv_4.Curve, Data3=crv_5)
merge_7 = Merge(Data1=bzspan_5.Curve, Data2=bzspan_7.Curve, Data3=bzspan_2.Curve)
merge_8 = Merge(Data1=bzspan.Curve, Data2=bzspan_8.Curve, Data3=bzspan_4.Curve)
netsurf = NetworkSurface(CurvesU=merge_3, CurvesV=merge_4, Continuity=2)
netsurf_2 = NetworkSurface(CurvesU=merge, CurvesV=merge_2, Continuity=2)
netsurf_3 = NetworkSurface(CurvesU=merge_5, CurvesV=merge_7, Continuity=2)
netsurf_4 = NetworkSurface(CurvesU=merge_6, CurvesV=merge_8, Continuity=2)
merge_9 = Merge(Data1=netsurf_2, Data2=netsurf, Data3=netsurf_3, Data4=netsurf_4)
