# Grasshopper definition simple_slicer_grasshopper_is.gh (Grasshopper 1.0.7)
# plug-ins: Bifocals

mesh = Mesh(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)
brep = Brep(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)
layer_height_mm = Slider(6.02, range=0..10)
distance_between_points_mm = Slider(20, range=5..50)
slice = BooleanToggle(True)

# ---- group: input_geometry
geo = Geometry(mesh)

# ---- group: Parameters
# Direct design through curves
number_slider = Slider(43, range=0..100)
layer_height = Slider(1, range=0..10)
layer_count = Slider(100, range=0..100)
div_pt_count = Slider(11, range=0..100)
number_slider_2 = Slider(15, range=0..100)
rotation_per_layer = Slider(0.93, range=0..5)

# ----
# Slicing existing geometry
slicer = GhPythonScript(slice=slice, input_geometry=geo, layer_height=layer_height_mm, distance_between_points=distance_between_points_mm)  # -> out, crvs, pts
# ---------- slicer: Python ----------
__author__ = "joburger"
__version__ = "2019.10.28"

import Rhino
import Rhino.Geometry as rg

import mini_eggshell.slicer.simple_slicer
reload(mini_eggshell.slicer.simple_slicer)

slicer = mini_eggshell.slicer.simple_slicer.Slicer(layer_height, distance_between_points)

if slice:
    if str(input_geometry.ObjectType) == "Mesh":
        print "Input geometry is of Mesh type"  
        crvs = slicer.create_contour_curves_from_mesh(input_geometry)
    elif str(input_geometry.ObjectType) == "Brep":
        print "Input geometry is of Brep type"
        crvs = slicer.create_contour_curves_from_brep(input_geometry)
    else:
        print "Input geometry not supported"
    
    pts = slicer.divide_curves_in_points()
# ---------- end slicer ----------
python = GhPythonScript(
    radius=number_slider,
    layer_count=layer_count,
    layer_height=layer_height,
    div_pt_count=div_pt_count,
    div_pt_offset=number_slider_2,
    rotation_per_layer=rotation_per_layer)  # -> out, moved_div_pt_list, polyline_list; inputs radius: Int32, layer_count: Int32
# ---------- python: Python ----------
__author__ = "joburger"
__version__ = "2019.10.03"

import Rhino.Geometry as rg
import math

start_point = rg.Point3d(0,0,0)
start_circle = rg.Circle(start_point, radius)

# script which generates a tower/column/pen holder

# create empty lists

moved_div_pt_list = []
polyline_list = []

# create a midpoint
for i in range(layer_count):
    polyline_points = []
    print(i)
    mid_pt = rg.Point3d(0,0, layer_height * i)
    # create a circle
    base_circle = rg.Circle(mid_pt, radius)
    # rotate the circle
    rotation_xform = rg.Transform.Rotation(math.radians(rotation_per_layer*i), mid_pt)
    rg.Circle.Transform(base_circle, rotation_xform)
    # divide the circle
    circle_curve = rg.Circle.ToNurbsCurve(base_circle)
    div_params = rg.Curve.DivideByCount(circle_curve, div_pt_count * 2, True)
    for j, param in enumerate(div_params):
        print("j", j)
        print("param", param)
        div_pt = rg.Curve.PointAt(circle_curve, param)
        #div_pt_list.append(div_pt)
        # move the circle's control points
        # create vectors and visualize
        div_pt_vector = div_pt - mid_pt
        vector_line = rg.Line(mid_pt, div_pt_vector)
        rg.Vector3d.Unitize(div_pt_vector)
        
        # if even: move points with divptoffset
        if j % 2 == 0:
            # create a horizontal offset based on sine curves
            hor_sin_offset = math.sin(j* (4*math.pi)/div_pt_count)
            # create a vertical offset based on sine curves
            vert_sin_offset = math.sin(i * (2*math.pi)/layer_count)
            moved_div_pt = div_pt + (div_pt_vector * div_pt_offset * vert_sin_offset * hor_sin_offset)
        # if uneven: do not move
        else:
            moved_div_pt = div_pt
        
        moved_div_pt_list.append(moved_div_pt)
        polyline_points.append(moved_div_pt)
        
    # create polylines and append to list
    polyline = rg.PolylineCurve(polyline_points + [polyline_points[0]])
    polyline_list.append(polyline)
# ---------- end python ----------

# ---- group: output_curves
crv = Curve(slicer.crvs)

# ---- group: output_points
pt = Point(slicer.pts)

# ----
list_length = ListLength(List=pt)
panel = Panel(list_length)

# ---- group: Printing time
printing_speed_mm_s = Slider(40, range=0..100)
pline = PolyLine(Vertices=pt, Closed=False)
len = Length(Curve=pline)
division = Division(A=len, B=printing_speed_mm_s)
division_2 = Division(A=division, B=60)
total_print_time_minutes = Panel(division_2)

# ---- group: Printing path visualization
number_slider_3 = Slider(1000, range=0..1000)
dom = ConstructDomain(DomainStart=Slider(0, range=0..1000), DomainEnd=Slider(1661, range=0..2000))
subset = SubList(List=pt, Domain=dom, Wrap=True)  # -> List, Index
pline_2 = PolyLine(Vertices=subset.List, Closed=False)

# ---- group: output_curves
crv_2 = Curve(python.polyline_list)

# ---- group: output_points
pt_2 = Point(python.moved_div_pt_list)

# ---- group: Printing time
printing_speed_mm_s_2 = Slider(40, range=0..100)
pline_3 = PolyLine(Vertices=pt_2, Closed=False)
len_2 = Length(Curve=pline_3)
division_3 = Division(A=len_2, B=printing_speed_mm_s_2)
division_4 = Division(A=division_3, B=60)
total_print_time_minutes_2 = Panel(division_4)

# ---- group: Printing path visualization
dom_2 = ConstructDomain(DomainStart=Slider(0, range=0..1000), DomainEnd=Slider(1000, range=0..1000))
subset_2 = SubList(List=pt_2, Domain=dom_2, Wrap=True)  # -> List, Index
pline_4 = PolyLine(Vertices=subset_2.List, Closed=False)
