# Grasshopper definition Spiralize-Mesh-2-polymorph.gh (Grasshopper 1.0.7)

mesh = Mesh(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)
cluster = Cluster(C=mesh, end_plane_rotation=Slider(15, range=0..100), distance_between_points=Slider(10, range=0..10000))
pline = PolyLine(Vertices=cluster, Closed=False)
explode = Explode(Curve=pline, Recursive=True)  # -> Segments, Vertices
xy = XYPlane(Origin=explode.Vertices)

# ==== cluster Cluster
distance_between_points = ClusterInput()
end_plane_rotation = ClusterInput()
C = ClusterInput()
bbox = BoundingBox(Content=C, Plane=PlaneXY(0, 0, 0))  # -> Box, Box_2
debrep = DeconstructBrep(Brep=bbox.Box)  # -> reverse(Faces), Edges, Vertices
area = Area(Geometry=debrep.Faces)  # -> Area, Centroid
scale = Scale(Geometry=debrep.Faces, Center=area.Centroid, Factor=Slider(2, range=0..10))  # -> Geometry, Transform
item = ListItem(List=scale.Geometry, Index=0, Wrap=True)  # -> Item, Item1

srf = Surface(item.Item1)
Z = UnitZ(Factor=Slider(0.01, range=0..0.01))
move = Move(Geometry=srf, Motion=Z)  # -> Geometry, Transform

debrep_2 = DeconstructBrep(Brep=move.Geometry)  # -> Faces, Edges, Vertices
item_2 = ListItem(List=debrep_2.Vertices, Index=0, Wrap=True)  # -> Item, Item1, Item2, Item3
crv = Curve(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)
bbox_2 = BoundingBox(Content=crv, Plane=PlaneXY(0, 0, 0))  # -> Box, Box_2
mesh = Mesh(C)
bbox_3 = BoundingBox(Content=mesh, Plane=PlaneXY(0, 0, 0))  # -> Box, Box_2
xy = XYPlane(Origin=Point(0, 0, 0))
xz = XZPlane(Origin=Point(0, 0, 0))
volume = Volume(Geometry=bbox_3.Box_2)  # -> Volume, Centroid

area_2 = Area(Geometry=item.Item)  # -> Area, Centroid
neg = Negative(Value=end_plane_rotation)
xz_2 = XZPlane(Origin=area_2.Centroid)
rotate = Rotate(Geometry=item.Item, Angle=degrees(neg), Plane=xz_2)  # -> Geometry, Transform
Z_2 = UnitZ(Factor=Slider(23, range=0..100))

neg_2 = Negative(Value=Z_2)

move_2 = Move(Geometry=rotate.Geometry, Motion=neg_2)  # -> Geometry, Transform

debrep_3 = DeconstructBrep(Brep=move_2.Geometry)  # -> Faces, Edges, Vertices
item_3 = ListItem(List=debrep_3.Vertices, Index=0, Wrap=True)  # -> Item, Item1, Item2, Item3
tbox = TwistedBox(
    CornerA=item_3.Item,
    CornerB=item_3.Item1,
    CornerC=item_3.Item2,
    CornerD=item_3.Item3,
    CornerE=item_2.Item,
    CornerF=item_2.Item1,
    CornerG=item_2.Item2,
    CornerH=item_2.Item3)
morph = BoxMorph(Geometry=crv, Reference=bbox_2.Box, Target=tbox)
rotate_2 = Rotate(Geometry=xy, Angle=degrees(neg), Plane=xz)  # -> Geometry, Transform
divlength = DivideLength(Curve=morph, Length=distance_between_points)  # -> Points, Tangents, Parameters
lng = ListLength(List=divlength.Points)
vec2pt = Vector2Pt(PointA=divlength.Points, PointB=volume.Centroid, Unitize=False)  # -> Vector, Length
range = Range(Domain=Domain(0, 1), Steps=lng)
devec = DeconstructVector(Vector=vec2pt.Vector)  # -> XComponent, YComponent, ZComponent
twn2plns = TweenTwoPlanes(PlaneA=xy, PlaneB=rotate_2.Geometry, Factor=range, Quaternion=True)
vec = VectorXYZ(XComponent=devec.XComponent, YComponent=devec.YComponent, ZComponent=0)  # -> Vector, Length
rev = ReverseList(List=twn2plns)
pl_origin = PlaneOrigin(Base=rev, Origin=divlength.Points)
align = AlignPlane(Plane=pl_origin, Direction=vec.Vector)  # -> Plane, Angle
deplane = DeconstructPlane(Plane=align.Plane)  # -> Origin, XAxis, YAxis, ZAxis
project = ProjectPoint(Point=divlength.Points, Direction=deplane.XAxis, Geometry=mesh)  # -> Point, Index
print_path = ClusterOutput(project.Point)
