# Grasshopper definition Spiralize-bottom-polymorph.gh (Grasshopper 1.0.4)
# plug-ins: Pufferfish

brep = Brep(<brep referenced from the Rhino model>)
mesh = Mesh(<mesh referenced from the Rhino model>)
mesh_2 = MeshBrep(
    Brep=brep,
    Settings={GridMaxCount=0, GridMinCount=16, JaggedSeams=False, MaxEdgeLength=0, MinEdgeLength=0.0001, MinTolerance=0, Refine=True, RefineAngle=0, RelativeTolerance=0.65, SimplePlanes=True, Tolerance=0})
bbox = BoundingBox(Content=mesh, Plane=PlaneXY(0, 0, 0))  # -> Box, Box_2
debrep = DeconstructBrep(Brep=bbox.Box)  # -> Faces, Edges, Vertices
item = ListItem(List=debrep.Faces, Index=4, Wrap=True)
Z = UnitZ(Factor=Slider(0.1, range=0..1))
move = Move(Geometry=item, Motion=Z)  # -> Geometry, Transform
sec = MeshPlane(Mesh=mesh, Plane=move.Geometry)
# ~ 2mm between lines
number_slider = Slider(52, range=0..100)
crv = Curve(sec)
area = Area(Geometry=crv)  # -> Area, Centroid
cir = Circle(Plane=area.Centroid, Radius=Slider(0.5, range=0..1))
divide = DivideCurve(Curve=cir, Count=10, Kinks=False)  # -> Points, Tangents, Parameters

# ---- group: SEAM PT
pt = Point(<point referenced from the Rhino model>)

# ----
pline = PolyLine(Vertices=divide.Points, Closed=True)
range = Range(Domain=Domain(0, 1), Steps=number_slider)

# ---- group: 2ND LAYER CHANGE SEAM
crv_cp = CurveClosestPoint(Point=pt, Curve=crv)  # -> Point, Parameter, Distance
seam = Seam(Curve=crv, Seam=crv_cp.Parameter)

# ----
twn2crvs = TweenTwoCurves(CurveA=seam, CurveB=pline, Factor=range, Refit=0, PointSample=0)
lng = ListLength(List=twn2crvs)
cull_i = CullIndex(List=twn2crvs, Indices=lng, Wrap=True)

# ---- group: SPIRAL
number_slider_2 = Slider(500, range=0..500)
divide_2 = DivideCurve(Curve=cull_i, Count=number_slider_2, Kinks=False)  # -> Points, Tangents, Parameters

# ---- group: NON SPIRAL
divide_3 = DivideCurve(Curve=twn2crvs, Count=number_slider_2, Kinks=False)  # -> Points, Tangents, Parameters
pline_2 = PolyLine(Vertices=divide_3.Points, Closed=True)
smoothpline = SmoothPolyline(Polyline=pline_2, Strength=1, Times=1)

# ----
pline_3 = PolyLine(Vertices=divide_2.Points, Closed=True)
smoothpline_2 = SmoothPolyline(Polyline=pline_3, Strength=1, Times=1)
non_spiral_crvs = Curve(smoothpline)
divide_4 = DivideCurve(Curve=smoothpline_2, Count=number_slider_2, Kinks=False)  # -> flatten(Points), Tangents, Parameters

# ---- group: SPIRAL (continued)
intcrv = Interpolate(Vertices=divide_4.Points, Degree=3, Periodic=False, KnotStyle=1)  # -> Curve, Length, Domain

# ----
spiral_crv = Curve(intcrv.Curve)
