# Grasshopper definition 191028_ur_online_control_gh_group_03_is.gh (Grasshopper 1.0.7)

# layer height = 4
# for the mid size nozzle
panel = Panel("-181 bottom extruder")
panel_2 = Panel("-172")
number_slider = Slider(1, range=0..100)
number_slider_2 = Slider(3, range=0..100)
pt = ConstructPoint(XCoordinate=Slider(80, range=-100..100), YCoordinate=Slider(-170, range=-500..100), ZCoordinate="-20")

# ---- group: Robot
# 0a
# Settings
# Check your IP address and set UR IP address
server_address = ValueList({"192.168.10.2", "192.168.10.11", "127.0.0.1"}, selected="192.168.10.11")
ur_ip = ValueList({"192.168.10.13", "192.168.10.11", "192.168.10.10", "127.0.0.1"}, selected="192.168.10.13")
server_port = Integer(30003)
globals = PythonScript(server_address=server_address, server_port=server_port, ur_ip=ur_ip)  # inputs server_port: Int32
# ---------- globals: Python ----------
from scriptcontext import sticky as st

st["server_address"] = server_address
st["server_port"] = server_port

st["ur_ip"] = ur_ip
# ---------- end globals ----------

# Check if UR is available
ping = Button()
py = PythonScript(ip=ur_ip, ping=ping)  # -> out
# ---------- py: Python ----------
from scriptcontext import sticky as st
from mini_eggshell.ur_online_control.ur_direct.utilities import is_available


guid = str(ghenv.Component.InstanceGuid)
txt_key = "txt_" + guid
if txt_key not in st:
    st[txt_key] = ""

if ping:
    
    available = is_available(ip)
    
    if available:
        st[txt_key] = "%s is up!" % ip
    else:
        st[txt_key] = "%s is down!" % ip

print st[txt_key]
# ---------- end py ----------
panel_3 = Panel(py)

# ----
series = Series(Start=0, Step=number_slider_2, Count=number_slider)
Z = UnitZ(Factor=series)
cir = Circle(Plane=pt, Radius=Slider(65, range=0..100))
integer_division = IntegerDivision(A=number_slider_2, B=2)
range = Range(Domain=Domain(0, 1), Steps=number_slider)
move = Move(Geometry=cir, Motion=Z)  # -> Geometry, Transform

# ---- group: Robot
bang = Button()
panel_4 = Panel("Unload libraries")
# 1. load robot model
# 2. set tool
# 3. set basis
unload = PythonScript(bang=bang)
# ---------- unload: Python ----------
from compas_ghpython import unload_modules

unload_modules("compas")
unload_modules("ur_online_control")
# ---------- end unload ----------

# ----
graph = GraphMapper(range, x0=0, x1=1, y0=0, y1=1, container_name="Sine", Equation_px=[0, 1], Equation_py=[0.7653694153, 0.9405152202])
pipe = Pipe(Curve=move.Geometry, Radius=integer_division, Caps=1)  # -> flatten(Pipe)
area = Area(Geometry=move.Geometry)  # -> Area, Centroid
cap = CapHoles(Brep=pipe)

# ---- group: Robot
# 1. load robot model
# 2. set tool
# 3. set basis
list = ValueList({"no_tool": 0, "plastic_extruder": 1, "clay_extruder": 2, "clay_extruder_SS": 3}, selected="clay_extruder")
tools = Tools(tool_id=list)
base = PythonScript()  # -> base_frame, base
# ---------- base: Python ----------
from compas.geometry import Frame

"""
origin = [0, 0, 0]
xaxis = [1, 0, 0]
yaxis = [0, 1, 0]


origin = [-313.92, -147.58, 13.79]
xaxis = [0.00000, -1.00000, 0.00000]
yaxis = [1.00000, 0.00000, 0.00000]
"""

#axis    Y         Z                        X



#UR 10 floor setup

origin = [-1140.17, 557.94, -396.35]
xaxis = [0.00000, -1.00000, 0.00000]
yaxis = [1.00000, 0.00000, 0.00000]


#UR 5 floor setup
 
#origin = [-706.51, -83.77, -478.98]
#xaxis = [1.00000, 0.00000, 0.00000]
#yaxis = [0.00000, 1.00000, 0.00003]


#UR5 base setup 
#origin = [164.22, 132.43, -23.59]
#xaxis = [0.97604, -0.21760, 0.00000]
#yaxis = [0.21760, 0.97604, 0.00000]

base_frame = Frame(list(origin), list(xaxis), list(yaxis))

base = "base = " + str(origin) + "\n"
# ---------- end base ----------
list_2 = ValueList({"UR5", "UR10"}, selected="UR10")
robot = PythonScript(model=list_2, tool=tools, base_frame=base.base_frame)  # -> robot
# ---------- robot: Python ----------
from mini_eggshell.ur_online_control.ur.ur10 import UR10
from mini_eggshell.ur_online_control.ur.ur5 import UR5
from scriptcontext import sticky as st

if model == "UR5":
    robot = UR5()
elif model == "UR10":
    robot = UR10()

if tool:
    robot.set_tool(tool)
if base_frame:
    robot.set_base(base_frame)

st["robot"] = robot
# ---------- end robot ----------

# ----
cull_i = CullIndex(List=graph, Indices=-1, Wrap=True)
scale = Scale(Geometry=move.Geometry, Center=area.Centroid, Factor=cull_i)  # -> Geometry, Transform

# ---- group: mm3 to Litres
volume = Volume(Geometry=cap)  # -> Volume, Centroid
multiplication = Multiplication(A=volume.Volume, B="0.000001")
ma = MassAddition(Input=multiplication)  # -> Result, PartialResults
panel_5 = Panel(ma.Result)

# ----
divide = DivideCurve(Curve=scale.Geometry, Count=Slider(12, range=0..100), Kinks=False)  # -> Points, Tangents, Parameters

# ----
# Master Control
circle_1_rad = Slider(75, range=0..10000)
division_point = Slider(36, range=0..100)
circle_2_rad = Slider(70, range=0..250)
circle_3_rad = Slider(35, range=0..250)

# ----
# POSITION !
md_slider = MDSlider(
    SliderMode=0,
    slider_value=Point(0.1964168937, 0.4337500595, 0.5),
    x_domain=Domain(0, 500),
    y_domain=Domain(0, 500),
    z_domain=Domain(0, 1))
deconstruct = Deconstruct(Point=md_slider)  # -> XComponent, YComponent, ZComponent
Z_2 = Slider(-1.5, range=-50..50)

panel_6 = Panel(base.base)
ur_5_tool_angle = Slider(80, range=0..100)
point = Point()

# ---- group: Fabrication planes
pln = Plane(flatten(divide.Points))

# ----
# Sequence 3
layer_height = Slider(1.8, range=0..6)
layer_count = Slider(6, range=0..100)
rotation_layer = Slider(0, range=-3..3)

# ----
# Sequence 3
layer_height_2 = Slider(2, range=0..6)
layer_count_2 = Slider(6, range=0..100)
rotation_layer_2 = Slider(-0.5, range=-3..3)

# ----
# Sequence 2
layer_height_3 = Slider(1.8, range=0..6)
layer_count_3 = Slider(6, range=0..100)
rotation_layer_3 = Slider(0.5, range=-3..3)

# ----
# Sequence 1
layer_height_4 = Slider(1.5, range=0..6)
layer_count_4 = Slider(6, range=0..100)
rotation_layer_4 = Slider(0, range=-3..3)

# ----
# PLANE ROTATION
ur_10_tool_angle = Slider(90, range=0..100)
number_slider_3 = Slider(0, range=0..1000)

rotation_layer_5 = Slider(0, range=-3..3)
number_slider_4 = Slider(490, range=0..1000)
point_2 = Point("0,0,100")
point_3 = Point("0,0,0")
xy_plane = XYPlane(Origin=point_2)
xy_plane_2 = XYPlane(Origin=point_3)

# ---- group: test_pt
pt_2 = Point(Point(143.5449512, 26.81423755, 319.3127676))
xy = XYPlane(Origin=pt_2)
rotate = Rotate(Geometry=xy, Angle=degrees(ur_10_tool_angle), Plane=xy)  # -> Geometry, Transform

# ---- group: filament_loading_pt
pt_3 = Point(Point(7.266607641, 97.95218925, 356.2487973))
xy_2 = XYPlane(Origin=pt_3)
rotate_2 = Rotate(Geometry=xy_2, Angle=degrees(ur_10_tool_angle), Plane=xy_2)  # -> Geometry, Transform

# ----
rectangle = Rectangle(Plane=xy_plane_2, XSize=number_slider_4, YSize=number_slider_4, Radius=0)  # -> Rectangle, Length
number_slider_5 = Slider(0, range=0..1000)
surface = Surface(rectangle.Rectangle)
santos = Panel("python C:\Users\indra\Documents\GIT\mini_eggshell\ur_online_control\communication\main_direct_send_group_03.py")

# ----
# Direct UR control
get = Button()
get_2 = Button()
pose = PythonScript(get=get_2)  # -> pose_joints
# ---------- pose: Python ----------
from scriptcontext import sticky as st
from mini_eggshell.ur_online_control.ur_direct import get_current_pose_joints
from mini_eggshell.ur_online_control.ur.robot import BaseConfiguration

server_address = st["server_address"]
server_port = 30005
ur_ip = st["ur_ip"]
robot = st["robot"]
tool_angle_axis = list(robot.tool.tcp_frame.point) + list(robot.tool.tcp_frame.axis_angle_vector)
print tool_angle_axis

guid = str(ghenv.Component.InstanceGuid)
pose_joints_key = "pose_joints" + guid

if get:
    st[pose_joints_key] = get_current_pose_joints(server_address, server_port, ur_ip, tool_angle_axis)
    
if pose_joints_key not in st:
    pose_joints = []
else:
    pose_joints = BaseConfiguration.from_joints(st[pose_joints_key])
# ---------- end pose ----------
pose_2 = PythonScript(get=get)  # -> pose_cartesian
# ---------- pose_2: Python ----------
from scriptcontext import sticky as st
from mini_eggshell.ur_online_control.ur_direct import get_current_pose_cartesian

server_address = st["server_address"]
server_port = 30005
ur_ip = st["ur_ip"]
robot = st["robot"]

tool_angle_axis = list(robot.tool.tcp_frame.point) + robot.tool.tcp_frame.axis_angle_vector
print tool_angle_axis

guid = str(ghenv.Component.InstanceGuid)
pose_cartesian_key = "pose_cartesian" + guid


if get:
    st[pose_cartesian_key] = get_current_pose_cartesian(server_address, server_port, ur_ip, tool_angle_axis)

if pose_cartesian_key not in st:
    pose_cartesian = []
else:
    pose_cartesian = st[pose_cartesian_key]
# ---------- end pose_2 ----------
stop = Button()
stop_2 = PythonScript(stop=stop)
# ---------- stop_2: Python ----------
from scriptcontext import sticky as st
from mini_eggshell.ur_online_control.ur_direct import stop as stop_robot

ur_ip = st["ur_ip"]

if stop:
    stop_robot(ur_ip)
# ---------- end stop_2 ----------
panel_7 = Panel(pose)
panel_8 = Panel(pose_2)

# ----
# 0b
vertical_pose = Number([-152.427, -780.635, 855.229, -1.1958, -1.22046, -1.20201])
back = Button()
reset = Button()
md_slider_2 = MDSlider(
    SliderMode=0,
    slider_value=Point(0.3184568692, 0.3293040206, 0.5),
    x_domain=Domain(0, 500),
    y_domain=Domain(0, 500),
    z_domain=Domain(0, 1))

# ---- group: Define joint positions
base_2 = Slider(90.163, range=-360..360)
shoulder = Slider(0, range=-360..360)
elbow = Slider(-102.857, range=-360..360)
wrist1 = Slider(0, range=-360..360)
wrist2 = Slider(0, range=-360..360)
wrist3 = Slider(0, range=-360..360)
ur1_q1_q6 = Data([base_2, shoulder, elbow, wrist1, wrist2, wrist3])

# ----
pt_4 = Point(Point(200, 200, 0))
pt_5 = Point(Tree({0}: [Point(252.4894531, 200.2293976, 0), Point(246.7415032, 208.1163672, 0), Point(255.663184, 211.8365708, 0), Point(259.8611815, 220.646794, 0), Point(269.6080859, 221.1377846, 0), Point(273.8060835, 229.9480078, 0)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], {1}: [Point(247.5003915, 199.95576, 1.5), Point(252.3590459, 207.9861831, 1.5), Point(252.7553366, 215.6521418, 1.5), Point(262.1330689, 216.042472, 1.5), Point(265.836294, 224.6668758, 1.5), Point(275.2140262, 225.057206, 1.5)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], {2}: [Point(252.1337157, 199.8901021, 3), Point(248.2604565, 207.7629189, 3), Point(255.5154332, 211.6385277, 3), Point(259.3037149, 219.552585, 3), Point(268.0275425, 220.4897156, 3), Point(271.8158242, 228.4037729, 3)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], {3}: [Point(247.8776443, 200.2458175, 4.5), Point(252.9756461, 207.1213782, 4.5), Point(253.1332554, 214.8952742, 4.5), Point(261.6451809, 215.7953197, 4.5), Point(265.1356031, 223.6106834, 4.5), Point(273.6475286, 224.5107288, 4.5)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], {4}: [Point(251.9193253, 199.6630169, 6), Point(249.3240747, 207.4189096, 6), Point(255.6458691, 211.3740567, 6), Point(259.079507, 218.7969488, 6), Point(267.173298, 219.9715732, 6), Point(270.6069359, 227.3944653, 6)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], {5}: [Point(248.1013343, 200.4386752, 7.5), Point(253.4697678, 206.3613396, 7.5), Point(253.3703344, 214.2365061, 7.5), Point(261.2802554, 215.3902752, 7.5), Point(264.4472953, 222.72975, 7.5), Point(272.3572163, 223.8835191, 7.5)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]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))
pt_6 = Point(Tree({0}: [Point(252.0514299, 198.5711419, 0), Point(251.8812931, 207.0751187, 0), Point(259.9168758, 209.863663, 0), Point(261.1732562, 217.922049, 0), Point(269.6491209, 218.6335855, 0), Point(271.5904222, 226.914764, 0)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], {1}: [Point(247.8965949, 201.3511798, 1.5), Point(255.8284673, 204.4476893, 1.5), Point(255.3467191, 212.948918, 1.5), Point(264.1357356, 214.3137687, 1.5), Point(266.1575964, 222.5851077, 1.5), Point(274.6479851, 223.2302979, 1.5)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], {2}: [Point(251.8408628, 198.9155442, 3), Point(251.6625614, 207.0315155, 3), Point(258.8477112, 210.8096638, 3), Point(260.8595904, 218.0227612, 3), Point(268.8966998, 219.1654133, 3), Point(271.4572949, 226.8689277, 3)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], {3}: [Point(248.1175453, 201.0105367, 4.5), Point(255.1511398, 205.0784571, 4.5), Point(255.2415876, 213.7773872, 4.5), Point(263.2932981, 214.8679768, 4.5), Point(265.9155651, 222.5584348, 4.5), Point(273.9672756, 223.6490243, 4.5)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], {4}: [Point(251.7528959, 199.1486932, 6), Point(251.2692537, 207.0741087, 6), Point(257.4968751, 210.7548398, 6), Point(260.4110636, 218.1408824, 6), Point(268.2382611, 219.4754609, 6), Point(271.1524495, 226.8615035, 6)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], {5}: [Point(248.2135538, 200.7784454, 7.5), Point(254.5520093, 205.568216, 7.5), Point(254.7187798, 213.902057, 7.5), Point(262.5576697, 215.1942355, 7.5), Point(265.5189069, 222.5664125, 7.5), Point(273.3577968, 223.858591, 7.5)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]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))
pt_7 = Point(Point(200, 200, 0))

# ----
# Measure basis:
# 1. Clear the recorded poses
# 2. Move robot to origin and press "get pose"
# 3. Move robot to point in positive x-axis and press "get pose"
# 4. Move robot to an other point in your basis and press "get pose"
# (The farer away these positions are, the better)
# 
# 5. Alternatively change the order in the component calc base
# 6. Copy output into base component
# Calculate basis
list_3 = ValueList({"origin, pt on positive x-axis, pt in xy plane": 0, "origin, pt on positive y-axis, pt in xy plane": 1}, selected="origin, pt on positive x-axis, pt in xy plane")
clear = Button()
rec = PythonScript(msg=pose_2, rec=get, clear=clear)  # -> rec; inputs msg: list
# ---------- rec: Python ----------
from scriptcontext import sticky as st

guid = str(ghenv.Component.InstanceGuid)
recorded_key =  "recorded_" + guid
just_cleared_key = "just_cleared_" + guid

if recorded_key not in st:
    st[recorded_key] = []

if just_cleared_key not in st:
    st[just_cleared_key] = False

if clear:
    st[recorded_key] = []
    st[just_cleared_key] = True
else:
    if len(msg):
        if msg != [None] and not st[just_cleared_key] and rec:
            st[recorded_key].append(msg)
    st[just_cleared_key] = False
        


rec = st[recorded_key]

print rec
# ---------- end rec ----------
calc_base = PythonScript(poses=rec, input_type=list_3)  # -> out; inputs poses: list
# ---------- calc_base: Python ----------
import Rhino.Geometry as rg
import math


if len(poses) > 2:
    
    O = poses[0]
    P1 = poses[1]
    P2 = poses[2]
    
    if input_type == 0:
        # origin, pt on positive x-axis, pt in xy plane
        origin = rg.Point3d(O[0], O[1], O[2])
        pt_on_xaxis = rg.Point3d(P1[0], P1[1], P1[2])
        pt_in_xyplane = rg.Point3d(P2[0], P2[1], P2[2])
        
        xaxis = pt_on_xaxis - origin
        xaxis.Unitize()
        
        v = pt_in_xyplane - origin
        zaxis = rg.Vector3d.CrossProduct(v, xaxis)
        zaxis.Unitize()
        
        # zaxis must look up!
        if math.acos(rg.Vector3d.ZAxis * zaxis) > math.acos(rg.Vector3d.ZAxis * -zaxis):
            zaxis = -zaxis
        
        yaxis = rg.Vector3d.CrossProduct(zaxis, xaxis)
    
    elif input_type == 1:
        # origin, pt on positive y-axis, pt in xy plane
        origin = rg.Point3d(O[0], O[1], O[2])
        pt_on_yaxis = rg.Point3d(P1[0], P1[1], P1[2])
        pt_in_xyplane = rg.Point3d(P2[0], P2[1], P2[2])
        
        yaxis = pt_on_yaxis - origin
        yaxis.Unitize()
        
        v = pt_in_xyplane - origin
        zaxis = rg.Vector3d.CrossProduct(v, yaxis)
        zaxis.Unitize()
        
        # zaxis must look up!
        if math.acos(rg.Vector3d.ZAxis * zaxis) > math.acos(rg.Vector3d.ZAxis * -zaxis):
            zaxis = -zaxis
        
        xaxis = rg.Vector3d.CrossProduct(yaxis, zaxis)
        
        
    print "Copy the following into base component:"
    print " "
    print "origin = [%.2f, %.2f, %.2f]" % tuple(list(origin))
    print "xaxis = [%.5f, %.5f, %.5f]" % tuple(list(xaxis))
    print "yaxis = [%.5f, %.5f, %.5f]" % tuple(list(yaxis))
    

#print rg.Vector3d.CrossProduct(rg.Vector3d.YAxis, rg.Vector3d.ZAxis)
#print rg.Vector3d.CrossProduct(rg.Vector3d.ZAxis, rg.Vector3d.XAxis)
# ---------- end calc_base ----------
panel_9 = Panel(rec)
panel_10 = Panel(calc_base)

py_2 = GhPythonScript(joint_values=ur1_q1_q6)  # -> configuration; inputs joint_values: list
# ---------- py_2: Python ----------
import math
from ur_online_control.ur.robot import BaseConfiguration

configuration = BaseConfiguration.from_joints([math.radians(d) for d in joint_values])
# ---------- end py_2 ----------
orient = Orient(Geometry=pt_5, Source=pt_4, Target=md_slider_2)  # -> Geometry, Transform
rotate_3 = Rotate(Geometry=orient.Geometry, Angle=Slider(34, range=0..360), Plane=md_slider_2)  # -> Geometry, Transform

# ---- group: Visualise / robot model brep
py_3 = PythonScript(model=list_2)  # -> n
# ---------- py_3: Python ----------
if model == "UR5":
    n = 0
if model == "UR10":
    n = 1

print n
# ---------- end py_3 ----------
ur10_brep = UR10Brep([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])
ur5_brep = UR5Brep([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])
show_brep = BooleanToggle(False)
filter = StreamFilter(Gate=py_3, Stream0=ur5_brep, Stream1=ur10_brep)

# ----
pt_8 = Point(rotate_3.Geometry)
tstat = TreeStatistics(Tree=pt_8)  # -> Paths, Length, Count
item = ListItem(List=tstat.Length, Index=0, Wrap=True)
multiplication_2 = Multiplication(A=item, B=Slider(17, range=0..100))
panel_11 = Panel(multiplication_2)
partition = PartitionList(List=flatten(pt_8), Size=multiplication_2)
data_dam = DataDam(DataA=Slider(2, range=0..2), BufferDelay=10000000, BufferMode=0)
branch = TreeBranch(Tree=simplify(partition), Path=data_dam, MaintainPaths=True)

# ----
# to INPUT
xy_plane_3 = XYPlane(Origin=Point(0, 0, 0))

# ----
# SEND TO 0,0,0
panel_12 = Panel("0,0,0")

panel_13 = Panel("490,490,0")

# ----
# to INPUT
xy_plane_4 = XYPlane(Origin=branch)

# ----
# INPUT
pln_2 = Plane(flatten(xy_plane_4))

rotate_4 = Rotate(Geometry=pln_2, Angle=degrees(ur_10_tool_angle), Plane=pln_2)  # -> Geometry, Transform

# ---- group: Define commands
speed = Slider(15, range=0..300)
# SAVE POINT
safe_speed = Slider(10, range=0..300)
# 1
number_slider_6 = Slider(10, range=0..100)
planes_wcs = Plane(rotate_4.Geometry)
python = PythonScript(planes_WCS=planes_wcs, dfillet=number_slider_6, speed=speed, safe_speed=safe_speed, safe_pt=rotate_2.Geometry)  # -> commands; inputs planes_WCS: list of Plane, speed: Int32, safe_pt: Plane
# ---------- python: Python ----------
import Rhino.Geometry as rg
from compas.geometry import Frame
from compas.geometry import Transformation
from scriptcontext import sticky as st


robot = st["robot"]
buffer = 0.5

commands = []

def generate_cmds(planes_WCS, dfillet, speed, safe_speed, safe_pt):

    # add safe_pt as a starting point
    tcp_WCS_safe_pt = Frame(safe_pt.Origin, safe_pt.XAxis, safe_pt.YAxis)

    tcp_RCS_safe_pt = robot.get_frame_in_RCS(tcp_WCS_safe_pt)
    cmd_safe_pt = list(tcp_RCS_safe_pt.point) + tcp_RCS_safe_pt.axis_angle_vector + [safe_speed, 0]
    commands.append(cmd_safe_pt)


    # TODO this must be optimized! matrix multiplication!

    for i, plane_WCS in enumerate(planes_WCS):
        tcp_WCS = Frame(plane_WCS.Origin, plane_WCS.XAxis, plane_WCS.YAxis)
        if i == 0 or i == len(planes_WCS) - 1:
            radius = 0.

        else:
            # calculate blend radius
            prev, current, next = planes_WCS[i-1].Origin, planes_WCS[i].Origin, planes_WCS[i+1].Origin
            # print((prev - current).Length/2 * buffer, (next - current).Length/2 * buffer, dfillet)
            radius = min((prev - current).Length/2 * buffer, (next - current).Length/2 * buffer, dfillet)
            radius = round(radius,5)
        print(radius)
        # print()


        tcp_RCS = robot.get_frame_in_RCS(tcp_WCS)
        cmd = list(tcp_RCS.point) + tcp_RCS.axis_angle_vector + [speed, radius]
        commands.append(cmd)


    # add safe_pt as an end point
    commands.append(cmd_safe_pt)
    return commands


commands = generate_cmds(planes_WCS, dfillet, speed, safe_speed, safe_pt)

print commands[0]
# ---------- end python ----------

# ----
rotate_5 = Rotate(Geometry=xy_plane, Angle=degrees(ur_10_tool_angle), Plane=pln_2)  # -> Geometry, Transform
pln_3 = Plane(planes_wcs)

# ---- group: save_commands
py_4 = PythonScript()  # -> path
# ---------- py_4: Python ----------
import sys
import os

ghComp = ghenv.Component
ghDoc = ghComp.OnPingDocument()

# the full path of the gh file
path = ghDoc.FilePath
# the directory of the gh file
path = os.path.dirname(path)

path = os.path.abspath(os.path.join(path, ".."))

print path
# ---------- end py_4 ----------
move_filament_loading_pt = BooleanToggle(True)
continue_fabrication = BooleanToggle(True)
# 3
panel_14 = Panel(py_4)
save_json = Button()
commands = Data(python)
send = PythonScript(
    path=panel_14,
    continue_fabrication=continue_fabrication,
    commands=commands,
    move_filament_loading_pt=move_filament_loading_pt,
    save_json=save_json,
    name_json="commands_group_03.json")  # -> out; inputs continue_fabrication: Int32, commands: list, move_filament_loading_pt: Boolean
# ---------- send: Python ----------
import json
import os

from mini_eggshell.ur_online_control.communication.msg_identifiers import *
from mini_eggshell.ur_online_control.utilities.lists import flatten_list
from time import sleep


#number of values per command to be formatted 
len_command = len(commands[0])
gh_commands = flatten_list(commands)


#to print in gh panel
print len_command, "values each command"
print len(gh_commands)/len_command, "commands." , len(gh_commands), "values"


if move_filament_loading_pt:
    print "Moving to filament loading point"
else:
    print "Skipping filament loading point"


data = {}
data['move_filament_loading_pt'] = move_filament_loading_pt
data['len_command'] = len_command
data['gh_commands'] = gh_commands


filename = os.path.join(path, name_json)
if save_json:
    with open(filename, 'w') as f:
        json.dump(data, f)
# ---------- end send ----------

# ----
panel_15 = Panel(send)
item_2 = ListItem(List=pln_3, Index=0, Wrap=True)  # -> Item1, Item
pln_4 = Plane([item_2.Item1, item_2.Item])

# ----
# 2
# Visualisation
robot_2 = Data(robot)
pose_joints = Data(pose)
planes_wcs_2 = Plane(pln_4)

# ---- group: Calculate joint positions for path
# Add init joint states
joint_states = Data([-0.1728179112, -1.415058186, 1.813991282, -1.971940356, -1.571654205, -3.308720436])
init_configuration = Slider(2, range=0..7)
py_5 = PythonScript(robot=robot_2, planes_WCS=planes_wcs_2, configuration_idx=init_configuration, init_configuration=joint_states)  # -> configurations; inputs planes_WCS: list, configuration_idx: Int32, init_configuration: list
# ---------- py_5: Python ----------
from compas_ghpython import unload_modules
unload_modules('ur_online_control')
import Rhino.Geometry as rg
from compas.geometry import Frame 
from compas.geometry.xforms import Transformation
#from compas_ghpython import xdraw_frame
from ur_online_control.ur.kinematics import calculate_configurations_for_path, format_joint_positions


# TODO this must be optimized! matrix multiplication!
frames_tool0_RCS = []
for plane_WCS in planes_WCS:
    tcp_WCS = Frame(plane_WCS.Origin, plane_WCS.XAxis, plane_WCS.YAxis)
    tcp_RCS = robot.get_frame_in_RCS(tcp_WCS)
    frames_tool0_RCS.append(robot.get_tool0_frame_from_tcp_frame(tcp_RCS))
    

#configurations = calculate_configurations_for_path(frames_tool0_RCS, robot.params, init_configuration)
configurations = calculate_configurations_for_path(frames_tool0_RCS, robot, init_configuration)
print configurations
configurations = configurations[min([configuration_idx, len(configurations) - 1])]

def format(numbers, k=4):
    #numbers = format_joint_positions(numbers)
    return "[" + ", ".join([("%." + str(k) + "f") % n for n in numbers]) + "]"
# ---------- end py_5 ----------
start = Button()
stop_3 = Button()
step = Button()
counter = CountThroughList(L=py_5, start=start, stop=stop_3, step=step, step_back=back, reset=reset, interval=50)  # -> item; inputs L: list, start: Boolean, stop: Boolean, step_back: Boolean
# ---------- counter: Python ----------
from scriptcontext import sticky as st
from compas_ghpython import update_component


# store data in component
guid = str(ghenv.Component.InstanceGuid)
counter_key = "counter_" + guid
running_key = "running_" + guid

if counter_key not in st:
    st[counter_key] = 0

if running_key not in st:
    st[running_key] = False

if start:
    st[running_key] = True

if stop:
    st[running_key] = False

if step:
    if st[counter_key] < len(L) - 1:
        st[counter_key] += 1

if step_back:
    if st[counter_key] < len(L) - 1:
        st[counter_key] -= 1

if reset:
    st[counter_key] = 0

if len(L):
    item = L[st[counter_key]]

if st[running_key]:
    if st[counter_key] < len(L) - 1:
        st[counter_key] += 1
        update_component(ghenv, interval)
    else:
        st[counter_key] = 0
        st[running_key] = False
# ---------- end counter ----------

# ---- group: Define plane in WCS, calculate joint positions
pt_9 = Point(Point(-283.8412985, -342.877576, 297.4189147))
select_configuration = Slider(1, range=0..7)
xy_3 = XYPlane(Origin=pt_9)
plane_wcs = Plane(xy_3)
inverse = PythonScript(robot=robot_2, plane_WCS=plane_wcs, idx=select_configuration)  # -> configuration; inputs plane_WCS: Plane, idx: Int32
# ---------- inverse: Python ----------
import Rhino.Geometry as rg
from compas.geometry import Frame, Transformation
#from compas_ghpython import xdraw_frame

tcp_WCS = Frame(plane_WCS.Origin, plane_WCS.XAxis, plane_WCS.YAxis)

# transform frame to robot coordinate system
tcp_RCS = robot.get_frame_in_RCS(tcp_WCS)

# get the frame of tool0
tool0_RCS = robot.get_tool0_frame_from_tcp_frame(tcp_RCS)

# calculate solutions to frame
solutions = robot.inverse_kinematics(tool0_RCS)

if not len(solutions):
    q = [0,0,0,0,0,0]
else:
    idx = min(len(solutions) - 1, idx)
    q = solutions[idx]
    
print q

configuration = q
# ---------- end inverse ----------

# ---- group: Calculate joint positions for path / Shows joint positions along path
flip = BooleanToggle(True)
l2t = PythonScript(L=py_5, flip=flip)  # -> T; inputs L: list, flip: Boolean
# ---------- l2t: Python ----------
from compas_ghpython import list_to_ghtree
L = [l.joint_values for l in L]

if flip:
    L = zip(*L)
T = list_to_ghtree(L)
# ---------- end l2t ----------
graph_2 = QuickGraph(l2t, SortOrder=0)

# ---- group: Visualise
list_4 = ValueList({"0 forward, from angles": 0, "1 inverse, from one plane": 1, "2 inverse, from multiple planes": 2, "3 forward, from robot": 3}, selected="3 forward, from robot")
filter_2 = StreamFilter(Gate=list_4, Stream0=py_2, Stream1=inverse, Stream2=counter, Stream3=pose_joints)
configuration = Panel(filter_2)
mesh = Mesh(filter)
draw = PythonScript(robot=robot_2, configuration=filter_2, mesh=mesh, brep=filter, show_brep=show_brep)  # -> meshes, tool0_plane, tcp_plane, robot_brep; inputs mesh: list, brep: list
# ---------- draw: Python ----------
from compas_ghpython import unload_modules
unload_modules("ur_online_control")

#from compas_ghpython import xdraw_frame
from compas_ghpython import mesh_draw
from compas_ghpython.geometry.xforms import xform_from_transformation
from compas.geometry import Frame
from compas.geometry.xforms import Transformation
from mini_eggshell.ur_online_control.ur.robot import BaseConfiguration

import Rhino.Geometry as rg
import Rhino

def mesh_update_vertices(mesh, vertices):
    for i in range(len(vertices)):
        mesh.vertex[i].update({'x': vertices[i][0], 'y': vertices[i][1], 'z': vertices[i][2]})

if configuration:
    #print configuration
    #q = BaseConfiguration.from_joints(configuration)
    q = configuration
    print q
    print q.joint_values
    
    print robot.get_forward_transformations(q)
    R0, R1, R2, R3, R4, R5 = robot.get_forward_transformations(q)
    
    tool0_frame2 = robot.tool0_frame.transformed(R5)
    tcp_frame2 = Frame.from_transformation(Transformation.from_frame(tool0_frame2) * robot.transformation_tool0_tcp)
    
    print robot.transformation_tool0_tcp
    print robot.transformation_tcp_tool0
    print robot.transformation_tool0_tcp * robot.transformation_tcp_tool0
    print tcp_frame2
    tcp_frame2 = Frame.from_transformation(Transformation.from_frame(tool0_frame2) * robot.transformation_tcp_tool0)
    print tcp_frame2
    
    tool0_frame, tcp_frame = robot.get_transformed_tool_frames(R5)
    
    tool0_frame = tool0_frame2
    tcp_frame = tcp_frame2
    
    m0, m1, m2, m3, m4, m5 = mesh
    for i in range(6):
        exec("R%drg = xform_from_transformation(R%d)" % (i, i))
        exec("m%d.Transform(R%drg)" % (i, i))
    meshes = [m0, m1, m2, m3, m4, m5]
    print meshes
    mt = robot.tool.get_transformed_model(Transformation.from_frame(tool0_frame))
    
    if mt:
        meshes.extend(map(mesh_draw, mt))
    
    """
    m0, m1, m2, m3, m4, m5, tool0_frame, tcp_frame = robot.get_transformed_model(q)
    mt = robot.get_transformed_tool_model(tcp_frame)
    
    meshes = []
    meshes.append(mesh_draw(m0))
    meshes.append(mesh_draw(m1))
    meshes.append(mesh_draw(m2))
    meshes.append(mesh_draw(m3))
    meshes.append(mesh_draw(m4))
    meshes.append(mesh_draw(m5))
    if mt:
        meshes.append(mesh_draw(mt))
    
    """
    
#    tool0_plane = xdraw_frame(tool0_frame)
#    tcp_plane = xdraw_frame(tcp_frame)
    
    if show_brep:
        
        b0, b1, b2, b3, b4, b5 = brep
        
        b0.Transform(R0rg)
        b1.Transform(R1rg)
        b2.Transform(R2rg)
        b3.Transform(R3rg)
        b4.Transform(R4rg)
        b5.Transform(R5rg)
        
        robot_brep = [b0, b1, b2, b3, b4, b5]
# ---------- end draw ----------
tool0_plane = Plane(draw.tool0_plane)
tcp_plane = Plane(draw.tcp_plane)
robot_brep = Brep(draw.robot_brep)
draw_2 = RepresentPlaneAsLines(plane=tcp_plane, size=100)  # -> G, C
# ---------- draw_2: Python ----------
import Rhino.Geometry as rg
from System.Drawing import Color

if plane:

    G = []
    G.append(rg.Line(plane.Origin, size * plane.XAxis))
    G.append(rg.Line(plane.Origin, size * plane.YAxis))
    G.append(rg.Line(plane.Origin, size * plane.ZAxis))
    
    C = []
    C.append(Color.FromArgb(255, 0, 0))
    C.append(Color.FromArgb(0, 255, 0))
    C.append(Color.FromArgb(0, 0, 255))
# ---------- end draw_2 ----------
preview = CustomPreview(Geometry=draw_2.G, Shader=draw_2.C)
preview_2 = CustomPreview(Geometry=draw.meshes, Shader=ColourSwatch(SwatchColor=RGBA(99, 94, 94, 96)))

# ---- group: Send joint position directly to robot
panel_16 = Panel("move cartesian")
idx = Slider(0, range=0..100)
commands_2 = Data(python)
item_3 = ListItem(List=commands_2, Index=idx, Wrap=True)
list_5 = ValueList({"send all positions": 0, "send only one position": 1}, selected="send only one position")
filter_3 = StreamFilter(Gate=list_5, Stream0=commands_2, Stream1=item_3)
movel = PythonScript(commands=filter_3, velocity=Slider(100, range=0..100))  # -> script; inputs commands: list
# ---------- movel: Python ----------
from scriptcontext import sticky as st

script_lines = []
for cmd in commands:
    #q, a=1.4, v=1.05, t=0, r=0)
    x, y, z, ax, ay, az, speed, radius = cmd
    script_lines.append("movel(p%s, v=%f, r=%f)" % (str([x/1000., y/1000., z/1000, ax, ay, az]), speed/1000., radius/1000.))

robot = st["robot"]
tool_angle_axis = list(robot.tool.tcp_frame.point) + robot.tool.tcp_frame.axis_angle_vector
x, y, z, ax, ay, az = tool_angle_axis

script = "def prog():\n"
script += "\ttextmsg(\">> program start\")\n"
script += "\tset_tcp(p%s)\n" % str([x/1000., y/1000., z/1000, ax, ay, az])
script += "".join(["\t%s\n" % line for line in script_lines])
script += "\ttextmsg(\"<< program end\")\n"
script += "end\n"
script += "prog()\n\n"

print script
# ---------- end movel ----------
send_2 = Button()
send_3 = Send(script=movel, send=send_2)
panel_17 = Panel(send_3)

# ----
panel_18 = Panel("set digital out")
number = Slider(0, range=0..10)
value = BooleanToggle(False)
digital_out = PythonScript(number=number, value=value)  # -> script; inputs number: Int32, value: Boolean
# ---------- digital_out: Python ----------
script = "def prog():\n"
script += "\ttextmsg(\">> program start\")\n"
script += "\tset_digital_out(%i, %s)\n" % (int(number), str(value))
script += "\ttextmsg(\"<< program end\")\n"
script += "end\n"
script += "prog()\n\n"

print script
# ---------- end digital_out ----------
send_4 = Button()
send_5 = Send(script=digital_out, send=send_4)
panel_19 = Panel(send_5)

panel_20 = Panel("move vertical")
movel_2 = PythonScript()  # -> script
# ---------- movel_2: Python ----------
from scriptcontext import sticky as st

robot = st["robot"]

tool_angle_axis = list(robot.tool.tcp_frame.point) + robot.tool.tcp_frame.axis_angle_vector
x, y, z, ax, ay, az = tool_angle_axis

script = "def prog():\n"
script += "\ttextmsg(\">> program start\")\n"
script += "\tset_tcp(p%s)\n" % str([x/1000., y/1000., z/1000, ax, ay, az])
script += "\tcurrent_pose = get_forward_kin()\n"
script += "\tmovel(p[current_pose[0], current_pose[1], current_pose[2], 0, 0, 0], a=0.1, v=0.1)\n"
script += "\ttextmsg(\"<< program end\")\n"
script += "end\n"
script += "prog()\n\n"

print script
# ---------- end movel_2 ----------
send_6 = Button()
send_7 = Send(script=movel_2, send=send_6)
panel_21 = Panel(send_7)

# ----
# move incremental in WCS
number_slider_7 = Slider(5, range=-10..10)
list_6 = ValueList({"xaxis", "yaxis", "zaxis"}, selected="zaxis")
movel_3 = PythonScript(step_size=number_slider_7, direction=list_6)  # -> script
# ---------- movel_3: Python ----------
from scriptcontext import sticky as st

robot = st["robot"]
tool_angle_axis = list(robot.tool.tcp_frame.point) + robot.tool.tcp_frame.axis_angle_vector
x, y, z, ax, ay, az = tool_angle_axis

script = "def prog():\n"
script += "\ttextmsg(\">> program start\")\n"
script += "\tset_tcp(p%s)\n" % str([x/1000., y/1000., z/1000, ax, ay, az])
script += "\tcurrent_pose = get_forward_kin()\n"


if direction == "xaxis":
    script += "\tmovel(p[current_pose[0] + %f, current_pose[1], current_pose[2], current_pose[3], current_pose[4], current_pose[5]], t=%f)\n" % (step_size/1000., step_size * 0.1)

elif direction == "yaxis":
    script += "\tmovel(p[current_pose[0], current_pose[1] + %f, current_pose[2], current_pose[3], current_pose[4], current_pose[5]], t=%f)\n" % (step_size/1000., step_size * 0.1)

else: # direction == "zaxis":
    script += "\tmovel(p[current_pose[0], current_pose[1], current_pose[2] + %f, current_pose[3], current_pose[4], current_pose[5]], t=%f)\n" % (step_size/1000., step_size * 0.1)

script += "\ttextmsg(\"<< program end\")\n"
script += "end\n"
script += "prog()\n\n"

print script
# ---------- end movel_3 ----------
send_8 = Button()
send_9 = Send(script=movel_3, send=send_8)
panel_22 = Panel(send_9)

# ----
# move incremental in TCS
get_current_pose = Button()
list_7 = ValueList({"xaxis", "yaxis", "zaxis"}, selected="zaxis")
movel_4 = PythonScript(get=get_current_pose, step_size=Slider(5, range=-10..10), direction=list_7)  # -> script; inputs get: list
# ---------- movel_4: Python ----------
from scriptcontext import sticky as st
from compas.geometry import Frame
from compas.geometry import Point, Vector
from mini_eggshell.ur_online_control.ur_direct import get_current_pose_cartesian

server_address = st["server_address"]
server_port = 30005
ur_ip = st["ur_ip"]
robot = st["robot"]
tool_angle_axis = list(robot.tool.tcp_frame.point) + robot.tool.tcp_frame.axis_angle_vector
print tool_angle_axis

guid = str(ghenv.Component.InstanceGuid)
pose_cartesian_key = "pose_cartesian" + guid

if get:
    st[pose_cartesian_key] = get_current_pose_cartesian(server_address, server_port, ur_ip, tool_angle_axis)

if pose_cartesian_key not in st:
    pose_cartesian = []
    script = ""
else:
    pose_cartesian = st[pose_cartesian_key]

    robot = st["robot"]
    tool_angle_axis = list(robot.tool.tcp_frame.point) + robot.tool.tcp_frame.axis_angle_vector
    x, y, z, ax, ay, az = tool_angle_axis
    
    script = "def prog():\n"
    script += "\ttextmsg(\">> program start\")\n"
    script += "\tset_tcp(p%s)\n" % str([x/1000., y/1000., z/1000, ax, ay, az])
    script += "\tcurrent_pose = get_forward_kin()\n"
    
#    frame = Frame.from_pose_axis_angle_vector(pose_cartesian)
    frame = Frame.from_axis_angle_vector([ax, ay, az])
    frame.point = [x, y, z]

    if direction == "xaxis":
        next_vector = Vector(*frame.xaxis) * step_size
    elif direction == "yaxis":
        next_vector = Vector(*frame.yaxis) * step_size
    else: # direction == "zaxis":
        next_vector = Vector(*frame.zaxis) * step_size
    
    x, y, z = next_vector
    script += "\tmovel(p[current_pose[0] + %f, current_pose[1] + %f, current_pose[2] + %f, current_pose[3], current_pose[4], current_pose[5]], t=%f)\n" % (x/1000., y/1000., z/1000., step_size * 0.1)
    
    script += "\ttextmsg(\"<< program end\")\n"
    script += "end\n"
    script += "prog()\n\n"
    
    print script
# ---------- end movel_4 ----------
send_10 = Button()
send_11 = Send(script=movel_4, send=send_10)
panel_23 = Panel(send_11)

number_slider_8 = Slider(500, range=0..1000)
point_4 = Point(Point(0, 0, 0))
xy_plane_5 = XYPlane(Origin=point_4)
point_5 = Point([Point(242.9229005, 199.3242394, 54.4), Point(238.3474666, 206.1705417, 54.4), Point(245.5572473, 207.8289825, 54.4), Point(246.407571, 216.0194282, 54.4), Point(254.5297488, 214.6641872, 54.4), Point(255.3800725, 222.8546329, 54.4)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])
list_item = ListItem(List=point_5, Index=0, Wrap=True)
xy_plane_6 = XYPlane(Origin=list_item)
orient_2 = Orient(Geometry=point_5, Source=xy_plane_6, Target=xy_plane_5)  # -> Geometry, Transform
rectangle_2 = Rectangle(Plane=PlaneXY(0, 0, 0), XSize=number_slider_8, YSize=number_slider_8, Radius=0)  # -> Rectangle, Length
pt_10 = Point(flatten([Point(262.020703, 197.7826233, 0), Point(264.0531932, 207.7525391, 0), Point(274.1684953, 208.8529481, 0), Point(276.2009855, 218.8228639, 0), Point(286.1082774, 220.3929941, 0), Point(287.5494524, 230.4653946, 0)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]))
point_6 = Point([Point(250.9846863, 199.3141481, 0), Point(252.9480367, 206.3321125, 0), Point(258.8501323, 210.6066692, 0), Point(262.0227494, 216.9379955, 0), Point(268.7996277, 219.617639, 0), Point(272.4399155, 225.9307106, 0)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])
point_7 = Point(orient_2.Geometry)

# ----
# PING LAST DESIGN
point_8 = Point(flatten(Tree({0;0;0}: [Point(100, 0, 0), Point(80.90169944, 58.77852523, 0), Point(30.90169944, 95.10565163, 0), Point(-30.90169944, 95.10565163, 0), Point(-80.90169944, 58.77852523, 0), Point(-100, 0, 0), Point(-80.90169944, -58.77852523, 0), Point(-30.90169944, -95.10565163, 0), Point(30.90169944, -95.10565163, 0), Point(80.90169944, -58.77852523, 0)], {0;0;1}: [Point(99.64051434, 0, 1.2), Point(80.61086943, 58.56722486, 1.2), Point(30.79061226, 94.76376045, 1.2), Point(-30.79061226, 94.76376045, 1.2), Point(-80.61086943, 58.56722486, 1.2), Point(-99.64051434, 0, 1.2), Point(-80.61086943, -58.56722486, 1.2), Point(-30.79061226, -94.76376045, 1.2), Point(30.79061226, -94.76376045, 1.2), Point(80.61086943, -58.56722486, 1.2)], {0;0;2}: [Point(99.28455763, 0, 2.4), Point(80.32289441, 58.35799876, 2.4), Point(30.68061559, 94.42522551, 2.4), Point(-30.68061559, 94.42522551, 2.4), Point(-80.32289441, 58.35799876, 2.4), Point(-99.28455763, 0, 2.4), Point(-80.32289441, -58.35799876, 2.4), Point(-30.68061559, -94.42522551, 2.4), Point(30.68061559, -94.42522551, 2.4), Point(80.32289441, -58.35799876, 2.4)], {0;0;3}: [Point(98.92919407, 0, 3.6), Point(80.03539924, 58.1491213, 3.6), Point(30.57080221, 94.08725467, 3.6), Point(-30.57080221, 94.08725467, 3.6), Point(-80.03539924, 58.1491213, 3.6), Point(-98.92919407, 0, 3.6), Point(-80.03539924, -58.1491213, 3.6), Point(-30.57080221, -94.08725467, 3.6), Point(30.57080221, -94.08725467, 3.6), Point(80.03539924, -58.1491213, 3.6)], {0;0;4}: [Point(98.57414258, 0, 4.8), Point(79.74815655, 57.94042726, 4.8), Point(30.46108526, 93.74958064, 4.8), Point(-30.46108526, 93.74958064, 4.8), Point(-79.74815655, 57.94042726, 4.8), Point(-98.57414258, 0, 4.8), Point(-79.74815655, -57.94042726, 4.8), Point(-30.46108526, -93.74958064, 4.8), Point(30.46108526, -93.74958064, 4.8), Point(79.74815655, -57.94042726, 4.8)], {0;0;5}: [Point(98.21929374, 0, 6), Point(79.46107781, 57.73185235, 6), Point(30.35143094, 93.41209934, 6), Point(-30.35143094, 93.41209934, 6), Point(-79.46107781, 57.73185235, 6), Point(-98.21929374, 0, 6), Point(-79.46107781, -57.73185235, 6), Point(-30.35143094, -93.41209934, 6), Point(30.35143094, -93.41209934, 6), Point(79.46107781, -57.73185235, 6)]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)))
md_slider_3 = MDSlider(
    SliderMode=0,
    slider_value=Point(0.5286641318, 0.8736728575, 0.5),
    x_domain=Domain(-250, 500),
    y_domain=Domain(-250, 500),
    z_domain=Domain(0, 1))
deconstruct_2 = Deconstruct(Point=md_slider_3)  # -> XComponent, YComponent, ZComponent
# Master Control
Z_3 = Slider(-18.7, range=-50..50)
vector_xyz = VectorXYZ(XComponent=deconstruct_2.XComponent, YComponent=deconstruct_2.YComponent, ZComponent=Z_3)  # -> Vector, Length
move_2 = Move(Motion=vector_xyz.Vector)  # -> Geometry, Transform

bounding_box = BoundingBox(Content=point_7, Plane=PlaneXY(0, 0, 0), UnionBox=True)  # -> Box, Box_2
deconstruct_box = DeconstructBox(Box=bounding_box.Box)  # -> Plane, X, Y, Z
panel_24 = Panel(deconstruct_box.X)
# OBJECT POSITION
# Object Visualization
# Point to bake
# Path Visualization
# Doubleclick Me!
panel_25 = Panel(deconstruct_box.Y)

# ----
# Sequence 4 Height
multiplication_3 = Multiplication(A=layer_height, B=layer_count)

# ----
# Sequence 1 Height
multiplication_4 = Multiplication(A=layer_height_4, B=layer_count_4)

addition = Addition(A=multiplication_4, B=Z_2)

height = Panel(addition)

# ----
# Actual Height
negative = Negative(Value=height)
height_2 = Panel(negative)

# ----
# Sequence 3 Height
multiplication_5 = Multiplication(A=layer_height_2, B=layer_count_2)

# ----
# Sequence 2 Height
multiplication_6 = Multiplication(A=layer_height_3, B=layer_count_3)

addition_2 = Addition(A=multiplication_6, B=height)

height_3 = Panel(addition_2)

addition_3 = Addition(A=multiplication_5, B=height_3)

height_4 = Panel(addition_3)

# ----
# Actual Height
addition_4 = Addition(A=height_3, B=negative)
height_5 = Panel(addition_4)

# ----
# Actual Height
addition_5 = Addition(A=height_4, B=addition_4)
height_6 = Panel(addition_5)

addition_6 = Addition(A=multiplication_3, B=addition_5)

height_7 = Panel(addition_6)

# ----
# Actual Height
addition_7 = Addition(A=height_7, B=addition_5)
height_8 = Panel(addition_7)

# ----
# Outer Shell
# SEQUENCE 1
# Void created by Clay
construct_point = ConstructPoint(XCoordinate=deconstruct.XComponent, YCoordinate=deconstruct.YComponent, ZCoordinate=Z_2)
construct_point_2 = ConstructPoint(XCoordinate=deconstruct.XComponent, YCoordinate=deconstruct.YComponent, ZCoordinate=Z_2)
construct_point_3 = ConstructPoint(XCoordinate=deconstruct.XComponent, YCoordinate=deconstruct.YComponent, ZCoordinate=Z_2)
circle = Circle(Plane=construct_point_2, Radius=circle_2_rad)
circle_2 = Circle(Plane=construct_point_3, Radius=circle_3_rad)
circle_3 = Circle(Plane=construct_point, Radius=circle_1_rad)
unit_z = UnitZ(Factor=Slider(0, range=0..100))
unit_z_2 = UnitZ(Factor=Slider(0, range=0..100))
unit_z_3 = UnitZ(Factor=Slider(0, range=0..100))
move_3 = Move(Geometry=circle_2, Motion=unit_z_3)  # -> Geometry, Transform
move_4 = Move(Geometry=circle, Motion=unit_z_2)  # -> Geometry, Transform
move_5 = Move(Geometry=circle_3, Motion=unit_z)  # -> Geometry, Transform
divide_curve = DivideCurve(Curve=move_5.Geometry, Count=division_point, Kinks=False)  # -> Points, Tangents, Parameters
divide_curve_2 = DivideCurve(Curve=move_4.Geometry, Count=division_point, Kinks=False)  # -> Points, Tangents, Parameters
divide_curve_3 = DivideCurve(Curve=move_3.Geometry, Count=division_point, Kinks=False)  # -> Points, Tangents, Parameters
reverse_list = ReverseList(List=divide_curve_2.Points)
reverse_list_2 = ReverseList(List=divide_curve_3.Points)
cull_pattern = CullPattern(List=reverse_list, CullPattern=[True, False, False, True])
cull_pattern_2 = CullPattern(List=reverse_list_2, CullPattern=[True, False, False, True])
weave = Weave(Pattern=[0, 1, 1, 0], Stream0=cull_pattern, Stream1=cull_pattern_2, NullGaps=False)
polyline_layer = PolyLine(Vertices=divide_curve.Points, Closed=True)
cull_index = CullIndex(List=weave, Indices=[0, -1], Wrap=True)
merge = Merge(Data1=divide_curve.Points, Data2=cull_index)
flatten_tree = FlattenTree(Tree=merge, Path="{0}")
series_2 = Series(Start=0, Step=layer_height_4, Count=layer_count_4)
unit_z_4 = UnitZ(Factor=series_2)
move_6 = Move(Geometry=polyline_layer, Motion=unit_z_4)  # -> Geometry, Transform
series_3 = Series(Start=0, Step=rotation_layer_4, Count=layer_count_4)
area_2 = Area(Geometry=move_6.Geometry)  # -> Area, Centroid
rotate_6 = Rotate(Geometry=move_6.Geometry, Angle=degrees(series_3), Plane=area_2.Centroid)  # -> Geometry, Transform
deconstruct_brep = DeconstructBrep(Brep=rotate_6.Geometry)  # -> Faces, Edges, Vertices

flatten_tree_2 = FlattenTree(Tree=rotate_6.Geometry, Path="{0}")
loft = Loft(Curves=flatten_tree_2, Options={Adjust=False, Closed=False, LoftEnds=0, LoftSimp=0, LoftType=0, Rebuild=10, Refit=0.01})

# ----
# Outer Shell
# SEQUENCE 2
# Void created by Clay
construct_point_4 = ConstructPoint(XCoordinate=deconstruct.XComponent, YCoordinate=deconstruct.YComponent, ZCoordinate=height)
construct_point_5 = ConstructPoint(XCoordinate=deconstruct.XComponent, YCoordinate=deconstruct.YComponent, ZCoordinate=height)
construct_point_6 = ConstructPoint(XCoordinate=deconstruct.XComponent, YCoordinate=deconstruct.YComponent, ZCoordinate=height)
circle_4 = Circle(Plane=construct_point_5, Radius=circle_2_rad)
circle_5 = Circle(Plane=construct_point_6, Radius=circle_3_rad)
circle_6 = Circle(Plane=construct_point_4, Radius=circle_1_rad)
unit_z_5 = UnitZ(Factor=Slider(0, range=0..100))
unit_z_6 = UnitZ(Factor=Slider(0, range=0..100))
unit_z_7 = UnitZ(Factor=Slider(0, range=0..100))
move_7 = Move(Geometry=circle_5, Motion=unit_z_7)  # -> Geometry, Transform
move_8 = Move(Geometry=circle_4, Motion=unit_z_6)  # -> Geometry, Transform
move_9 = Move(Geometry=circle_6, Motion=unit_z_5)  # -> Geometry, Transform
divide_curve_4 = DivideCurve(Curve=move_9.Geometry, Count=division_point, Kinks=False)  # -> Points, Tangents, Parameters
divide_curve_5 = DivideCurve(Curve=move_8.Geometry, Count=division_point, Kinks=False)  # -> Points, Tangents, Parameters
divide_curve_6 = DivideCurve(Curve=move_7.Geometry, Count=division_point, Kinks=False)  # -> Points, Tangents, Parameters
reverse_list_3 = ReverseList(List=divide_curve_5.Points)
reverse_list_4 = ReverseList(List=divide_curve_6.Points)
cull_pattern_3 = CullPattern(List=reverse_list_3, CullPattern=[True, False, False, True])
cull_pattern_4 = CullPattern(List=reverse_list_4, CullPattern=[True, False, False, True])
multiplication_7 = Multiplication(A=layer_count_4, B=rotation_layer_4)
weave_2 = Weave(Pattern=[0, 1, 1, 0], Stream0=cull_pattern_3, Stream1=cull_pattern_4, NullGaps=False)
cull_index_2 = CullIndex(List=weave_2, Indices=[0, -1], Wrap=True)
merge_2 = Merge(Data1=divide_curve_4.Points, Data2=cull_index_2)
flatten_tree_3 = FlattenTree(Tree=merge_2, Path="{0}")
polyline_layer_2 = PolyLine(Vertices=flatten_tree_3, Closed=True)
series_4 = Series(Start=0, Step=layer_height_3, Count=layer_count_3)
unit_z_8 = UnitZ(Factor=series_4)
series_5 = Series(Start=0, Step=rotation_layer_3, Count=layer_count_3)

area_3 = Area(Geometry=polyline_layer_2)  # -> Area, Centroid

# ----
# SEQUENCE 4
construct_point_7 = ConstructPoint(XCoordinate=deconstruct.XComponent, YCoordinate=deconstruct.YComponent, ZCoordinate=height_4)
construct_point_8 = ConstructPoint(XCoordinate=deconstruct.XComponent, YCoordinate=deconstruct.YComponent, ZCoordinate=height_4)
construct_point_9 = ConstructPoint(XCoordinate=deconstruct.XComponent, YCoordinate=deconstruct.YComponent, ZCoordinate=height_4)
circle_7 = Circle(Plane=construct_point_8, Radius=circle_2_rad)
circle_8 = Circle(Plane=construct_point_9, Radius=circle_3_rad)
circle_9 = Circle(Plane=construct_point_7, Radius=circle_1_rad)
unit_z_9 = UnitZ(Factor=Slider(0, range=0..100))
unit_z_10 = UnitZ(Factor=Slider(0, range=0..100))
unit_z_11 = UnitZ(Factor=Slider(0, range=0..100))
move_10 = Move(Geometry=circle_8, Motion=unit_z_11)  # -> Geometry, Transform
move_11 = Move(Geometry=circle_7, Motion=unit_z_10)  # -> Geometry, Transform
move_12 = Move(Geometry=circle_9, Motion=unit_z_9)  # -> Geometry, Transform
divide_curve_7 = DivideCurve(Curve=move_12.Geometry, Count=division_point, Kinks=False)  # -> Points, Tangents, Parameters
divide_curve_8 = DivideCurve(Curve=move_11.Geometry, Count=division_point, Kinks=False)  # -> Points, Tangents, Parameters
divide_curve_9 = DivideCurve(Curve=move_10.Geometry, Count=division_point, Kinks=False)  # -> Points, Tangents, Parameters
reverse_list_5 = ReverseList(List=divide_curve_8.Points)
reverse_list_6 = ReverseList(List=divide_curve_9.Points)
cull_pattern_5 = CullPattern(List=reverse_list_5, CullPattern=[True, False, False, True])
cull_pattern_6 = CullPattern(List=reverse_list_6, CullPattern=[True, False, False, True])
multiplication_8 = Multiplication(A=layer_count_2, B=rotation_layer_2)
weave_3 = Weave(Pattern=[0, 1, 1, 0], Stream0=cull_pattern_5, Stream1=cull_pattern_6, NullGaps=False)
polyline_layer_3 = PolyLine(Vertices=divide_curve_7.Points, Closed=True)
area_4 = Area(Geometry=polyline_layer_3)  # -> Area, Centroid
cull_index_3 = CullIndex(List=weave_3, Indices=[0, -1], Wrap=True)
merge_3 = Merge(Data1=divide_curve_7.Points, Data2=cull_index_3)
flatten_tree_4 = FlattenTree(Tree=merge_3, Path="{0}")
series_6 = Series(Start=0, Step=layer_height, Count=layer_count)
unit_z_12 = UnitZ(Factor=series_6)
series_7 = Series(Start=0, Step=rotation_layer, Count=layer_count)

# ----
# SEQUENCE 3
construct_point_10 = ConstructPoint(XCoordinate=deconstruct.XComponent, YCoordinate=deconstruct.YComponent, ZCoordinate=height_3)
construct_point_11 = ConstructPoint(XCoordinate=deconstruct.XComponent, YCoordinate=deconstruct.YComponent, ZCoordinate=height_3)
construct_point_12 = ConstructPoint(XCoordinate=deconstruct.XComponent, YCoordinate=deconstruct.YComponent, ZCoordinate=height_3)
circle_10 = Circle(Plane=construct_point_11, Radius=circle_2_rad)
circle_11 = Circle(Plane=construct_point_12, Radius=circle_3_rad)
circle_12 = Circle(Plane=construct_point_10, Radius=circle_1_rad)
unit_z_13 = UnitZ(Factor=Slider(0, range=0..100))
unit_z_14 = UnitZ(Factor=Slider(0, range=0..100))
unit_z_15 = UnitZ(Factor=Slider(0, range=0..100))
move_13 = Move(Geometry=circle_11, Motion=unit_z_15)  # -> Geometry, Transform
move_14 = Move(Geometry=circle_10, Motion=unit_z_14)  # -> Geometry, Transform
move_15 = Move(Geometry=circle_12, Motion=unit_z_13)  # -> Geometry, Transform
divide_curve_10 = DivideCurve(Curve=move_15.Geometry, Count=division_point, Kinks=False)  # -> Points, Tangents, Parameters
divide_curve_11 = DivideCurve(Curve=move_14.Geometry, Count=division_point, Kinks=False)  # -> Points, Tangents, Parameters
divide_curve_12 = DivideCurve(Curve=move_13.Geometry, Count=division_point, Kinks=False)  # -> Points, Tangents, Parameters
reverse_list_7 = ReverseList(List=divide_curve_11.Points)
reverse_list_8 = ReverseList(List=divide_curve_12.Points)
cull_pattern_7 = CullPattern(List=reverse_list_7, CullPattern=[True, False, False, True])
cull_pattern_8 = CullPattern(List=reverse_list_8, CullPattern=[True, False, False, True])
multiplication_9 = Multiplication(A=layer_count_3, B=rotation_layer_3)
weave_4 = Weave(Pattern=[0, 1, 1, 0], Stream0=cull_pattern_7, Stream1=cull_pattern_8, NullGaps=False)
addition_8 = Addition(A=multiplication_9, B=multiplication_7)
cull_index_4 = CullIndex(List=weave_4, Indices=[0, -1], Wrap=True)
merge_4 = Merge(Data1=divide_curve_10.Points, Data2=cull_index_4)
flatten_tree_5 = FlattenTree(Tree=merge_4, Path="{0}")
polyline_layer_4 = PolyLine(Vertices=flatten_tree_5, Closed=True)
series_8 = Series(Start=0, Step=layer_height_2, Count=layer_count_2)
unit_z_16 = UnitZ(Factor=series_8)
series_9 = Series(Start=0, Step=rotation_layer_2, Count=layer_count_2)

area_5 = Area(Geometry=polyline_layer_4)  # -> Area, Centroid

addition_9 = Addition(A=multiplication_8, B=addition_8)
rotate_7 = Rotate(Geometry=polyline_layer_3, Angle=degrees(addition_9), Plane=area_4.Centroid)  # -> Geometry, Transform
move_16 = Move(Geometry=rotate_7.Geometry, Motion=unit_z_12)  # -> Geometry, Transform
rotate_8 = Rotate(Geometry=move_16.Geometry, Angle=degrees(series_7), Plane=area_4.Centroid)  # -> Geometry, Transform
deconstruct_brep_2 = DeconstructBrep(Brep=rotate_8.Geometry)  # -> Faces, Edges, Vertices

flatten_tree_6 = FlattenTree(Tree=rotate_8.Geometry, Path="{0}")
loft_2 = Loft(Curves=flatten_tree_6, Options={Adjust=False, Closed=False, LoftEnds=0, LoftSimp=0, LoftType=0, Rebuild=10, Refit=0.01})

rotate_9 = Rotate(Geometry=polyline_layer_2, Angle=degrees(multiplication_7), Plane=area_3.Centroid)  # -> Geometry, Transform
move_17 = Move(Geometry=rotate_9.Geometry, Motion=unit_z_8)  # -> Geometry, Transform
rotate_10 = Rotate(Geometry=move_17.Geometry, Angle=degrees(series_5), Plane=area_3.Centroid)  # -> Geometry, Transform
deconstruct_brep_3 = DeconstructBrep(Brep=rotate_10.Geometry)  # -> Faces, Edges, Vertices

flatten_tree_7 = FlattenTree(Tree=rotate_10.Geometry, Path="{0}")
loft_3 = Loft(Curves=flatten_tree_7, Options={Adjust=False, Closed=False, LoftEnds=0, LoftSimp=0, LoftType=0, Rebuild=10, Refit=0.01})

rotate_11 = Rotate(Geometry=polyline_layer_4, Angle=degrees(addition_8), Plane=area_5.Centroid)  # -> Geometry, Transform
move_18 = Move(Geometry=rotate_11.Geometry, Motion=unit_z_16)  # -> Geometry, Transform
rotate_12 = Rotate(Geometry=move_18.Geometry, Angle=degrees(series_9), Plane=area_5.Centroid)  # -> Geometry, Transform
deconstruct_brep_4 = DeconstructBrep(Brep=rotate_12.Geometry)  # -> Faces, Edges, Vertices

flatten_tree_8 = FlattenTree(Tree=rotate_12.Geometry, Path="{0}")
loft_4 = Loft(Curves=flatten_tree_8, Options={Adjust=False, Closed=False, LoftEnds=0, LoftSimp=0, LoftType=0, Rebuild=10, Refit=0.01})

# ----
# SEQUENCE CONTROLLER
value_list = ValueList({"Sequence 1": 0, "Sequence 2": 1, "Sequence 3": 2, "Sequence 4": 3}, selected="Sequence 3")

flatten_tree_9 = FlattenTree(Tree=deconstruct_brep.Vertices, Path="{0}")
list_length = ListLength(List=flatten_tree_9)  # -> expr("x-1", Length)
addition_10 = Addition(A=list_length)

last_point = Panel(list_length)

construct_domain = ConstructDomain(DomainStart=0, DomainEnd=last_point)
sub_list = SubList(List=flatten_tree_9, Domain=construct_domain, Wrap=True)  # -> List, Index
polyline_to_visual_print = PolyLine(Vertices=sub_list.List, Closed=False)
pipe_2 = Pipe(Curve=polyline_to_visual_print, Radius=Slider(1, range=0..10), Caps=0)  # disabled

# ----
# Last Point
flatten_tree_10 = FlattenTree(Tree=sub_list.List, Path="{0}")
last_point_2 = Panel("-1")
list_item_2 = ListItem(List=flatten_tree_10, Index=last_point_2, Wrap=True)

flatten_tree_11 = FlattenTree(Tree=deconstruct_brep_3.Vertices, Path="{0}")
list_length_2 = ListLength(List=flatten_tree_11)  # -> expr("x-1", Length)

flatten_tree_12 = FlattenTree(Tree=deconstruct_brep_2.Vertices, Path="{0}")
list_length_3 = ListLength(List=flatten_tree_12)  # -> expr("x-1", Length)

flatten_tree_13 = FlattenTree(Tree=deconstruct_brep_4.Vertices, Path="{0}")
list_length_4 = ListLength(List=flatten_tree_13)  # -> expr("x-1", Length)

last_point_3 = Panel(list_length_2)

last_point_4 = Panel(list_length_3)

last_point_5 = Panel(list_length_4)

construct_domain_2 = ConstructDomain(DomainStart=0, DomainEnd=last_point_3)
sub_list_2 = SubList(List=flatten_tree_11, Domain=construct_domain_2, Wrap=True)  # -> List, Index

# ----
# Last Point
flatten_tree_14 = FlattenTree(Tree=sub_list_2.List, Path="{0}")
last_point_6 = Panel("-1")
list_item_3 = ListItem(List=flatten_tree_14, Index=last_point_6, Wrap=True)

flatten_tree_15 = FlattenTree(Tree=sub_list_2.List, Path="{0}")
merge_5 = Merge(Data1=list_item_2, Data2=flatten_tree_15)

polyline_to_visual_print_2 = PolyLine(Vertices=merge_5, Closed=False)
pipe_3 = Pipe(Curve=polyline_to_visual_print_2, Radius=Slider(1, range=0..10), Caps=0)  # disabled

construct_domain_3 = ConstructDomain(DomainStart=0, DomainEnd=last_point_4)
sub_list_3 = SubList(List=flatten_tree_12, Domain=construct_domain_3, Wrap=True)  # -> List, Index

construct_domain_4 = ConstructDomain(DomainStart=0, DomainEnd=last_point_5)
sub_list_4 = SubList(List=flatten_tree_13, Domain=construct_domain_4, Wrap=True)  # -> List, Index

stream_filter = StreamFilter(Gate=value_list, Stream0=sub_list.List, Stream1=sub_list_2.List, Stream2=sub_list_4.List, Stream3=sub_list_3.List)

# ----
# Last Point
flatten_tree_16 = FlattenTree(Tree=sub_list_4.List, Path="{0}")
last_point_7 = Panel("-1")
list_item_4 = ListItem(List=flatten_tree_16, Index=last_point_7, Wrap=True)

flatten_tree_17 = FlattenTree(Tree=sub_list_3.List, Path="{0}")
merge_6 = Merge(Data1=list_item_4, Data2=flatten_tree_17)

polyline_to_visual_print_3 = PolyLine(Vertices=merge_6, Closed=False)
pipe_4 = Pipe(Curve=polyline_to_visual_print_3, Radius=Slider(3, range=0..10), Caps=0)  # disabled

flatten_tree_18 = FlattenTree(Tree=sub_list_4.List, Path="{0}")
merge_7 = Merge(Data1=list_item_3, Data2=flatten_tree_18)

polyline_to_visual_print_4 = PolyLine(Vertices=merge_7, Closed=False)
pipe_5 = Pipe(Curve=polyline_to_visual_print_4, Radius=Slider(3, range=0..10), Caps=0)  # disabled

polyline_to_visual_print_5 = PolyLine(Vertices=stream_filter, Closed=False)

# ---- group: Send joint position directly to robot
idx_2 = Slider(0, range=0..100)
panel_26 = Panel("move joints")
joint_positions = Data(py_5)
list_8 = ValueList({"send all positions": 0, "send only one position": 1}, selected="send only one position")
item_4 = ListItem(List=joint_positions, Index=idx_2, Wrap=True)
filter_4 = StreamFilter(Gate=list_8, Stream0=joint_positions, Stream1=item_4)
movej = PythonScript(joint_positions=filter_4, velocity=Slider(153, range=0..200))  # -> script; inputs joint_positions: list
# ---------- movej: Python ----------
script_lines = []

for position in joint_positions:
    script_lines.append("movej(%s, v=%f)" % (str(position), velocity/1000.))


script = "def prog():\n"
script += "\ttextmsg(\">> program start\")\n"
script += "".join(["\t%s\n" % line for line in script_lines])
script += "\ttextmsg(\"<< program end\")\n"
script += "end\n"
script += "prog()\n\n"


print script

#script = ""
# ---------- end movej ----------
send_12 = Button()

# ----
send_13 = Send(script=movej, send=send_12)

# ---- group: Send joint position directly to robot (continued)
panel_27 = Panel(send_13)

# ==== cluster Tools

# ---- group: clay_extruder
brep = Brep([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])
yaxis_line = Curve(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)
xaxis_line = Curve(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)
test_geometry = Geometry(brep)
brep_2 = Brep(test_geometry)
mesh = Mesh(test_geometry)
tool = Tool(meshes=mesh, breps=brep_2, xline=xaxis_line, yline=yaxis_line)

# ---- group: plastic_extruder
brep_3 = Brep([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])
xaxis_line_2 = Curve(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)
yaxis_line_2 = Curve(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)
test_geometry_2 = Geometry(brep_3)
mesh_2 = Mesh(test_geometry_2)
brep_4 = Brep(test_geometry_2)
tool_2 = Tool(meshes=mesh_2, breps=brep_4, xline=xaxis_line_2, yline=yaxis_line_2)

# ---- group: clay_extruder_SS
brep_5 = Brep([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])
yaxis_line_3 = Curve(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)
xaxis_line_3 = Curve(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)
test_geometry_3 = Geometry(brep_5)
brep_6 = Brep(test_geometry_3)
mesh_3 = Mesh(test_geometry_3)
tool_3 = Tool(meshes=mesh_3, breps=brep_6, xline=xaxis_line_3, yline=yaxis_line_3)

# ----
tool_id = ClusterInput()
tool_id_2 = Integer(tool_id)
filter = StreamFilter(Gate=tool_id_2, Stream1=tool_2, Stream2=tool, Stream3=tool_3)
py = PythonScript(tool=filter)  # -> tcp_frame, model
# ---------- py: Python ----------
from compas_ghpython import mesh_draw 

tcp_frame = tool.tcp_frame
model = map(mesh_draw, tool.model)
# ---------- end py ----------
tool_4 = Data(filter)
draw = PythonScript(frame=py.tcp_frame)  # -> G, C
# ---------- draw: Python ----------
import Rhino.Geometry as rg
from System.Drawing import Color

if not size:
    size = 100

if frame:
    plane = rg.Plane(rg.Point3d(*list(frame.point)), rg.Vector3d(*list(frame.xaxis)), rg.Vector3d(*list(frame.yaxis)))

    G = []
    G.append(rg.Line(plane.Origin, size * plane.XAxis))
    G.append(rg.Line(plane.Origin, size * plane.YAxis))
    G.append(rg.Line(plane.Origin, size * plane.ZAxis))
    
    C = []
    C.append(Color.FromArgb(255, 0, 0))
    C.append(Color.FromArgb(0, 255, 0))
    C.append(Color.FromArgb(0, 0, 255))
# ---------- end draw ----------
tool_5 = ClusterOutput(tool_4)
preview = CustomPreview(Geometry=draw.G, Shader=draw.C)
preview_2 = CustomPreview(Geometry=py.model, Shader=ColourSwatch(SwatchColor=RGB(141, 170, 178)))

# ==== cluster Send
script = ClusterInput()
send = ClusterInput()
send_2 = PythonScript(script=script, send=send)  # -> out
# ---------- send_2: Python ----------
import socket
from scriptcontext import sticky as st

ur_ip = st["ur_ip"]
ur_port = 30002

if send:
    s = socket.create_connection((ur_ip, ur_port), timeout=0.5) 
    s.send(script)
    s.close()
# ---------- end send_2 ----------
out = ClusterOutput(send_2)

# ==== cluster Tool
breps = ClusterInput()
meshes = ClusterInput()
meshes_2 = Mesh(meshes)
mjoin = MeshJoin(Meshes=meshes_2)
xline = ClusterInput()
yline = ClusterInput()
tool = PythonScript(meshes=mjoin, breps=breps, xline=xline, yline=yline)  # -> tool; inputs meshes: list of Mesh, breps: list of Brep
# ---------- tool: Python ----------
import Rhino.Geometry as rg
from compas.geometry import Frame
from ur_online_control.ur.tool import Tool
from compas.datastructures import Mesh
from compas_rhino.helpers import mesh_from_guid

xaxis = rg.Line(xline.PointAtStart, xline.PointAtEnd)
yaxis = rg.Line(yline.PointAtStart, yline.PointAtEnd)

if xaxis.From.DistanceTo(yaxis.From) < 0.01:
    origin = xaxis.From
    xaxis = xaxis.Direction
    yaxis = yaxis.Direction
elif xaxis.To.DistanceTo(yaxis.To) < 0.01:
    origin = xaxis.To
    xaxis = -xaxis.Direction
    yaxis = -yaxis.Direction
elif xaxis.From.DistanceTo(yaxis.To) < 0.01:
    origin = xaxis.From
    xaxis = xaxis.Direction
    yaxis = -yaxis.Direction
elif xaxis.To.DistanceTo(yaxis.From) < 0.01:
    origin = xaxis.To
    xaxis = -xaxis.Direction
    yaxis = yaxis.Direction

xaxis.Unitize()
yaxis.Unitize()

print origin
print xaxis
print yaxis

tcp_frame = Frame(origin, xaxis, yaxis)

tool = Tool(tcp_frame)
tool.model = [mesh_from_guid(Mesh, mesh) for mesh in meshes]
#tool.model_xyz = tool.model.xyz
tool.breps = breps
# ---------- end tool ----------
tool_2 = ClusterOutput(tool)
