# Grasshopper definition 191105_export_import_json_groupe_02.gh (Grasshopper 1.0.7)

# ---- group: EXPORT_JSON
pt = Point()
# GH Definition to export points as json
# 
# 
# - To optimize your control UR5 defintion, insert the "EXPORT_JSON" part in your design definition.
# 
# - Make sure that your points are within a flatten list in the right order regarding your printing path
# 
# - Change "path" name and "name_json"
# 
# - Press "save_json"
panel = Panel("C:\Users\Remy Clemente\Documents\GitHub\eth_projects\mini_eggshell\ur_online_control")
python = GhPythonScript(path=panel, planes=pt, save_json=Button(), name_json="design_test_00_groupe_02.json")  # -> out, a; inputs planes: list
# ---------- python: Python ----------
__author__ = "Remy Clemente"
__version__ = "2019.11.05"

import rhinoscriptsyntax as rs

import json
import os


pts= []
for i in range(len(planes)):
    pt = rs.coerce3dpoint(planes[i])
    pts.append(list(pt))

data = {}
data['points'] = pts

filename = os.path.join(path, name_json)
if save_json:
    with open(filename, 'w') as f:
        json.dump(data, f)
# ---------- end python ----------
panel_2 = Panel(python.a)

# ---- group: IMPORT_JSON
py = PythonScript()  # -> path
# ---------- py: Python ----------
import sys
import os

ghComp = ghenv.Component
ghDoc = ghComp.OnPingDocument()

# the full path of the gh file
path = ghDoc.FilePath
# the directory of the gh file
path = os.path.dirname(path)

path = os.path.abspath(os.path.join(path, ".."))

print path
# ---------- end py ----------
# GH Definition to import points as json
# 
# 
# - To optimize your control UR5 defintion insert the "IMPORT_JSON" in your definition.
# 
# - Make sure that your "path" name and "name_json" are the same than your previous json file.
# 
# - Press "import_json"
panel_3 = Panel(py)
import_json = Button()
send = PythonScript(path=panel_3, import_json=import_json, name_json="design_test_00_groupe_02.json")  # -> new_pts
# ---------- send: Python ----------
import json
import os

import rhinoscriptsyntax as rs
import Rhino.Geometry as rg

filename = os.path.join(path, name_json)
if import_json:
    with open(filename, 'r') as f:
        data = json.load(f)
    # load the commands from the json dictionary
pts = data['points']

new_pts = []

for i in range(len(pts)):
    new_x = round(pts[i][0],3)
    new_y = round(pts[i][1],3)
    new_z = round(pts[i][2],3)
    new_point = rg.Point3d(new_x,new_y,new_z)
    print (new_point)
    new_pts.append(new_point)
# ---------- end send ----------
pt_2 = Point(send)

# ---- group: IMPORT_JSON / Fabrication planes
pln = Plane(flatten(pt_2))
