# Grasshopper definition 191108_ur_online_control_gh_group_05.gh (Grasshopper 1.0.7)
# plug-ins: treesloth01

# layer height = 4
# for the mid size nozzle
panel = Panel("-181 bottom extruder")
panel_2 = Panel("-172")
number_slider = Slider(4, range=0..100)
number_slider_2 = Slider(2, range=0..100)
pt = ConstructPoint(XCoordinate=Slider(80, range=-100..100), YCoordinate=Slider(-170, range=-500..100), ZCoordinate="200")
series = Series(Start=0, Step=number_slider_2, Count=number_slider)
integer_division = IntegerDivision(A=number_slider_2, B=2)

# ---- group: Robot
# 0a
# Settings
# Check your IP address and set UR IP address
server_address = ValueList({"192.168.10.2", "192.168.10.11", "127.0.0.1"}, selected="192.168.10.11")
ur_ip = ValueList({"192.168.10.13", "192.168.10.11", "192.168.10.10", "127.0.0.1"}, selected="192.168.10.10")
server_port = Integer(30003)
globals = PythonScript(server_address=server_address, server_port=server_port, ur_ip=ur_ip)  # inputs server_port: Int32
# ---------- globals: Python ----------
from scriptcontext import sticky as st

st["server_address"] = server_address
st["server_port"] = server_port

st["ur_ip"] = ur_ip
# ---------- end globals ----------

# Check if UR is available
ping = Button()
py = PythonScript(ip=ur_ip, ping=ping)  # -> out
# ---------- py: Python ----------
from scriptcontext import sticky as st
from mini_eggshell.ur_online_control.ur_direct.utilities import is_available


guid = str(ghenv.Component.InstanceGuid)
txt_key = "txt_" + guid
if txt_key not in st:
    st[txt_key] = ""

if ping:
    
    available = is_available(ip)
    
    if available:
        st[txt_key] = "%s is up!" % ip
    else:
        st[txt_key] = "%s is down!" % ip

print st[txt_key]
# ---------- end py ----------
panel_3 = Panel(py)

# ----
Z = UnitZ(Factor=series)
cir = Circle(Plane=pt, Radius=Slider(65, range=0..100))
range = Range(Domain=Domain(0, 1), Steps=number_slider)
move = Move(Geometry=cir, Motion=Z)  # -> Geometry, Transform
pipe = Pipe(Curve=move.Geometry, Radius=integer_division, Caps=1)  # -> flatten(Pipe)
cap = CapHoles(Brep=pipe)
graph = GraphMapper(range, x0=0, x1=1, y0=0, y1=1, container_name="Sine", Equation_px=[0, 1], Equation_py=[0.7653694153, 0.9405152202])
area = Area(Geometry=move.Geometry)  # -> Area, Centroid

# ---- group: distance
# Geometry
number_slider_3 = Slider(200, range=0..1000)

# ---- group: point
number_slider_4 = Slider(20, range=0..100)

# ---- group: mm3 to Litres
volume = Volume(Geometry=cap)  # -> Volume, Centroid
multiplication = Multiplication(A=volume.Volume, B="0.000001")
ma = MassAddition(Input=multiplication)  # -> Result, PartialResults
panel_4 = Panel(ma.Result)

# ---- group: Robot
# 1. load robot model
# 2. set tool
# 3. set basis
bang = Button()
panel_5 = Panel("Unload libraries")
unload = PythonScript(bang=bang)
# ---------- unload: Python ----------
from compas_ghpython import unload_modules

unload_modules("compas")
unload_modules("ur_online_control")
# ---------- end unload ----------

# ----
cull_i = CullIndex(List=graph, Indices=-1, Wrap=True)
scale = Scale(Geometry=move.Geometry, Center=area.Centroid, Factor=cull_i)  # -> Geometry, Transform
divide = DivideCurve(Curve=scale.Geometry, Count=Slider(12, range=0..100), Kinks=False)  # -> Points, Tangents, Parameters

# ---- group: Robot
# 1. load robot model
# 2. set tool
# 3. set basis
list = ValueList({"no_tool": 0, "plastic_extruder": 1, "clay_extruder": 2, "clay_extruder_SS": 3}, selected="clay_extruder")
tools = Tools(tool_id=list)
base = PythonScript()  # -> base_frame, base
# ---------- base: Python ----------
from compas.geometry import Frame

"""
origin = [0, 0, 0]
xaxis = [1, 0, 0]
yaxis = [0, 1, 0]


origin = [-313.92, -147.58, 13.79]
xaxis = [0.00000, -1.00000, 0.00000]
yaxis = [1.00000, 0.00000, 0.00000]
"""

#axis    Y         Z                        X

#origin = [284.18, 20.87, 38.02]
#xaxis = [0.00000, 1.00000, 0.00000]
#yaxis = [-1.00000, 0.00000, 0.00000]


#origin = [211.27, 507.88, -79.82]
#xaxis = [-0.05035, -0.99873, 0.00000]
#yaxis = [0.99873, -0.05035, 0.00000]

origin = [-687.17, -107.73, -294.36]
xaxis = [1.00000, 0.00000, 0.00000]
yaxis = [0.00000, 1.00000, 0.00000]




base_frame = Frame(list(origin), list(xaxis), list(yaxis))

base = "base = " + str(origin) + "\n"
# ---------- end base ----------
list_2 = ValueList({"UR5", "UR10"}, selected="UR5")
robot = PythonScript(model=list_2, tool=tools, base_frame=base.base_frame)  # -> robot
# ---------- robot: Python ----------
from mini_eggshell.ur_online_control.ur.ur10 import UR10
from mini_eggshell.ur_online_control.ur.ur5 import UR5
from scriptcontext import sticky as st

if model == "UR5":
    robot = UR5()
elif model == "UR10":
    robot = UR10()

if tool:
    robot.set_tool(tool)
if base_frame:
    robot.set_base(base_frame)

st["robot"] = robot
# ---------- end robot ----------

# ----
point = Point(<point referenced from the Rhino model>)
number_slider_5 = Slider(20, range=0..100)
number_slider_6 = Slider(20, range=0..100)
panel_6 = Panel(base.base)
renumber_paths = RenumberPaths()

# ---- group: length
number_slider_7 = Slider(280, range=0..1000)

# ---- group: height
number_slider_8 = Slider(150, range=0..1000)

# ----
number_slider_9 = Slider(90, range=0..100)
number_slider_10 = Slider(0, range=0..1000)
range_2 = Range(Domain=Domain(0, 1), Steps=number_slider_6)
range_3 = Range(Domain=number_slider_7, Steps=number_slider_6)
range_4 = Range(Domain=number_slider_8, Steps=number_slider_6)
range_5 = Range(Domain=Domain(0, 1), Steps=number_slider_5)
range_6 = Range(Domain=number_slider_7, Steps=number_slider_5)
range_7 = Range(Domain=number_slider_8, Steps=number_slider_5)
graph_2 = GraphMapper(
    range_2,
    x0=0,
    x1=1,
    y0=0,
    y1=1,
    container_name="Sinc",
    Equation_X0=0.7168884277,
    Equation_X1=0.5279306769,
    Equation_Y0=0.8048963547,
    Equation_Y1=0.2381280065)
graph_3 = GraphMapper(
    range_2,
    x0=0,
    x1=1,
    y0=0,
    y1=1,
    container_name="Bezier",
    cpx=[0, 0.195652172, 0.8043478131, 1],
    cpy=[0.1913043261, 0, 0.9739130139, 0.7188404799])
graph_4 = GraphMapper(
    range_5,
    x0=0,
    x1=1,
    y0=0,
    y1=1,
    container_name="Sinc",
    Equation_X0=0.3072465658,
    Equation_X1=0.5043480992,
    Equation_Y0=0.7750723958,
    Equation_Y1=0.1591303945)
graph_5 = GraphMapper(
    range_5,
    x0=0,
    x1=1,
    y0=0,
    y1=1,
    A=-1.285927476,
    B=0.9127827287,
    container_name="Linear",
    Graph_x0=0,
    Graph_x1=0.5224238038,
    Graph_y0=0.9127827287,
    Graph_y1=0.2409836054)
crossref = CrossReference(ListA=range_3, ListB=range_3, CrossMode=1)  # -> ListA, ListB
crossref_2 = CrossReference(ListA=range_4, ListB=range_4, CrossMode=1)  # -> ListA, ListB
crossref_3 = CrossReference(ListA=range_6, ListB=range_6, CrossMode=1)  # -> ListA, ListB
crossref_4 = CrossReference(ListA=range_7, ListB=range_7, CrossMode=1)  # -> ListA, ListB
crossref_5 = CrossReference(ListA=graph_2, ListB=graph_3, CrossMode=1)  # -> ListA, ListB
crossref_6 = CrossReference(ListA=graph_4, ListB=graph_5, CrossMode=1)  # -> ListA, ListB
multiplication_2 = Multiplication(A=crossref_5.ListA, B=crossref_5.ListB)
multiplication_3 = Multiplication(A=crossref_6.ListA, B=crossref_6.ListB)
multiplication_4 = Multiplication(A=Slider(100, range=0..100), B=multiplication_2)
multiplication_5 = Multiplication(A=Slider(40, range=0..100), B=multiplication_3)
addition = Addition(A=number_slider_5, B=Slider(1, range=0..1))
addition_2 = Addition(A=number_slider_6, B=Slider(1, range=0..1))
pt_2 = ConstructPoint(XCoordinate=crossref.ListA, YCoordinate=multiplication_4, ZCoordinate=crossref_2.ListB)
pt_3 = ConstructPoint(XCoordinate=crossref_3.ListA, YCoordinate=multiplication_5, ZCoordinate=crossref_4.ListB)
srfgrid = SurfaceFromPoints(Points=flatten(pt_2), UCount=addition_2, Interpolate=False)

# ---- group: plane b
srfgrid_2 = SurfaceFromPoints(Points=flatten(pt_3), UCount=addition, Interpolate=False)

# ----
Y = UnitY(Factor=Slider(70, range=0..1000))

# ---- group: plane a
move_2 = Move(Geometry=srfgrid, Motion=Y)  # -> Geometry, Transform

# ---- group: offset distance
number_slider_11 = Slider(12.5, range=0..50)

# ----
contour = Contour(Shape=move_2.Geometry, Point=Point(0, 0, 0), Direction=Vector(0, 0, 1), Distance=Slider(8, range=0..10))  # -> flatten(Contours)
contour_2 = Contour(Shape=srfgrid_2, Point=Point(0, 0, 0), Direction=Vector(0, 0, 1), Distance=Slider(8, range=0..10))  # -> flatten(Contours)

# ---- group: points distance
number_slider_12 = Slider(20, range=0..100)

# ----
item = ListItem(List=contour_2, Index=0, Wrap=True)
item_2 = ListItem(List=contour, Index=0, Wrap=True)

# ---- group: point for positioning
pt_4 = Point(<point referenced from the Rhino model>)

# ----
range_8 = Range(Domain=Domain(0, 1), Steps=number_slider_4)
number_slider_13 = Slider(100, range=0..100)
graph_6 = GraphMapper(
    range_8,
    x0=0,
    x1=1,
    y0=0,
    y1=1,
    container_name="Sinc",
    Equation_X0=0.3330436349,
    Equation_X1=0.500579834,
    Equation_Y0=0.6089853048,
    Equation_Y1=0.3773914576)
graph_7 = GraphMapper(
    range_8,
    x0=0,
    x1=1,
    y0=0,
    y1=1,
    container_name="Sine Summation",
    Equation0_px=[0.09590347856, 0.5256130695],
    Equation0_py=[0.5326871872, 0.2694144845],
    Equation1_px=[0.6617882848, 0.8887475133],
    Equation1_py=[0.2391532063, 0.411642313])
range_9 = Range(Domain=number_slider_3, Steps=number_slider_4)
multiplication_6 = Multiplication(A=number_slider_13, B=graph_6)
multiplication_7 = Multiplication(A=number_slider_13, B=graph_7)
pt_5 = ConstructPoint(XCoordinate=range_9, YCoordinate=multiplication_6, ZCoordinate=0)
pt_6 = ConstructPoint(XCoordinate=range_9, YCoordinate=multiplication_7, ZCoordinate=0)
dist = Distance(PointA=pt_5, PointB=pt_6)
panel_7 = Panel(dist)
sort = SortList(Keys=dist, ValuesA=pt_5)  # -> Keys, ValuesA
sort_2 = SortList(Keys=dist, ValuesA=pt_6)  # -> Keys, ValuesA
item_3 = ListItem(List=sort.Keys, Index=0, Wrap=True)
subtraction = Subtraction(A=Slider(50, range=0..100), B=item_3)
Y_2 = UnitY(Factor=subtraction)
number_slider_14 = Slider(10, range=0..10)
move_3 = Move(Geometry=pt_6, Motion=Y_2)  # -> Geometry, Transform
pline = PolyLine(Vertices=pt_5, Closed=False)
pline_2 = PolyLine(Vertices=move_3.Geometry, Closed=False)
range_10 = Range(Domain=Domain(0, 1), Steps=number_slider_14)
range_11 = Range(Domain=Domain(0, 1), Steps=number_slider_14)
end = EndPoints(Curve=pline)  # -> Start, End
end_2 = EndPoints(Curve=pline_2)  # -> Start, End
graph_8 = GraphMapper(
    range_11,
    x0=0,
    x1=1,
    y0=0,
    y1=1,
    container_name="Bezier",
    cpx=[0, 0.5289855003, 0.7053771019, 1],
    cpy=[0, 0, 0.7821885347, 0])
graph_9 = GraphMapper(range_10, x0=0, x1=1, y0=0, y1=1, container_name="Sine", Equation_px=[0, 0.5015125871], Equation_py=[0, 0.434948504])
pdecon = Deconstruct(Point=end.Start)  # -> XComponent, YComponent, ZComponent
pdecon_2 = Deconstruct(Point=end_2.Start)  # -> XComponent, YComponent, ZComponent
pdecon_3 = Deconstruct(Point=end.End)  # -> XComponent, YComponent, ZComponent
pdecon_4 = Deconstruct(Point=end_2.End)  # -> XComponent, YComponent, ZComponent
multiplication_8 = Multiplication(A=Slider(20, range=0..50), B=graph_8)
dom = ConstructDomain(DomainStart=pdecon.YComponent, DomainEnd=pdecon_2.YComponent)
dom_2 = ConstructDomain(DomainStart=pdecon_3.YComponent, DomainEnd=pdecon_4.YComponent)
neg = Negative(Value=Slider(20, range=0..50))
multiplication_9 = Multiplication(A=neg, B=graph_9)
range_12 = Range(Domain=dom, Steps=10)
range_13 = Range(Domain=dom_2, Steps=10)
addition_3 = Addition(A=pdecon_4.XComponent, B=multiplication_9)
pt_7 = ConstructPoint(XCoordinate=multiplication_8, YCoordinate=range_12, ZCoordinate=0)
pt_8 = ConstructPoint(XCoordinate=addition_3, YCoordinate=range_13, ZCoordinate=0)
pline_3 = PolyLine(Vertices=pt_7, Closed=False)
pline_4 = PolyLine(Vertices=pt_8, Closed=False)
crv = Curve(pline)
crv_2 = Curve(pline_2)
merge = Merge(Data1=crv, Data2=pline_4, Data3=crv_2, Data4=pline_3)  # -> flatten(Result)
join = JoinCurves(Curves=merge, Preserve=False)
Z_2 = UnitZ(Factor=Slider(100, range=0..1000))
move_4 = Move(Geometry=join, Motion=Z_2)  # -> Geometry, Transform
loft = Loft(
    Curves=[move_4.Geometry, join],
    Options={Adjust=False, Closed=False, LoftEnds=0, LoftSimp=0, LoftType=0, Rebuild=10, Refit=0.01})
pt_9 = Point(end.Start)
vec2pt = Vector2Pt(PointA=pt_9, PointB=pt_4, Unitize=False)  # -> Vector, Length

offset = OffsetCurve(Curve=join, Distance=number_slider_11, Plane=PlaneXY(0, 0, 0), Corners=1)
move_5 = Move(Geometry=offset, Motion=Z_2)  # -> Geometry, Transform
loft_2 = Loft(
    Curves=[offset, move_5.Geometry],
    Options={Adjust=False, Closed=False, LoftEnds=0, LoftSimp=0, LoftType=0, Rebuild=10, Refit=0.01})

# ----
# Direct UR control
get = Button()
get_2 = Button()
pose = PythonScript(get=get_2)  # -> pose_joints
# ---------- pose: Python ----------
from scriptcontext import sticky as st
from mini_eggshell.ur_online_control.ur_direct import get_current_pose_joints
from mini_eggshell.ur_online_control.ur.robot import BaseConfiguration

server_address = st["server_address"]
server_port = 30005
ur_ip = st["ur_ip"]
robot = st["robot"]
tool_angle_axis = list(robot.tool.tcp_frame.point) + list(robot.tool.tcp_frame.axis_angle_vector)
print tool_angle_axis

guid = str(ghenv.Component.InstanceGuid)
pose_joints_key = "pose_joints" + guid

if get:
    st[pose_joints_key] = get_current_pose_joints(server_address, server_port, ur_ip, tool_angle_axis)
    
if pose_joints_key not in st:
    pose_joints = []
else:
    pose_joints = BaseConfiguration.from_joints(st[pose_joints_key])
# ---------- end pose ----------
pose_2 = PythonScript(get=get)  # -> pose_cartesian
# ---------- pose_2: Python ----------
from scriptcontext import sticky as st
from mini_eggshell.ur_online_control.ur_direct import get_current_pose_cartesian

server_address = st["server_address"]
server_port = 30005
ur_ip = st["ur_ip"]
robot = st["robot"]

tool_angle_axis = list(robot.tool.tcp_frame.point) + robot.tool.tcp_frame.axis_angle_vector
print tool_angle_axis

guid = str(ghenv.Component.InstanceGuid)
pose_cartesian_key = "pose_cartesian" + guid


if get:
    st[pose_cartesian_key] = get_current_pose_cartesian(server_address, server_port, ur_ip, tool_angle_axis)

if pose_cartesian_key not in st:
    pose_cartesian = []
else:
    pose_cartesian = st[pose_cartesian_key]
# ---------- end pose_2 ----------
stop = Button()
stop_2 = PythonScript(stop=stop)
# ---------- stop_2: Python ----------
from scriptcontext import sticky as st
from mini_eggshell.ur_online_control.ur_direct import stop as stop_robot

ur_ip = st["ur_ip"]

if stop:
    stop_robot(ur_ip)
# ---------- end stop_2 ----------
panel_8 = Panel(pose)
panel_9 = Panel(pose_2)

divide_2 = DivideCurve(Curve=item, Count=number_slider_12, Kinks=False)  # -> Points, Tangents, Parameters
point_2 = Point(<point referenced from the Rhino model>)
divide_3 = DivideCurve(Curve=item_2, Count=number_slider_12, Kinks=False)  # -> Points, Tangents, Parameters
# 0b
vertical_pose = Number([-152.427, -780.635, 855.229, -1.1958, -1.22046, -1.20201])
series_2 = Series(Start=0, Step=Slider(3, range=0..10), Count=Slider(28, range=0..100))
circle = Circle(Plane=point_2, Radius=Slider(50, range=0..100))
dist_2 = Distance(PointA=divide_3.Points, PointB=divide_2.Points)
curve = Curve(<curve referenced from the Rhino model>)
unit_z = UnitZ(Factor=series_2)
amount_of_layers = Slider(16, range=0..100)
layer_height_1 = Slider(3, range=0..10)
layer_height_2 = Slider(2, range=0..10)
curve_2 = Curve(<curve referenced from the Rhino model>)
divide_curve = DivideCurve(Curve=circle, Count=Slider(8, range=0..10), Kinks=False)  # -> Points, Tangents, Parameters
sort_3 = SortList(Keys=dist_2, ValuesA=divide_3.Points)  # -> Keys, ValuesA
sort_4 = SortList(Keys=dist_2, ValuesA=divide_2.Points)  # -> Keys, ValuesA

# ---- group: smooth path
move_6 = Move(Geometry=loft_2, Motion=vec2pt.Vector)  # -> Geometry, Transform

# ----
back = Button()
reset = Button()
number_slider_15 = Slider(40, range=0..100)
item_4 = ListItem(List=sort_3.Keys, Index=0, Wrap=True)

# ---- group: Define joint positions
base_2 = Slider(90.163, range=-360..360)
shoulder = Slider(0, range=-360..360)
elbow = Slider(-102.857, range=-360..360)
wrist1 = Slider(0, range=-360..360)
wrist2 = Slider(0, range=-360..360)
wrist3 = Slider(0, range=-360..360)
ur1_q1_q6 = Data([base_2, shoulder, elbow, wrist1, wrist2, wrist3])

# ----
move_7 = Move(Geometry=curve, Motion=unit_z)  # -> Geometry, Transform
area_2 = Area(Geometry=curve_2)  # -> Area, Centroid
loft_3 = Loft(
    Curves=[<geometry referenced from the Rhino model> x2],
    Options={Adjust=True, Closed=False, LoftEnds=0, LoftSimp=0, LoftType=0, Rebuild=10, Refit=0.01})

# ---- group: geometry
move_8 = Move(Geometry=loft_3, Motion=vec2pt.Vector)  # -> Geometry, Transform

# ----
# Measure basis:
# 1. Clear the recorded poses
# 2. Move robot to origin and press "get pose"
# 3. Move robot to point in positive x-axis and press "get pose"
# 4. Move robot to an other point in your basis and press "get pose"
# (The farer away these positions are, the better)
# 
# 5. Alternatively change the order in the component calc base
# 6. Copy output into base component
# Calculate basis
list_3 = ValueList({"origin, pt on positive x-axis, pt in xy plane": 0, "origin, pt on positive y-axis, pt in xy plane": 1}, selected="origin, pt on positive x-axis, pt in xy plane")
clear = Button()
rec = PythonScript(msg=pose_2, rec=get, clear=clear)  # -> rec; inputs msg: list
# ---------- rec: Python ----------
from scriptcontext import sticky as st

guid = str(ghenv.Component.InstanceGuid)
recorded_key =  "recorded_" + guid
just_cleared_key = "just_cleared_" + guid

if recorded_key not in st:
    st[recorded_key] = []

if just_cleared_key not in st:
    st[just_cleared_key] = False

if clear:
    st[recorded_key] = []
    st[just_cleared_key] = True
else:
    if len(msg):
        if msg != [None] and not st[just_cleared_key] and rec:
            st[recorded_key].append(msg)
    st[just_cleared_key] = False
        


rec = st[recorded_key]

print rec
# ---------- end rec ----------
calc_base = PythonScript(poses=rec, input_type=list_3)  # -> out; inputs poses: list
# ---------- calc_base: Python ----------
import Rhino.Geometry as rg
import math


if len(poses) > 2:
    
    O = poses[0]
    P1 = poses[1]
    P2 = poses[2]
    
    if input_type == 0:
        # origin, pt on positive x-axis, pt in xy plane
        origin = rg.Point3d(O[0], O[1], O[2])
        pt_on_xaxis = rg.Point3d(P1[0], P1[1], P1[2])
        pt_in_xyplane = rg.Point3d(P2[0], P2[1], P2[2])
        
        xaxis = pt_on_xaxis - origin
        xaxis.Unitize()
        
        v = pt_in_xyplane - origin
        zaxis = rg.Vector3d.CrossProduct(v, xaxis)
        zaxis.Unitize()
        
        # zaxis must look up!
        if math.acos(rg.Vector3d.ZAxis * zaxis) > math.acos(rg.Vector3d.ZAxis * -zaxis):
            zaxis = -zaxis
        
        yaxis = rg.Vector3d.CrossProduct(zaxis, xaxis)
    
    elif input_type == 1:
        # origin, pt on positive y-axis, pt in xy plane
        origin = rg.Point3d(O[0], O[1], O[2])
        pt_on_yaxis = rg.Point3d(P1[0], P1[1], P1[2])
        pt_in_xyplane = rg.Point3d(P2[0], P2[1], P2[2])
        
        yaxis = pt_on_yaxis - origin
        yaxis.Unitize()
        
        v = pt_in_xyplane - origin
        zaxis = rg.Vector3d.CrossProduct(v, yaxis)
        zaxis.Unitize()
        
        # zaxis must look up!
        if math.acos(rg.Vector3d.ZAxis * zaxis) > math.acos(rg.Vector3d.ZAxis * -zaxis):
            zaxis = -zaxis
        
        xaxis = rg.Vector3d.CrossProduct(yaxis, zaxis)
        
        
    print "Copy the following into base component:"
    print " "
    print "origin = [%.2f, %.2f, %.2f]" % tuple(list(origin))
    print "xaxis = [%.5f, %.5f, %.5f]" % tuple(list(xaxis))
    print "yaxis = [%.5f, %.5f, %.5f]" % tuple(list(yaxis))
    

#print rg.Vector3d.CrossProduct(rg.Vector3d.YAxis, rg.Vector3d.ZAxis)
#print rg.Vector3d.CrossProduct(rg.Vector3d.ZAxis, rg.Vector3d.XAxis)
# ---------- end calc_base ----------
panel_10 = Panel(rec)
panel_11 = Panel(calc_base)

subtraction_2 = Subtraction(A=Slider(15, range=0..100), B=item_4)
cull_pattern = CullPattern(List=divide_curve.Points, CullPattern=[True, False])
cull_pattern_2 = CullPattern(List=divide_curve.Points, CullPattern=[False, True])
py_2 = GhPythonScript(joint_values=ur1_q1_q6)  # -> configuration; inputs joint_values: list
# ---------- py_2: Python ----------
import math
from ur_online_control.ur.robot import BaseConfiguration

configuration = BaseConfiguration.from_joints([math.radians(d) for d in joint_values])
# ---------- end py_2 ----------
multiplication_10 = Multiplication(A=layer_height_1, B=amount_of_layers)
Y_3 = UnitY(Factor=subtraction_2)
multiplication_11 = Multiplication(A=layer_height_2, B=amount_of_layers)
number_slider_16 = Slider(20, range=0..100)
pt_10 = Point(<point referenced from the Rhino model>)
rotate = Rotate(Angle=1.570796327, Plane=PlaneXY(0, 0, 0))  # -> Geometry, Transform
move_9 = Move(Geometry=contour, Motion=Y_3)  # -> Geometry, Transform
crv_3 = Curve(contour_2)
unit_z_2 = UnitZ(Factor=multiplication_10)
unit_z_3 = UnitZ(Factor=multiplication_11)
divide_curve_2 = DivideCurve(Curve=move_7.Geometry, Count=number_slider_15, Kinks=False)  # -> Points, Tangents, Parameters

# ---- group: Visualise / robot model brep
py_3 = PythonScript(model=list_2)  # -> n
# ---------- py_3: Python ----------
if model == "UR5":
    n = 0
if model == "UR10":
    n = 1

print n
# ---------- end py_3 ----------
ur10_brep = UR10Brep([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])
ur5_brep = UR5Brep([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])
show_brep = BooleanToggle(False)
filter = StreamFilter(Gate=py_3, Stream0=ur5_brep, Stream1=ur10_brep)

# ----
divide_4 = DivideCurve(Curve=move_9.Geometry, Count=number_slider_16, Kinks=False)  # -> Points, Tangents, Parameters
divide_5 = DivideCurve(Curve=crv_3, Count=number_slider_16, Kinks=False)  # -> Points, Tangents, Parameters
end_3 = EndPoints(Curve=move_9.Geometry)  # -> Start, End
end_4 = EndPoints(Curve=crv_3)  # -> Start, End
ln = Line(StartPoint=end_3.Start, EndPoint=end_4.Start)
ln_2 = Line(StartPoint=end_4.End, EndPoint=end_3.End)
move_10 = Move(Geometry=cull_pattern, Motion=unit_z_3)  # -> graft(Geometry), Transform
move_11 = Move(Geometry=cull_pattern_2, Motion=unit_z_2)  # -> graft(Geometry), Transform
vec2pt_2 = Vector2Pt(PointA=area_2.Centroid, PointB=pt_10, Unitize=False)  # -> Vector, Length
move_12 = Move(Geometry=rotate.Geometry, Motion=vec2pt_2.Vector)  # -> Geometry, Transform

# ---- group: input_geometry
geo = Geometry(move_12.Geometry)

# ----
# Slicing existing geometry
layer_height_mm = Slider(2.5, range=0..10)
distance_between_points_mm = Slider(10, range=5..50)
slice = BooleanToggle(True)
slicer = GhPythonScript(slice=slice, input_geometry=geo, layer_height=layer_height_mm, distance_between_points=distance_between_points_mm)  # -> out, crvs, pts
# ---------- slicer: Python ----------
__author__ = "joburger"
__version__ = "2019.10.28"

import Rhino
import Rhino.Geometry as rg

import mini_eggshell.slicer.simple_slicer
reload(mini_eggshell.slicer.simple_slicer)

slicer = mini_eggshell.slicer.simple_slicer.Slicer(layer_height, distance_between_points)

if slice:
    if str(input_geometry.ObjectType) == "Mesh":
        print "Input geometry is of Mesh type"  
        crvs = slicer.create_contour_curves_from_mesh(input_geometry)
    elif str(input_geometry.ObjectType) == "Brep":
        print "Input geometry is of Brep type"
        crvs = slicer.create_contour_curves_from_brep(input_geometry)
    else:
        print "Input geometry not supported"
    
    pts = slicer.divide_curves_in_points()
# ---------- end slicer ----------
list_item = ListItem(List=slicer.pts, Index=Slider(1348, range=0..1700), Wrap=True)

# ----
# Split Path in Parts
number_slider_17 = Slider(2040, range=0..10000)
partition_list = PartitionList(List=flatten(slicer.pts), Size=number_slider_17)
tree_branch = TreeBranch(Tree=simplify(partition_list), Path=Slider(0, range=0..1), MaintainPaths=True)

# ---- group: output_curves
crv_4 = Curve(slicer.crvs)

# ----
flip_matrix = FlipMatrix(Data=divide_curve_2.Tangents)
flip_matrix_2 = FlipMatrix(Data=divide_curve_2.Points)
loft_4 = Loft(Curves=move_9.Geometry, Options={Adjust=False, Closed=False, LoftEnds=0, LoftSimp=0, LoftType=0, Rebuild=10, Refit=0.01})
loft_5 = Loft(Curves=ln, Options={Adjust=False, Closed=False, LoftEnds=0, LoftSimp=0, LoftType=0, Rebuild=10, Refit=0.01})
loft_6 = Loft(Curves=crv_3, Options={Adjust=False, Closed=False, LoftEnds=0, LoftSimp=0, LoftType=0, Rebuild=10, Refit=0.01})
loft_7 = Loft(Curves=ln_2, Options={Adjust=False, Closed=False, LoftEnds=0, LoftSimp=0, LoftType=0, Rebuild=10, Refit=0.01})
merge_2 = Merge(Data1=loft_4, Data2=loft_5, Data3=loft_6, Data4=loft_7)  # -> flatten(Result)
series_3 = Series(Start=Slider(1, range=0..1), Step=Slider(0.54, range=0..1), Count=number_slider_15)
number_slider_18 = Slider(15, range=0..100)
weave = Weave(Pattern=[1, 0], Stream0=cull_pattern_2, Stream1=cull_pattern, NullGaps=False)
multiplication_12 = Multiplication(A=flip_matrix, B=graft(series_3))
weave_2 = Weave(Pattern=[1, 0], Stream0=move_11.Geometry, Stream1=move_10.Geometry, NullGaps=False)
move_13 = Move(Geometry=flip_matrix_2, Motion=multiplication_12)  # -> Geometry, Transform
division = Division(A="1", B=amount_of_layers)
join_2 = BrepJoin(Breps=merge_2)  # -> Breps, Closed
merge_3 = Merge(Data1=move_11.Geometry, Data2=move_10.Geometry)
range_14 = Range(Domain=Domain(0, 1), Steps=expr("x-1", amount_of_layers))
scale_2 = Scale(Geometry=join_2.Breps, Center=Point(0, 0, 0), Factor=Slider(0.5, range=0..1))  # -> Geometry, Transform
point_3 = Point(flatten(merge_3))
interpolate = Interpolate(Vertices=flatten(weave), Degree=3, Periodic=True, KnotStyle=1)  # -> Curve, Length, Domain
interpolate_2 = Interpolate(Vertices=flatten(weave_2), Degree=3, Periodic=True, KnotStyle=1)  # -> Curve, Length, Domain
flip_matrix_3 = FlipMatrix(Data=move_13.Geometry)
contour_3 = Contour(Shape=scale_2.Geometry, Point=Point(0, 0, 0), Direction=Vector(0, 0, 1), Distance=Slider(3, range=0..10))  # -> flatten(Contours)
polyline = PolyLine(Vertices=point_3, Closed=True)
polyline_2 = PolyLine(Vertices=flatten(flip_matrix_3), Closed=False)
lng = ListLength(List=contour_3)
split = SplitList(List=contour_3, Index=expr("x-1", lng))  # -> ListA, ListB
explode = Explode(Curve=split.ListB, Recursive=True)  # -> Segments, Vertices
tween_curve = TweenCurve(CurveA=interpolate.Curve, CurveB=interpolate_2.Curve, Factor=range_14, BlendType=0)
item_5 = ListItem(List=explode.Segments, Index=0, Wrap=True)  # -> Item, Item1, Item2, Item3

panel_12 = Panel("set digital out")
number = Slider(0, range=0..10)
value = BooleanToggle(False)
digital_out = PythonScript(number=number, value=value)  # -> script; inputs number: Int32, value: Boolean
# ---------- digital_out: Python ----------
script = "def prog():\n"
script += "\ttextmsg(\">> program start\")\n"
script += "\tset_digital_out(%i, %s)\n" % (int(number), str(value))
script += "\ttextmsg(\"<< program end\")\n"
script += "end\n"
script += "prog()\n\n"

print script
# ---------- end digital_out ----------
send = Button()
send_2 = Send(script=digital_out, send=send)
panel_13 = Panel(send_2)

panel_14 = Panel("move vertical")
movel = PythonScript()  # -> script
# ---------- movel: Python ----------
from scriptcontext import sticky as st

robot = st["robot"]

tool_angle_axis = list(robot.tool.tcp_frame.point) + robot.tool.tcp_frame.axis_angle_vector
x, y, z, ax, ay, az = tool_angle_axis

script = "def prog():\n"
script += "\ttextmsg(\">> program start\")\n"
script += "\tset_tcp(p%s)\n" % str([x/1000., y/1000., z/1000, ax, ay, az])
script += "\tcurrent_pose = get_forward_kin()\n"
script += "\tmovel(p[current_pose[0], current_pose[1], current_pose[2], 0, 0, 0], a=0.1, v=0.1)\n"
script += "\ttextmsg(\"<< program end\")\n"
script += "end\n"
script += "prog()\n\n"

print script
# ---------- end movel ----------
send_3 = Button()
send_4 = Send(script=movel, send=send_3)
panel_15 = Panel(send_4)

crv_5 = Curve(item_5.Item2)
crv_6 = Curve(item_5.Item1)
crv_7 = Curve(item_5.Item)
crv_8 = Curve(item_5.Item3)
divide_distance = DivideDistance(Curve=tween_curve, Distance=Slider(13, range=0..100))  # -> Points, Tangents, Parameters
merge_4 = Merge(Data1=crv_5, Data2=crv_6, Data3=crv_7, Data4=crv_8)
number_slider_19 = Slider(40, range=0..100)
flip = FlipCurve(Curve=merge_4)  # -> Curve, Flag
join_3 = JoinCurves(Curves=flip.Curve, Preserve=False)
xy_plane = XYPlane(Origin=divide_distance.Points)
divide_6 = DivideCurve(Curve=split.ListA, Count=number_slider_19, Kinks=False)  # -> Points, Tangents, Parameters
divide_7 = DivideCurve(Curve=join_3, Count=number_slider_19, Kinks=False)  # -> Points, Tangents, Parameters
flatten = FlattenTree(Tree=divide_6.Points, Path="{0}")
lng_2 = ListLength(List=flatten)
ins = InsertItems(List=flatten, Item=divide_7.Points, Indices=lng_2, Wrap=True)
pt_11 = Point(<point referenced from the Rhino model>)
points = PointList(Points=ins, Size=Slider(2, range=0..10))
pline_5 = PolyLine(Vertices=ins, Closed=False)
item_6 = ListItem(List=ins, Index=0, Wrap=True)
vec2pt_3 = Vector2Pt(PointA=item_6, PointB=pt_11, Unitize=False)  # -> Vector, Length
move_14 = Move(Geometry=ins, Motion=vec2pt_3.Vector)  # -> Geometry, Transform

# ---- group: output_points
pt_12 = Point(move_14.Geometry)

# ----
list_item_2 = ListItem(List=pt_12, Index=Slider(0, range=0..10000), Wrap=True)

# ---- group: Fabrication planes
pln = Plane(flatten(pt_12))

# ----
pln_2 = Plane(flatten(pln))
rotate_2 = Rotate(Geometry=pln_2, Angle=degrees(number_slider_9), Plane=pln_2)  # -> Geometry, Transform

# ---- group: Printing time
printing_speed_mm_s = Slider(40, range=0..100)
pline_6 = PolyLine(Vertices=pt_12, Closed=False)
len = Length(Curve=pline_6)
division_2 = Division(A=len, B=printing_speed_mm_s)
division_3 = Division(A=division_2, B=60)
total_print_time_minutes = Panel(division_3)

# ---- group: Printing path visualization
dom_3 = ConstructDomain(DomainStart=Slider(0, range=0..1000), DomainEnd=Slider(1000, range=0..1000))
subset = SubList(List=pt_12, Domain=dom_3, Wrap=True)  # -> List, Index
pline_7 = PolyLine(Vertices=subset.List, Closed=False)

# ----
pt_13 = Point(rotate_2.Geometry)

# ---- group: test_pt
pt_14 = Point(Point(24.81319733, 37.76746931, -41.49502575))
xy = XYPlane(Origin=pt_13)
rotate_3 = Rotate(Geometry=xy, Angle=degrees(Slider(0, range=0..1000)), Plane=xy)  # -> Geometry, Transform

# ---- group: filament_loading_pt
pt_15 = Point(<point referenced from the Rhino model>)
xy_2 = XYPlane(Origin=pt_14)
rotate_4 = Rotate(Geometry=xy_2, Angle=degrees(number_slider_9), Plane=xy_2)  # -> Geometry, Transform

# ---- group: Define commands
safe_speed = Slider(20, range=0..300)
# 1
number_slider_20 = Slider(10, range=0..100)
speed = Slider(10, range=0..300)
planes_wcs = Plane(rotate_2.Geometry)
python = PythonScript(planes_WCS=planes_wcs, dfillet=number_slider_20, speed=speed, safe_speed=safe_speed, safe_pt=rotate_4.Geometry)  # -> commands; inputs planes_WCS: list of Plane, speed: Int32, safe_pt: Plane
# ---------- python: Python ----------
import Rhino.Geometry as rg
from compas.geometry import Frame
from compas.geometry import Transformation
from scriptcontext import sticky as st


robot = st["robot"]
buffer = 0.5

commands = []

def generate_cmds(planes_WCS, dfillet, speed, safe_speed, safe_pt):

    # add safe_pt as a starting point
    tcp_WCS_safe_pt = Frame(safe_pt.Origin, safe_pt.XAxis, safe_pt.YAxis)

    tcp_RCS_safe_pt = robot.get_frame_in_RCS(tcp_WCS_safe_pt)
    cmd_safe_pt = list(tcp_RCS_safe_pt.point) + tcp_RCS_safe_pt.axis_angle_vector + [safe_speed, 0]
    commands.append(cmd_safe_pt)


    # TODO this must be optimized! matrix multiplication!

    for i, plane_WCS in enumerate(planes_WCS):
        tcp_WCS = Frame(plane_WCS.Origin, plane_WCS.XAxis, plane_WCS.YAxis)
        if i == 0 or i == len(planes_WCS) - 1:
            radius = 0.

        else:
            # calculate blend radius
            prev, current, next = planes_WCS[i-1].Origin, planes_WCS[i].Origin, planes_WCS[i+1].Origin
            # print((prev - current).Length/2 * buffer, (next - current).Length/2 * buffer, dfillet)
            radius = min((prev - current).Length/2 * buffer, (next - current).Length/2 * buffer, dfillet)
            radius = round(radius,5)
        print(radius)
        # print()


        tcp_RCS = robot.get_frame_in_RCS(tcp_WCS)
        cmd = list(tcp_RCS.point) + tcp_RCS.axis_angle_vector + [speed, radius]
        commands.append(cmd)


    # add safe_pt as an end point
    commands.append(cmd_safe_pt)
    return commands


commands = generate_cmds(planes_WCS, dfillet, speed, safe_speed, safe_pt)

print commands[0]
# ---------- end python ----------

# ----
pln_3 = Plane(planes_wcs)

# ---- group: save_commands
py_4 = PythonScript()  # -> path
# ---------- py_4: Python ----------
import sys
import os

ghComp = ghenv.Component
ghDoc = ghComp.OnPingDocument()

# the full path of the gh file
path = ghDoc.FilePath
# the directory of the gh file
path = os.path.dirname(path)

path = os.path.abspath(os.path.join(path, ".."))

print path
# ---------- end py_4 ----------
move_filament_loading_pt = BooleanToggle(True)
continue_fabrication = BooleanToggle(True)
# 3
panel_16 = Panel(py_4)
save_json = Button()
commands = Data(python)
send_5 = PythonScript(
    path=panel_16,
    continue_fabrication=continue_fabrication,
    commands=commands,
    move_filament_loading_pt=move_filament_loading_pt,
    save_json=save_json,
    name_json="commands_group_05.json")  # -> out; inputs continue_fabrication: Int32, commands: list, move_filament_loading_pt: Boolean
# ---------- send_5: Python ----------
import json
import os

from mini_eggshell.ur_online_control.communication.msg_identifiers import *
from mini_eggshell.ur_online_control.utilities.lists import flatten_list
from time import sleep


#number of values per command to be formatted 
len_command = len(commands[0])
gh_commands = flatten_list(commands)


#to print in gh panel
print len_command, "values each command"
print len(gh_commands)/len_command, "commands." , len(gh_commands), "values"


if move_filament_loading_pt:
    print "Moving to filament loading point"
else:
    print "Skipping filament loading point"


data = {}
data['move_filament_loading_pt'] = move_filament_loading_pt
data['len_command'] = len_command
data['gh_commands'] = gh_commands


filename = os.path.join(path, name_json)
if save_json:
    with open(filename, 'w') as f:
        json.dump(data, f)
# ---------- end send_5 ----------

# ----
panel_17 = Panel(send_5)
item_7 = ListItem(List=pln_3, Index=0, Wrap=True)  # -> Item1, Item
pln_4 = Plane([item_7.Item1, item_7.Item])

# ----
# 2
# Visualisation
robot_2 = Data(robot)
pose_joints = Data(pose)
planes_wcs_2 = Plane(pln_4)

# ---- group: Calculate joint positions for path
# Add init joint states
joint_states = Data([-0.1728179112, -1.415058186, 1.813991282, -1.971940356, -1.571654205, -3.308720436])
init_configuration = Slider(2, range=0..7)
py_5 = PythonScript(robot=robot_2, planes_WCS=planes_wcs_2, configuration_idx=init_configuration, init_configuration=joint_states)  # -> configurations; inputs planes_WCS: list, configuration_idx: Int32, init_configuration: list
# ---------- py_5: Python ----------
from compas_ghpython import unload_modules
unload_modules('ur_online_control')
import Rhino.Geometry as rg
from compas.geometry import Frame 
from compas.geometry.xforms import Transformation
#from compas_ghpython import xdraw_frame
from ur_online_control.ur.kinematics import calculate_configurations_for_path, format_joint_positions


# TODO this must be optimized! matrix multiplication!
frames_tool0_RCS = []
for plane_WCS in planes_WCS:
    tcp_WCS = Frame(plane_WCS.Origin, plane_WCS.XAxis, plane_WCS.YAxis)
    tcp_RCS = robot.get_frame_in_RCS(tcp_WCS)
    frames_tool0_RCS.append(robot.get_tool0_frame_from_tcp_frame(tcp_RCS))
    

#configurations = calculate_configurations_for_path(frames_tool0_RCS, robot.params, init_configuration)
configurations = calculate_configurations_for_path(frames_tool0_RCS, robot, init_configuration)
print configurations
configurations = configurations[min([configuration_idx, len(configurations) - 1])]

def format(numbers, k=4):
    #numbers = format_joint_positions(numbers)
    return "[" + ", ".join([("%." + str(k) + "f") % n for n in numbers]) + "]"
# ---------- end py_5 ----------
start = Button()
stop_3 = Button()
step = Button()
counter = CountThroughList(L=py_5, start=start, stop=stop_3, step=step, step_back=back, reset=reset, interval=50)  # -> item; inputs L: list, start: Boolean, stop: Boolean, step_back: Boolean
# ---------- counter: Python ----------
from scriptcontext import sticky as st
from compas_ghpython import update_component


# store data in component
guid = str(ghenv.Component.InstanceGuid)
counter_key = "counter_" + guid
running_key = "running_" + guid

if counter_key not in st:
    st[counter_key] = 0

if running_key not in st:
    st[running_key] = False

if start:
    st[running_key] = True

if stop:
    st[running_key] = False

if step:
    if st[counter_key] < len(L) - 1:
        st[counter_key] += 1

if step_back:
    if st[counter_key] < len(L) - 1:
        st[counter_key] -= 1

if reset:
    st[counter_key] = 0

if len(L):
    item = L[st[counter_key]]

if st[running_key]:
    if st[counter_key] < len(L) - 1:
        st[counter_key] += 1
        update_component(ghenv, interval)
    else:
        st[counter_key] = 0
        st[running_key] = False
# ---------- end counter ----------

# ---- group: Define plane in WCS, calculate joint positions
pt_16 = Point(Point(-283.8412985, -342.877576, 297.4189147))
select_configuration = Slider(1, range=0..7)
xy_3 = XYPlane(Origin=pt_16)
plane_wcs = Plane(xy_3)
inverse = PythonScript(robot=robot_2, plane_WCS=plane_wcs, idx=select_configuration)  # -> configuration; inputs plane_WCS: Plane, idx: Int32
# ---------- inverse: Python ----------
import Rhino.Geometry as rg
from compas.geometry import Frame, Transformation
#from compas_ghpython import xdraw_frame

tcp_WCS = Frame(plane_WCS.Origin, plane_WCS.XAxis, plane_WCS.YAxis)

# transform frame to robot coordinate system
tcp_RCS = robot.get_frame_in_RCS(tcp_WCS)

# get the frame of tool0
tool0_RCS = robot.get_tool0_frame_from_tcp_frame(tcp_RCS)

# calculate solutions to frame
solutions = robot.inverse_kinematics(tool0_RCS)

if not len(solutions):
    q = [0,0,0,0,0,0]
else:
    idx = min(len(solutions) - 1, idx)
    q = solutions[idx]
    
print q

configuration = q
# ---------- end inverse ----------

# ---- group: Calculate joint positions for path / Shows joint positions along path
flip_2 = BooleanToggle(True)
l2t = PythonScript(L=py_5, flip=flip_2)  # -> T; inputs L: list, flip: Boolean
# ---------- l2t: Python ----------
from compas_ghpython import list_to_ghtree
L = [l.joint_values for l in L]

if flip:
    L = zip(*L)
T = list_to_ghtree(L)
# ---------- end l2t ----------
graph_10 = QuickGraph(l2t, SortOrder=0)

# ---- group: Visualise
list_4 = ValueList({"0 forward, from angles": 0, "1 inverse, from one plane": 1, "2 inverse, from multiple planes": 2, "3 forward, from robot": 3}, selected="3 forward, from robot")
filter_2 = StreamFilter(Gate=list_4, Stream0=py_2, Stream1=inverse, Stream2=counter, Stream3=pose_joints)
configuration = Panel(filter_2)
mesh = Mesh(filter)
draw = PythonScript(robot=robot_2, configuration=filter_2, mesh=mesh, brep=filter, show_brep=show_brep)  # -> meshes, tool0_plane, tcp_plane, robot_brep; inputs mesh: list, brep: list
# ---------- draw: Python ----------
from compas_ghpython import unload_modules
unload_modules("ur_online_control")

#from compas_ghpython import xdraw_frame
from compas_ghpython import mesh_draw
from compas_ghpython.geometry.xforms import xform_from_transformation
from compas.geometry import Frame
from compas.geometry.xforms import Transformation
from mini_eggshell.ur_online_control.ur.robot import BaseConfiguration

import Rhino.Geometry as rg
import Rhino

def mesh_update_vertices(mesh, vertices):
    for i in range(len(vertices)):
        mesh.vertex[i].update({'x': vertices[i][0], 'y': vertices[i][1], 'z': vertices[i][2]})

if configuration:
    #print configuration
    #q = BaseConfiguration.from_joints(configuration)
    q = configuration
    print q
    print q.joint_values
    
    print robot.get_forward_transformations(q)
    R0, R1, R2, R3, R4, R5 = robot.get_forward_transformations(q)
    
    tool0_frame2 = robot.tool0_frame.transformed(R5)
    tcp_frame2 = Frame.from_transformation(Transformation.from_frame(tool0_frame2) * robot.transformation_tool0_tcp)
    
    print robot.transformation_tool0_tcp
    print robot.transformation_tcp_tool0
    print robot.transformation_tool0_tcp * robot.transformation_tcp_tool0
    print tcp_frame2
    tcp_frame2 = Frame.from_transformation(Transformation.from_frame(tool0_frame2) * robot.transformation_tcp_tool0)
    print tcp_frame2
    
    tool0_frame, tcp_frame = robot.get_transformed_tool_frames(R5)
    
    tool0_frame = tool0_frame2
    tcp_frame = tcp_frame2
    
    m0, m1, m2, m3, m4, m5 = mesh
    for i in range(6):
        exec("R%drg = xform_from_transformation(R%d)" % (i, i))
        exec("m%d.Transform(R%drg)" % (i, i))
    meshes = [m0, m1, m2, m3, m4, m5]
    print meshes
    mt = robot.tool.get_transformed_model(Transformation.from_frame(tool0_frame))
    
    if mt:
        meshes.extend(map(mesh_draw, mt))
    
    """
    m0, m1, m2, m3, m4, m5, tool0_frame, tcp_frame = robot.get_transformed_model(q)
    mt = robot.get_transformed_tool_model(tcp_frame)
    
    meshes = []
    meshes.append(mesh_draw(m0))
    meshes.append(mesh_draw(m1))
    meshes.append(mesh_draw(m2))
    meshes.append(mesh_draw(m3))
    meshes.append(mesh_draw(m4))
    meshes.append(mesh_draw(m5))
    if mt:
        meshes.append(mesh_draw(mt))
    
    """
    
#    tool0_plane = xdraw_frame(tool0_frame)
#    tcp_plane = xdraw_frame(tcp_frame)
    
    if show_brep:
        
        b0, b1, b2, b3, b4, b5 = brep
        
        b0.Transform(R0rg)
        b1.Transform(R1rg)
        b2.Transform(R2rg)
        b3.Transform(R3rg)
        b4.Transform(R4rg)
        b5.Transform(R5rg)
        
        robot_brep = [b0, b1, b2, b3, b4, b5]
# ---------- end draw ----------
tool0_plane = Plane(draw.tool0_plane)
tcp_plane = Plane(draw.tcp_plane)
robot_brep = Brep(draw.robot_brep)
draw_2 = RepresentPlaneAsLines(plane=tcp_plane, size=100)  # -> G, C
# ---------- draw_2: Python ----------
import Rhino.Geometry as rg
from System.Drawing import Color

if plane:

    G = []
    G.append(rg.Line(plane.Origin, size * plane.XAxis))
    G.append(rg.Line(plane.Origin, size * plane.YAxis))
    G.append(rg.Line(plane.Origin, size * plane.ZAxis))
    
    C = []
    C.append(Color.FromArgb(255, 0, 0))
    C.append(Color.FromArgb(0, 255, 0))
    C.append(Color.FromArgb(0, 0, 255))
# ---------- end draw_2 ----------
preview = CustomPreview(Geometry=draw_2.G, Shader=draw_2.C)
preview_2 = CustomPreview(Geometry=draw.meshes, Shader=ColourSwatch(SwatchColor=RGBA(99, 94, 94, 96)))

# ---- group: Send joint position directly to robot
panel_18 = Panel("move cartesian")
idx = Slider(0, range=0..100)
commands_2 = Data(python)
item_8 = ListItem(List=commands_2, Index=idx, Wrap=True)
list_5 = ValueList({"send all positions": 0, "send only one position": 1}, selected="send only one position")
filter_3 = StreamFilter(Gate=list_5, Stream0=commands_2, Stream1=item_8)
movel_2 = PythonScript(commands=filter_3, velocity=Slider(100, range=0..100))  # -> script; inputs commands: list
# ---------- movel_2: Python ----------
from scriptcontext import sticky as st

script_lines = []
for cmd in commands:
    #q, a=1.4, v=1.05, t=0, r=0)
    x, y, z, ax, ay, az, speed, radius = cmd
    script_lines.append("movel(p%s, v=%f, r=%f)" % (str([x/1000., y/1000., z/1000, ax, ay, az]), speed/1000., radius/1000.))

robot = st["robot"]
tool_angle_axis = list(robot.tool.tcp_frame.point) + robot.tool.tcp_frame.axis_angle_vector
x, y, z, ax, ay, az = tool_angle_axis

script = "def prog():\n"
script += "\ttextmsg(\">> program start\")\n"
script += "\tset_tcp(p%s)\n" % str([x/1000., y/1000., z/1000, ax, ay, az])
script += "".join(["\t%s\n" % line for line in script_lines])
script += "\ttextmsg(\"<< program end\")\n"
script += "end\n"
script += "prog()\n\n"

print script
# ---------- end movel_2 ----------
send_6 = Button()
send_7 = Send(script=movel_2, send=send_6)
panel_19 = Panel(send_7)

# ----
# move incremental in WCS
number_slider_21 = Slider(5, range=-10..10)
list_6 = ValueList({"xaxis", "yaxis", "zaxis"}, selected="zaxis")
movel_3 = PythonScript(step_size=number_slider_21, direction=list_6)  # -> script
# ---------- movel_3: Python ----------
from scriptcontext import sticky as st

robot = st["robot"]
tool_angle_axis = list(robot.tool.tcp_frame.point) + robot.tool.tcp_frame.axis_angle_vector
x, y, z, ax, ay, az = tool_angle_axis

script = "def prog():\n"
script += "\ttextmsg(\">> program start\")\n"
script += "\tset_tcp(p%s)\n" % str([x/1000., y/1000., z/1000, ax, ay, az])
script += "\tcurrent_pose = get_forward_kin()\n"


if direction == "xaxis":
    script += "\tmovel(p[current_pose[0] + %f, current_pose[1], current_pose[2], current_pose[3], current_pose[4], current_pose[5]], t=%f)\n" % (step_size/1000., step_size * 0.1)

elif direction == "yaxis":
    script += "\tmovel(p[current_pose[0], current_pose[1] + %f, current_pose[2], current_pose[3], current_pose[4], current_pose[5]], t=%f)\n" % (step_size/1000., step_size * 0.1)

else: # direction == "zaxis":
    script += "\tmovel(p[current_pose[0], current_pose[1], current_pose[2] + %f, current_pose[3], current_pose[4], current_pose[5]], t=%f)\n" % (step_size/1000., step_size * 0.1)

script += "\ttextmsg(\"<< program end\")\n"
script += "end\n"
script += "prog()\n\n"

print script
# ---------- end movel_3 ----------
send_8 = Button()
send_9 = Send(script=movel_3, send=send_8)
panel_20 = Panel(send_9)

# ----
# move incremental in TCS
get_current_pose = Button()
list_7 = ValueList({"xaxis", "yaxis", "zaxis"}, selected="zaxis")
movel_4 = PythonScript(get=get_current_pose, step_size=Slider(5, range=-10..10), direction=list_7)  # -> script; inputs get: list
# ---------- movel_4: Python ----------
from scriptcontext import sticky as st
from compas.geometry import Frame
from compas.geometry import Point, Vector
from mini_eggshell.ur_online_control.ur_direct import get_current_pose_cartesian

server_address = st["server_address"]
server_port = 30005
ur_ip = st["ur_ip"]
robot = st["robot"]
tool_angle_axis = list(robot.tool.tcp_frame.point) + robot.tool.tcp_frame.axis_angle_vector
print tool_angle_axis

guid = str(ghenv.Component.InstanceGuid)
pose_cartesian_key = "pose_cartesian" + guid

if get:
    st[pose_cartesian_key] = get_current_pose_cartesian(server_address, server_port, ur_ip, tool_angle_axis)

if pose_cartesian_key not in st:
    pose_cartesian = []
    script = ""
else:
    pose_cartesian = st[pose_cartesian_key]

    robot = st["robot"]
    tool_angle_axis = list(robot.tool.tcp_frame.point) + robot.tool.tcp_frame.axis_angle_vector
    x, y, z, ax, ay, az = tool_angle_axis
    
    script = "def prog():\n"
    script += "\ttextmsg(\">> program start\")\n"
    script += "\tset_tcp(p%s)\n" % str([x/1000., y/1000., z/1000, ax, ay, az])
    script += "\tcurrent_pose = get_forward_kin()\n"
    
#    frame = Frame.from_pose_axis_angle_vector(pose_cartesian)
    frame = Frame.from_axis_angle_vector([ax, ay, az])
    frame.point = [x, y, z]

    if direction == "xaxis":
        next_vector = Vector(*frame.xaxis) * step_size
    elif direction == "yaxis":
        next_vector = Vector(*frame.yaxis) * step_size
    else: # direction == "zaxis":
        next_vector = Vector(*frame.zaxis) * step_size
    
    x, y, z = next_vector
    script += "\tmovel(p[current_pose[0] + %f, current_pose[1] + %f, current_pose[2] + %f, current_pose[3], current_pose[4], current_pose[5]], t=%f)\n" % (x/1000., y/1000., z/1000., step_size * 0.1)
    
    script += "\ttextmsg(\"<< program end\")\n"
    script += "end\n"
    script += "prog()\n\n"
    
    print script
# ---------- end movel_4 ----------
send_10 = Button()
send_11 = Send(script=movel_4, send=send_10)
panel_21 = Panel(send_11)

# ---- group: Send joint position directly to robot
idx_2 = Slider(0, range=0..100)
panel_22 = Panel("move joints")
joint_positions = Data(py_5)
list_8 = ValueList({"send all positions": 0, "send only one position": 1}, selected="send only one position")
item_9 = ListItem(List=joint_positions, Index=idx_2, Wrap=True)
filter_4 = StreamFilter(Gate=list_8, Stream0=joint_positions, Stream1=item_9)
movej = PythonScript(joint_positions=filter_4, velocity=Slider(153, range=0..200))  # -> script; inputs joint_positions: list
# ---------- movej: Python ----------
script_lines = []

for position in joint_positions:
    script_lines.append("movej(%s, v=%f)" % (str(position), velocity/1000.))


script = "def prog():\n"
script += "\ttextmsg(\">> program start\")\n"
script += "".join(["\t%s\n" % line for line in script_lines])
script += "\ttextmsg(\"<< program end\")\n"
script += "end\n"
script += "prog()\n\n"


print script

#script = ""
# ---------- end movej ----------
send_12 = Button()

# ----
send_13 = Send(script=movej, send=send_12)

# ---- group: Send joint position directly to robot (continued)
panel_23 = Panel(send_13)

# ==== cluster Tools

# ---- group: clay_extruder
brep = Brep([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])
yaxis_line = Curve(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)
xaxis_line = Curve(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)
test_geometry = Geometry(brep)
brep_2 = Brep(test_geometry)
mesh = Mesh(test_geometry)
tool = Tool(meshes=mesh, breps=brep_2, xline=xaxis_line, yline=yaxis_line)

# ---- group: plastic_extruder
brep_3 = Brep([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])
xaxis_line_2 = Curve(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)
yaxis_line_2 = Curve(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)
test_geometry_2 = Geometry(brep_3)
mesh_2 = Mesh(test_geometry_2)
brep_4 = Brep(test_geometry_2)
tool_2 = Tool(meshes=mesh_2, breps=brep_4, xline=xaxis_line_2, yline=yaxis_line_2)

# ---- group: clay_extruder_SS
brep_5 = Brep([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])
yaxis_line_3 = Curve(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)
xaxis_line_3 = Curve(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)
test_geometry_3 = Geometry(brep_5)
brep_6 = Brep(test_geometry_3)
mesh_3 = Mesh(test_geometry_3)
tool_3 = Tool(meshes=mesh_3, breps=brep_6, xline=xaxis_line_3, yline=yaxis_line_3)

# ----
tool_id = ClusterInput()
tool_id_2 = Integer(tool_id)
filter = StreamFilter(Gate=tool_id_2, Stream1=tool_2, Stream2=tool, Stream3=tool_3)
py = PythonScript(tool=filter)  # -> tcp_frame, model
# ---------- py: Python ----------
from compas_ghpython import mesh_draw 

tcp_frame = tool.tcp_frame
model = map(mesh_draw, tool.model)
# ---------- end py ----------
tool_4 = Data(filter)
draw = PythonScript(frame=py.tcp_frame)  # -> G, C
# ---------- draw: Python ----------
import Rhino.Geometry as rg
from System.Drawing import Color

if not size:
    size = 100

if frame:
    plane = rg.Plane(rg.Point3d(*list(frame.point)), rg.Vector3d(*list(frame.xaxis)), rg.Vector3d(*list(frame.yaxis)))

    G = []
    G.append(rg.Line(plane.Origin, size * plane.XAxis))
    G.append(rg.Line(plane.Origin, size * plane.YAxis))
    G.append(rg.Line(plane.Origin, size * plane.ZAxis))
    
    C = []
    C.append(Color.FromArgb(255, 0, 0))
    C.append(Color.FromArgb(0, 255, 0))
    C.append(Color.FromArgb(0, 0, 255))
# ---------- end draw ----------
tool_5 = ClusterOutput(tool_4)
preview = CustomPreview(Geometry=draw.G, Shader=draw.C)
preview_2 = CustomPreview(Geometry=py.model, Shader=ColourSwatch(SwatchColor=RGB(141, 170, 178)))

# ==== cluster Send
script = ClusterInput()
send = ClusterInput()
send_2 = PythonScript(script=script, send=send)  # -> out
# ---------- send_2: Python ----------
import socket
from scriptcontext import sticky as st

ur_ip = st["ur_ip"]
ur_port = 30002

if send:
    s = socket.create_connection((ur_ip, ur_port), timeout=0.5) 
    s.send(script)
    s.close()
# ---------- end send_2 ----------
out = ClusterOutput(send_2)

# ==== cluster Tool
breps = ClusterInput()
meshes = ClusterInput()
meshes_2 = Mesh(meshes)
mjoin = MeshJoin(Meshes=meshes_2)
xline = ClusterInput()
yline = ClusterInput()
tool = PythonScript(meshes=mjoin, breps=breps, xline=xline, yline=yline)  # -> tool; inputs meshes: list of Mesh, breps: list of Brep
# ---------- tool: Python ----------
import Rhino.Geometry as rg
from compas.geometry import Frame
from ur_online_control.ur.tool import Tool
from compas.datastructures import Mesh
from compas_rhino.helpers import mesh_from_guid

xaxis = rg.Line(xline.PointAtStart, xline.PointAtEnd)
yaxis = rg.Line(yline.PointAtStart, yline.PointAtEnd)

if xaxis.From.DistanceTo(yaxis.From) < 0.01:
    origin = xaxis.From
    xaxis = xaxis.Direction
    yaxis = yaxis.Direction
elif xaxis.To.DistanceTo(yaxis.To) < 0.01:
    origin = xaxis.To
    xaxis = -xaxis.Direction
    yaxis = -yaxis.Direction
elif xaxis.From.DistanceTo(yaxis.To) < 0.01:
    origin = xaxis.From
    xaxis = xaxis.Direction
    yaxis = -yaxis.Direction
elif xaxis.To.DistanceTo(yaxis.From) < 0.01:
    origin = xaxis.To
    xaxis = -xaxis.Direction
    yaxis = yaxis.Direction

xaxis.Unitize()
yaxis.Unitize()

print origin
print xaxis
print yaxis

tcp_frame = Frame(origin, xaxis, yaxis)

tool = Tool(tcp_frame)
tool.model = [mesh_from_guid(Mesh, mesh) for mesh in meshes]
#tool.model_xyz = tool.model.xyz
tool.breps = breps
# ---------- end tool ----------
tool_2 = ClusterOutput(tool)
