# Grasshopper definition 191119_ur_online_control_gh_group_05CT.gh (Grasshopper 1.0.7)
# plug-ins: treesloth01, Pufferfish

# ---- group: Robot
# 0a
# Settings
# Check your IP address and set UR IP address
server_address = ValueList({"192.168.10.2", "192.168.10.11", "127.0.0.1"}, selected="192.168.10.11")
ur_ip = ValueList({"192.168.10.13", "192.168.10.11", "192.168.10.10", "127.0.0.1"}, selected="192.168.10.10")
server_port = Integer(30003)
globals = PythonScript(server_address=server_address, server_port=server_port, ur_ip=ur_ip)  # inputs server_port: Int32
# ---------- globals: Python ----------
from scriptcontext import sticky as st

st["server_address"] = server_address
st["server_port"] = server_port

st["ur_ip"] = ur_ip
# ---------- end globals ----------

# Check if UR is available
ping = Button()
py = PythonScript(ip=ur_ip, ping=ping)  # -> out
# ---------- py: Python ----------
from scriptcontext import sticky as st
from mini_eggshell.ur_online_control.ur_direct.utilities import is_available


guid = str(ghenv.Component.InstanceGuid)
txt_key = "txt_" + guid
if txt_key not in st:
    st[txt_key] = ""

if ping:
    
    available = is_available(ip)
    
    if available:
        st[txt_key] = "%s is up!" % ip
    else:
        st[txt_key] = "%s is down!" % ip

print st[txt_key]
# ---------- end py ----------
panel = Panel(py)

# ---- group: length
number_slider = Slider(800, range=0..1000)

number_slider_2 = Slider(800, range=0..1000)

# ---- group: Robot
# 1. load robot model
# 2. set tool
# 3. set basis
bang = Button()
panel_2 = Panel("Unload libraries")
unload = PythonScript(bang=bang)
# ---------- unload: Python ----------
from compas_ghpython import unload_modules

unload_modules("compas")
unload_modules("ur_online_control")
# ---------- end unload ----------

# 1. load robot model
# 2. set tool
# 3. set basis
list = ValueList({"no_tool": 0, "plastic_extruder": 1, "clay_extruder": 2, "clay_extruder_SS": 3}, selected="clay_extruder")
tools = Tools(tool_id=list)
base = PythonScript()  # -> base_frame, base
# ---------- base: Python ----------
from compas.geometry import Frame

"""
origin = [0, 0, 0]
xaxis = [1, 0, 0]
yaxis = [0, 1, 0]


origin = [-313.92, -147.58, 13.79]
xaxis = [0.00000, -1.00000, 0.00000]
yaxis = [1.00000, 0.00000, 0.00000]
"""

#axis    Y         Z                        X

#origin = [284.18, 20.87, 38.02]
#xaxis = [0.00000, 1.00000, 0.00000]
#yaxis = [-1.00000, 0.00000, 0.00000]


#origin = [211.27, 507.88, -79.82]
#xaxis = [-0.05035, -0.99873, 0.00000]
#yaxis = [0.99873, -0.05035, 0.00000]

origin = [-687.17, -107.73, -294.36]
xaxis = [1.00000, 0.00000, 0.00000]
yaxis = [0.00000, 1.00000, 0.00000]




base_frame = Frame(list(origin), list(xaxis), list(yaxis))

base = "base = " + str(origin) + "\n"
# ---------- end base ----------
list_2 = ValueList({"UR5", "UR10"}, selected="UR5")
robot = PythonScript(model=list_2, tool=tools, base_frame=base.base_frame)  # -> robot
# ---------- robot: Python ----------
from mini_eggshell.ur_online_control.ur.ur10 import UR10
from mini_eggshell.ur_online_control.ur.ur5 import UR5
from scriptcontext import sticky as st

if model == "UR5":
    robot = UR5()
elif model == "UR10":
    robot = UR10()

if tool:
    robot.set_tool(tool)
if base_frame:
    robot.set_base(base_frame)

st["robot"] = robot
# ---------- end robot ----------

# ----
number_slider_3 = Slider(25, range=0..100)
panel_3 = Panel(base.base)
range = Range(Domain=Domain(0, 1), Steps=Slider(3, range=0..10))
number_slider_4 = Slider(90, range=0..100)
number_slider_5 = Slider(0, range=0..1000)
neg = Negative(Value=number_slider_3)

# ---- group: filament_loading_pt
pt = Point(<point referenced from the Rhino model>)
xy = XYPlane(Origin=pt)
rotate = Rotate(Geometry=xy, Angle=degrees(number_slider_4), Plane=xy)  # -> Geometry, Transform

# ----
# Split Path in Parts
number_slider_6 = Slider(8873, range=0..10000)
partition = PartitionList(Size=number_slider_6)
branch = TreeBranch(Tree=simplify(partition), Path=Slider(0, range=0..1), MaintainPaths=True)

# ---- group: input_geometry
geo = Geometry(<mesh referenced from the Rhino model>)  # disabled

# ----
# Slicing existing geometry
layer_height_mm = Slider(10, range=0..10)
distance_between_points_mm = Slider(25, range=3..50)
slice = BooleanToggle(True)
slicer = GhPythonScript(slice=slice, input_geometry=geo, layer_height=layer_height_mm, distance_between_points=distance_between_points_mm)  # -> out, crvs, pts
# ---------- slicer: Python ----------
__author__ = "joburger"
__version__ = "2019.10.28"

import Rhino
import Rhino.Geometry as rg

import mini_eggshell.slicer.simple_slicer
reload(mini_eggshell.slicer.simple_slicer)

slicer = mini_eggshell.slicer.simple_slicer.Slicer(layer_height, distance_between_points)

if slice:
    if str(input_geometry.ObjectType) == "Mesh":
        print "Input geometry is of Mesh type"  
        crvs = slicer.create_contour_curves_from_mesh(input_geometry)
    elif str(input_geometry.ObjectType) == "Brep":
        print "Input geometry is of Brep type"
        crvs = slicer.create_contour_curves_from_brep(input_geometry)
    else:
        print "Input geometry not supported"
    
    pts = slicer.divide_curves_in_points()
# ---------- end slicer ----------

# ---- group: output_curves
crv = Curve(slicer.crvs)

# ---- group: output_points
pt_2 = Point(slicer.pts)

# ----
distance_between_points_mm_2 = Slider(10, range=5..50)
layer_height_mm_2 = Slider(2.5, range=0..10)
item = ListItem(List=pt_2, Index=Slider(0, range=0..10), Wrap=True)

# ---- group: Printing time
printing_speed_mm_s = Slider(10, range=0..100)
pline = PolyLine(Vertices=pt_2, Closed=False)
len = Length(Curve=pline)
division = Division(A=len, B=printing_speed_mm_s)
division_2 = Division(A=division, B=60)
total_print_time_minutes = Panel(division_2)

# ---- group: Printing path visualization
dom = ConstructDomain(DomainStart=Slider(0, range=0..1000), DomainEnd=Slider(6601, range=0..6601))
subset = SubList(List=pt_2, Domain=dom, Wrap=True)  # -> List, Index
pline_2 = PolyLine(Vertices=subset.List, Closed=False)

# ----
slice_2 = BooleanToggle(True)

# ---- group: Position Pt
pt_3 = Point(<point referenced from the Rhino model>)

# ----
number_slider_7 = Slider(300, range=0..500)
division_3 = Division(A=number_slider_7, B=Slider(2, range=0..10))

# ----
# Direct UR control
get = Button()
get_2 = Button()
pose = PythonScript(get=get_2)  # -> pose_joints
# ---------- pose: Python ----------
from scriptcontext import sticky as st
from mini_eggshell.ur_online_control.ur_direct import get_current_pose_joints
from mini_eggshell.ur_online_control.ur.robot import BaseConfiguration

server_address = st["server_address"]
server_port = 30005
ur_ip = st["ur_ip"]
robot = st["robot"]
tool_angle_axis = list(robot.tool.tcp_frame.point) + list(robot.tool.tcp_frame.axis_angle_vector)
print tool_angle_axis

guid = str(ghenv.Component.InstanceGuid)
pose_joints_key = "pose_joints" + guid

if get:
    st[pose_joints_key] = get_current_pose_joints(server_address, server_port, ur_ip, tool_angle_axis)
    
if pose_joints_key not in st:
    pose_joints = []
else:
    pose_joints = BaseConfiguration.from_joints(st[pose_joints_key])
# ---------- end pose ----------
pose_2 = PythonScript(get=get)  # -> pose_cartesian
# ---------- pose_2: Python ----------
from scriptcontext import sticky as st
from mini_eggshell.ur_online_control.ur_direct import get_current_pose_cartesian

server_address = st["server_address"]
server_port = 30005
ur_ip = st["ur_ip"]
robot = st["robot"]

tool_angle_axis = list(robot.tool.tcp_frame.point) + robot.tool.tcp_frame.axis_angle_vector
print tool_angle_axis

guid = str(ghenv.Component.InstanceGuid)
pose_cartesian_key = "pose_cartesian" + guid


if get:
    st[pose_cartesian_key] = get_current_pose_cartesian(server_address, server_port, ur_ip, tool_angle_axis)

if pose_cartesian_key not in st:
    pose_cartesian = []
else:
    pose_cartesian = st[pose_cartesian_key]
# ---------- end pose_2 ----------
stop = Button()
stop_2 = PythonScript(stop=stop)
# ---------- stop_2: Python ----------
from scriptcontext import sticky as st
from mini_eggshell.ur_online_control.ur_direct import stop as stop_robot

ur_ip = st["ur_ip"]

if stop:
    stop_robot(ur_ip)
# ---------- end stop_2 ----------
panel_4 = Panel(pose)
panel_5 = Panel(pose_2)

# ----
# 0b
vertical_pose = Number([-152.427, -780.635, 855.229, -1.1958, -1.22046, -1.20201])
multiplication = Multiplication(A=Slider(300, range=0..5000), B=Slider(10, range=0..10))
pt_4 = Point([<point referenced from the Rhino model> x3])
pt_5 = Point([<point referenced from the Rhino model> x3])
back = Button()
reset = Button()

# ---- group: Define joint positions
base_2 = Slider(90.163, range=-360..360)
elbow = Slider(-102.857, range=-360..360)
wrist2 = Slider(0, range=-360..360)
wrist3 = Slider(0, range=-360..360)
shoulder = Slider(0, range=-360..360)
wrist1 = Slider(0, range=-360..360)
ur1_q1_q6 = Data([base_2, shoulder, elbow, wrist1, wrist2, wrist3])

# ----
# Measure basis:
# 1. Clear the recorded poses
# 2. Move robot to origin and press "get pose"
# 3. Move robot to point in positive x-axis and press "get pose"
# 4. Move robot to an other point in your basis and press "get pose"
# (The farer away these positions are, the better)
# 
# 5. Alternatively change the order in the component calc base
# 6. Copy output into base component
# Calculate basis
list_3 = ValueList({"origin, pt on positive x-axis, pt in xy plane": 0, "origin, pt on positive y-axis, pt in xy plane": 1}, selected="origin, pt on positive x-axis, pt in xy plane")
clear = Button()
rec = PythonScript(msg=pose_2, rec=get, clear=clear)  # -> rec; inputs msg: list
# ---------- rec: Python ----------
from scriptcontext import sticky as st

guid = str(ghenv.Component.InstanceGuid)
recorded_key =  "recorded_" + guid
just_cleared_key = "just_cleared_" + guid

if recorded_key not in st:
    st[recorded_key] = []

if just_cleared_key not in st:
    st[just_cleared_key] = False

if clear:
    st[recorded_key] = []
    st[just_cleared_key] = True
else:
    if len(msg):
        if msg != [None] and not st[just_cleared_key] and rec:
            st[recorded_key].append(msg)
    st[just_cleared_key] = False
        


rec = st[recorded_key]

print rec
# ---------- end rec ----------
calc_base = PythonScript(poses=rec, input_type=list_3)  # -> out; inputs poses: list
# ---------- calc_base: Python ----------
import Rhino.Geometry as rg
import math


if len(poses) > 2:
    
    O = poses[0]
    P1 = poses[1]
    P2 = poses[2]
    
    if input_type == 0:
        # origin, pt on positive x-axis, pt in xy plane
        origin = rg.Point3d(O[0], O[1], O[2])
        pt_on_xaxis = rg.Point3d(P1[0], P1[1], P1[2])
        pt_in_xyplane = rg.Point3d(P2[0], P2[1], P2[2])
        
        xaxis = pt_on_xaxis - origin
        xaxis.Unitize()
        
        v = pt_in_xyplane - origin
        zaxis = rg.Vector3d.CrossProduct(v, xaxis)
        zaxis.Unitize()
        
        # zaxis must look up!
        if math.acos(rg.Vector3d.ZAxis * zaxis) > math.acos(rg.Vector3d.ZAxis * -zaxis):
            zaxis = -zaxis
        
        yaxis = rg.Vector3d.CrossProduct(zaxis, xaxis)
    
    elif input_type == 1:
        # origin, pt on positive y-axis, pt in xy plane
        origin = rg.Point3d(O[0], O[1], O[2])
        pt_on_yaxis = rg.Point3d(P1[0], P1[1], P1[2])
        pt_in_xyplane = rg.Point3d(P2[0], P2[1], P2[2])
        
        yaxis = pt_on_yaxis - origin
        yaxis.Unitize()
        
        v = pt_in_xyplane - origin
        zaxis = rg.Vector3d.CrossProduct(v, yaxis)
        zaxis.Unitize()
        
        # zaxis must look up!
        if math.acos(rg.Vector3d.ZAxis * zaxis) > math.acos(rg.Vector3d.ZAxis * -zaxis):
            zaxis = -zaxis
        
        xaxis = rg.Vector3d.CrossProduct(yaxis, zaxis)
        
        
    print "Copy the following into base component:"
    print " "
    print "origin = [%.2f, %.2f, %.2f]" % tuple(list(origin))
    print "xaxis = [%.5f, %.5f, %.5f]" % tuple(list(xaxis))
    print "yaxis = [%.5f, %.5f, %.5f]" % tuple(list(yaxis))
    

#print rg.Vector3d.CrossProduct(rg.Vector3d.YAxis, rg.Vector3d.ZAxis)
#print rg.Vector3d.CrossProduct(rg.Vector3d.ZAxis, rg.Vector3d.XAxis)
# ---------- end calc_base ----------
panel_6 = Panel(rec)
panel_7 = Panel(calc_base)

dom_2 = ConstructDomain(DomainStart=Slider(0, range=0..100), DomainEnd=Slider(10, range=0..100))
py_2 = GhPythonScript(joint_values=ur1_q1_q6)  # -> configuration; inputs joint_values: list
# ---------- py_2: Python ----------
import math
from ur_online_control.ur.robot import BaseConfiguration

configuration = BaseConfiguration.from_joints([math.radians(d) for d in joint_values])
# ---------- end py_2 ----------

# ---- group: Visualise / robot model brep
py_3 = PythonScript(model=list_2)  # -> n
# ---------- py_3: Python ----------
if model == "UR5":
    n = 0
if model == "UR10":
    n = 1

print n
# ---------- end py_3 ----------
ur10_brep = UR10Brep([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])
ur5_brep = UR5Brep([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])
show_brep = BooleanToggle(False)
filter = StreamFilter(Gate=py_3, Stream0=ur5_brep, Stream1=ur10_brep)

# ----
panel_8 = Panel("set digital out")
value = BooleanToggle(False)
number = Slider(0, range=0..10)
digital_out = PythonScript(number=number, value=value)  # -> script; inputs number: Int32, value: Boolean
# ---------- digital_out: Python ----------
script = "def prog():\n"
script += "\ttextmsg(\">> program start\")\n"
script += "\tset_digital_out(%i, %s)\n" % (int(number), str(value))
script += "\ttextmsg(\"<< program end\")\n"
script += "end\n"
script += "prog()\n\n"

print script
# ---------- end digital_out ----------
send = Button()
send_2 = Send(script=digital_out, send=send)
panel_9 = Panel(send_2)

panel_10 = Panel("move vertical")
movel = PythonScript()  # -> script
# ---------- movel: Python ----------
from scriptcontext import sticky as st

robot = st["robot"]

tool_angle_axis = list(robot.tool.tcp_frame.point) + robot.tool.tcp_frame.axis_angle_vector
x, y, z, ax, ay, az = tool_angle_axis

script = "def prog():\n"
script += "\ttextmsg(\">> program start\")\n"
script += "\tset_tcp(p%s)\n" % str([x/1000., y/1000., z/1000, ax, ay, az])
script += "\tcurrent_pose = get_forward_kin()\n"
script += "\tmovel(p[current_pose[0], current_pose[1], current_pose[2], 0, 0, 0], a=0.1, v=0.1)\n"
script += "\ttextmsg(\"<< program end\")\n"
script += "end\n"
script += "prog()\n\n"

print script
# ---------- end movel ----------
send_3 = Button()
send_4 = Send(script=movel, send=send_3)
panel_11 = Panel(send_4)

# ----
# move incremental in WCS
number_slider_8 = Slider(5, range=-10..10)
list_4 = ValueList({"xaxis", "yaxis", "zaxis"}, selected="zaxis")
movel_2 = PythonScript(step_size=number_slider_8, direction=list_4)  # -> script
# ---------- movel_2: Python ----------
from scriptcontext import sticky as st

robot = st["robot"]
tool_angle_axis = list(robot.tool.tcp_frame.point) + robot.tool.tcp_frame.axis_angle_vector
x, y, z, ax, ay, az = tool_angle_axis

script = "def prog():\n"
script += "\ttextmsg(\">> program start\")\n"
script += "\tset_tcp(p%s)\n" % str([x/1000., y/1000., z/1000, ax, ay, az])
script += "\tcurrent_pose = get_forward_kin()\n"


if direction == "xaxis":
    script += "\tmovel(p[current_pose[0] + %f, current_pose[1], current_pose[2], current_pose[3], current_pose[4], current_pose[5]], t=%f)\n" % (step_size/1000., step_size * 0.1)

elif direction == "yaxis":
    script += "\tmovel(p[current_pose[0], current_pose[1] + %f, current_pose[2], current_pose[3], current_pose[4], current_pose[5]], t=%f)\n" % (step_size/1000., step_size * 0.1)

else: # direction == "zaxis":
    script += "\tmovel(p[current_pose[0], current_pose[1], current_pose[2] + %f, current_pose[3], current_pose[4], current_pose[5]], t=%f)\n" % (step_size/1000., step_size * 0.1)

script += "\ttextmsg(\"<< program end\")\n"
script += "end\n"
script += "prog()\n\n"

print script
# ---------- end movel_2 ----------
send_5 = Button()
send_6 = Send(script=movel_2, send=send_5)
panel_12 = Panel(send_6)

# ----
# move incremental in TCS
get_current_pose = Button()
list_5 = ValueList({"xaxis", "yaxis", "zaxis"}, selected="zaxis")
movel_3 = PythonScript(get=get_current_pose, step_size=Slider(5, range=-10..10), direction=list_5)  # -> script; inputs get: list
# ---------- movel_3: Python ----------
from scriptcontext import sticky as st
from compas.geometry import Frame
from compas.geometry import Point, Vector
from mini_eggshell.ur_online_control.ur_direct import get_current_pose_cartesian

server_address = st["server_address"]
server_port = 30005
ur_ip = st["ur_ip"]
robot = st["robot"]
tool_angle_axis = list(robot.tool.tcp_frame.point) + robot.tool.tcp_frame.axis_angle_vector
print tool_angle_axis

guid = str(ghenv.Component.InstanceGuid)
pose_cartesian_key = "pose_cartesian" + guid

if get:
    st[pose_cartesian_key] = get_current_pose_cartesian(server_address, server_port, ur_ip, tool_angle_axis)

if pose_cartesian_key not in st:
    pose_cartesian = []
    script = ""
else:
    pose_cartesian = st[pose_cartesian_key]

    robot = st["robot"]
    tool_angle_axis = list(robot.tool.tcp_frame.point) + robot.tool.tcp_frame.axis_angle_vector
    x, y, z, ax, ay, az = tool_angle_axis
    
    script = "def prog():\n"
    script += "\ttextmsg(\">> program start\")\n"
    script += "\tset_tcp(p%s)\n" % str([x/1000., y/1000., z/1000, ax, ay, az])
    script += "\tcurrent_pose = get_forward_kin()\n"
    
#    frame = Frame.from_pose_axis_angle_vector(pose_cartesian)
    frame = Frame.from_axis_angle_vector([ax, ay, az])
    frame.point = [x, y, z]

    if direction == "xaxis":
        next_vector = Vector(*frame.xaxis) * step_size
    elif direction == "yaxis":
        next_vector = Vector(*frame.yaxis) * step_size
    else: # direction == "zaxis":
        next_vector = Vector(*frame.zaxis) * step_size
    
    x, y, z = next_vector
    script += "\tmovel(p[current_pose[0] + %f, current_pose[1] + %f, current_pose[2] + %f, current_pose[3], current_pose[4], current_pose[5]], t=%f)\n" % (x/1000., y/1000., z/1000., step_size * 0.1)
    
    script += "\ttextmsg(\"<< program end\")\n"
    script += "end\n"
    script += "prog()\n\n"
    
    print script
# ---------- end movel_3 ----------
send_7 = Button()
send_8 = Send(script=movel_3, send=send_7)
panel_13 = Panel(send_8)

# ----
# Base Curve
panel_14 = Panel("-125")
pt_6 = ConstructPoint(XCoordinate=-100, YCoordinate=600, ZCoordinate=panel_14)
pt_7 = ConstructPoint(XCoordinate=300, YCoordinate=300, ZCoordinate=panel_14)
pt_8 = ConstructPoint(XCoordinate=50, YCoordinate=0, ZCoordinate=panel_14)
number_slider_9 = Slider(25, range=0..25)
multiplication_2 = Multiplication(A=number_slider_9, B=-1)
number_slider_10 = Slider(9, range=0..25)

pt_9 = ConstructPoint(XCoordinate=0, YCoordinate=750, ZCoordinate=panel_14)

nurbs = NurbsCurve(Vertices=[pt_9, pt_6, pt_7, pt_8], Degree=Slider(2, range=0..10), Periodic=False)  # -> Curve, Length, Domain
offset = OffsetCurve(Curve=nurbs.Curve, Distance=number_slider_9, Plane=PlaneXY(0, 0, 0), Corners=0)
offset_2 = OffsetCurve(Curve=nurbs.Curve, Distance=multiplication_2, Plane=PlaneXY(0, 0, 0), Corners=0)
divide = DivideCurve(Curve=offset, Count=number_slider_10, Kinks=False)  # -> Points, Tangents, Parameters
divide_2 = DivideCurve(Curve=offset_2, Count=number_slider_10, Kinks=False)  # -> Points, Tangents, Parameters
end = EndPoints(Curve=nurbs.Curve)  # -> Start, End
circlett = CircleTanTan(CurveA=offset, CurveB=offset_2, Point=end.Start)
circlett_2 = CircleTanTan(CurveA=offset, CurveB=offset_2, Point=end.End)
ccx = CurveCurve(CurveA=circlett, CurveB=offset)  # -> Points, ParamsA, ParamsB
ccx_2 = CurveCurve(CurveA=circlett, CurveB=offset_2)  # -> Points, ParamsA, ParamsB
ccx_3 = CurveCurve(CurveA=circlett_2, CurveB=offset)  # -> Points, ParamsA, ParamsB
ccx_4 = CurveCurve(CurveA=circlett_2, CurveB=offset_2)  # -> Points, ParamsA, ParamsB
ptstrimcrv = PointsTrimCurve(Curve=circlett, Points=[ccx_2.Points, ccx.Points], Flip=True)  # -> Trimmed, SubDomains, Intersected
ptstrimcrv_2 = PointsTrimCurve(Curve=circlett_2, Points=[ccx_3.Points, ccx_4.Points], Flip=False)  # -> Trimmed, SubDomains, Intersected
merge = Merge(Data1=offset, Data2=ptstrimcrv.Trimmed, Data3=offset_2, Data4=ptstrimcrv_2.Trimmed)
flatten = FlattenTree(Tree=merge, Path="{0}")
boundary = BoundarySurfaces(Edges=flatten)
edges = BrepEdges(Brep=boundary)  # -> Naked, Interior, NonManifold
flatten_2 = FlattenTree(Tree=edges.Naked, Path="{0}")
join = JoinCurves(Curves=flatten_2, Preserve=True)
reb = RebuildCurve(Curve=join, Count=Slider(50, range=0..100), Tangents=False)
cp = ControlPoints(Curve=reb)  # -> Points, Weights, Knots
dispatch = Dispatch(List=cp.Points, DispatchPattern=[True, False])  # -> ListA, ListB
pt_10 = Point(dispatch.ListA)
pt_11 = Point(dispatch.ListB)
moveaway = MoveAwayFrom(Geometry=pt_10, Emitter=nurbs.Curve, Distance=Slider(17, range=0..100))  # -> Geometry, Transform
cull_i = CullIndex(List=pt_11, Indices=Slider(101, range=0..110), Wrap=True)
weave = Weave(Pattern=[0, 1], Stream0=moveaway.Geometry, Stream1=cull_i, NullGaps=False)
nurbs_2 = NurbsCurve(Vertices=weave, Degree=3, Periodic=False)  # -> Curve, Length, Domain

# ----
# Top Curve
panel_15 = Panel("275")
pt_12 = ConstructPoint(XCoordinate=-50, YCoordinate=600, ZCoordinate=panel_15)
pt_13 = ConstructPoint(XCoordinate=200, YCoordinate=300, ZCoordinate=panel_15)
pt_14 = ConstructPoint(XCoordinate=75, YCoordinate=10, ZCoordinate=panel_15)
number_slider_11 = Slider(25, range=0..25)
multiplication_3 = Multiplication(A=number_slider_11, B=-1)
number_slider_12 = Slider(9, range=0..25)

pt_15 = ConstructPoint(XCoordinate=0, YCoordinate=720, ZCoordinate=panel_15)

nurbs_3 = NurbsCurve(Vertices=[pt_15, pt_12, pt_13, pt_14], Degree=Slider(2, range=0..10), Periodic=False)  # -> Curve, Length, Domain
offset_3 = OffsetCurve(Curve=nurbs_3.Curve, Distance=number_slider_11, Plane=PlaneXY(0, 0, 0), Corners=0)
offset_4 = OffsetCurve(Curve=nurbs_3.Curve, Distance=multiplication_3, Plane=PlaneXY(0, 0, 0), Corners=0)
divide_3 = DivideCurve(Curve=offset_3, Count=number_slider_12, Kinks=False)  # -> Points, Tangents, Parameters
divide_4 = DivideCurve(Curve=offset_4, Count=number_slider_12, Kinks=False)  # -> Points, Tangents, Parameters
end_2 = EndPoints(Curve=nurbs_3.Curve)  # -> Start, End
circlett_3 = CircleTanTan(CurveA=offset_3, CurveB=offset_4, Point=end_2.Start)
circlett_4 = CircleTanTan(CurveA=offset_3, CurveB=offset_4, Point=end_2.End)
ccx_5 = CurveCurve(CurveA=circlett_3, CurveB=offset_3)  # -> Points, ParamsA, ParamsB
ccx_6 = CurveCurve(CurveA=circlett_3, CurveB=offset_4)  # -> Points, ParamsA, ParamsB
ccx_7 = CurveCurve(CurveA=circlett_4, CurveB=offset_3)  # -> Points, ParamsA, ParamsB
ccx_8 = CurveCurve(CurveA=circlett_4, CurveB=offset_4)  # -> Points, ParamsA, ParamsB
ptstrimcrv_3 = PointsTrimCurve(Curve=circlett_3, Points=[ccx_6.Points, ccx_5.Points], Flip=True)  # -> Trimmed, SubDomains, Intersected
ptstrimcrv_4 = PointsTrimCurve(Curve=circlett_4, Points=[ccx_7.Points, ccx_8.Points], Flip=False)  # -> Trimmed, SubDomains, Intersected
merge_2 = Merge(Data1=offset_3, Data2=ptstrimcrv_3.Trimmed, Data3=offset_4, Data4=ptstrimcrv_4.Trimmed)
flatten_3 = FlattenTree(Tree=merge_2, Path="{0}")
join_2 = JoinCurves(Curves=flatten_3, Preserve=False)
reb_2 = RebuildCurve(Curve=join_2, Count=Slider(50, range=0..100), Tangents=False)
cp_2 = ControlPoints(Curve=reb_2)  # -> Points, Weights, Knots
dispatch_2 = Dispatch(List=cp_2.Points, DispatchPattern=[True, False])  # -> ListA, ListB
pt_16 = Point(dispatch_2.ListA)
pt_17 = Point(dispatch_2.ListB)
moveaway_2 = MoveAwayFrom(Geometry=pt_16, Emitter=nurbs_3.Curve, Distance=Slider(17, range=0..100))  # -> Geometry, Transform
cull_i_2 = CullIndex(List=pt_17, Indices=Slider(101, range=0..110), Wrap=True)
weave_2 = Weave(Pattern=[0, 1], Stream0=moveaway_2.Geometry, Stream1=cull_i_2, NullGaps=False)
order = PointOrder(Points=weave_2)
nurbs_4 = NurbsCurve(Vertices=weave_2, Degree=3, Periodic=False)  # -> Curve, Length, Domain

# ----
# Large Base Form
loft = Loft(
    Curves=[nurbs_4.Curve, nurbs_2.Curve],
    Options={Adjust=False, Closed=False, LoftEnds=0, LoftSimp=2, LoftType=0, Rebuild=58, Refit=0.01})

# ----
# Bottom Base Curve
number_slider_13 = Slider(10, range=0..100)
range_2 = Range(Domain=Domain(0, 1), Steps=number_slider_13)
range_3 = Range(Domain=number_slider, Steps=number_slider_13)

graph = GraphMapper(range_2, x0=0, x1=1, y0=0, y1=1, container_name="Sine", Equation_px=[0, 0.4379710257], Equation_py=[0, 1])
multiplication_4 = Multiplication(A=Slider(125, range=0..1000), B=graph)

pt_18 = ConstructPoint(XCoordinate=range_3, YCoordinate=multiplication_4, ZCoordinate="-125")
intcrv = Interpolate(Vertices=pt_18, Degree=3, Periodic=False, KnotStyle=1)  # -> Curve, Length, Domain

# ----
# Top Base Curve
number_slider_14 = Slider(10, range=0..100)
range_4 = Range(Domain=Domain(0, 1), Steps=number_slider_14)
range_5 = Range(Domain=number_slider_2, Steps=number_slider_14)

graph_2 = GraphMapper(range_4, x0=0, x1=1, y0=0, y1=1, container_name="Sine", Equation_px=[0, 0.3356261253], Equation_py=[1, 0])
multiplication_5 = Multiplication(A=Slider(65, range=0..1000), B=graph_2)

pt_19 = ConstructPoint(XCoordinate=range_5, YCoordinate=multiplication_5, ZCoordinate="275")
intcrv_2 = Interpolate(Vertices=pt_19, Degree=3, Periodic=False, KnotStyle=1)  # -> Curve, Length, Domain

tweencrv = TweenCurve(CurveA=intcrv.Curve, CurveB=intcrv_2.Curve, Factor=range, BlendType=0)
offset_5 = OffsetCurve(Curve=tweencrv, Distance=number_slider_3, Plane=PlaneXY(0, 0, 0), Corners=1)
offset_6 = OffsetCurve(Curve=tweencrv, Distance=neg, Plane=PlaneXY(0, 0, 0), Corners=1)
end_3 = EndPoints(Curve=offset_5)  # -> Start, End
pt_20 = Point(end_3.Start)
pt_21 = Point(end_3.End)
circlett_5 = CircleTanTan(CurveA=offset_5, CurveB=offset_6, Point=pt_20)
circlett_6 = CircleTanTan(CurveA=offset_5, CurveB=offset_6, Point=pt_21)
ccx_9 = CurveCurve(CurveA=circlett_5, CurveB=offset_5)  # -> Points, ParamsA, ParamsB
ccx_10 = CurveCurve(CurveA=circlett_5, CurveB=offset_6)  # -> Points, ParamsA, ParamsB
ccx_11 = CurveCurve(CurveA=circlett_6, CurveB=offset_5)  # -> Points, ParamsA, ParamsB
ccx_12 = CurveCurve(CurveA=circlett_6, CurveB=offset_6)  # -> Points, ParamsA, ParamsB
ptstrimcrv_5 = PointsTrimCurve(Curve=circlett_5, Points=[ccx_9.Points, ccx_10.Points], Flip=True)  # -> Trimmed, SubDomains, Intersected
ptstrimcrv_6 = PointsTrimCurve(Curve=circlett_6, Points=[ccx_12.Points, ccx_11.Points], Flip=False)  # -> Trimmed, SubDomains, Intersected
merge_3 = Merge(Data1=ptstrimcrv_5.Trimmed, Data2=offset_5, Data3=ptstrimcrv_6.Trimmed, Data4=offset_6)  # -> flatten(Result)
join_3 = JoinCurves(Curves=merge_3, Preserve=False)
fitloft = FitLoft(Curves=join_3, CountU=Slider(300, range=0..300), DegreeU=5, DegreeV=Slider(3, range=0..10))

number_slider_15 = Slider(120, range=0..200)
number_slider_16 = Slider(30, range=0..100)
sdivide = DivideSurface(Surface=fitloft, UCount=number_slider_15, VCount=number_slider_16)  # -> Points, Normals, Parameters
curvature = SurfaceCurvature(Surface=fitloft, Point=sdivide.Parameters)  # -> Frame, Gaussian, Mean
bnd = Bounds(Numbers=curvature.Gaussian)
dedomain = DeconstructDomain(Domain=bnd)  # -> Start, End
gradient = Gradient(
    LowerLimit=dedomain.Start,
    UpperLimit=dedomain.End,
    Parameter=curvature.Gaussian,
    stops=[0: RGB(0, 128, 0), 0.5: RGB(255, 255, 0), 1: RGB(255, 0, 0)])
preview = CustomPreview(Geometry=sdivide.Points, Material=gradient)

loft_2 = Loft(Curves=join_3, Options={Adjust=False, Closed=True, LoftEnds=0, LoftSimp=0, LoftType=2, Rebuild=10, Refit=0.01})

# ---- group: input_geometry
geo_2 = Geometry(fitloft)

# ----
slicer_2 = GhPythonScript(
    slice=slice_2,
    input_geometry=geo_2,
    layer_height=layer_height_mm_2,
    distance_between_points=distance_between_points_mm_2)  # -> out, crvs, pts; same code as slicer

divide_5 = DivideDomain²(Domain=fitloft, UCount=number_slider_15, VCount=number_slider_16)
subsrf = Isotrim(Surface=fitloft, Domain=divide_5)
area = Area(Geometry=subsrf)  # -> Area, Centroid
pdecon = Deconstruct(Point=area.Centroid)  # -> XComponent, YComponent, ZComponent
bnd_2 = Bounds(Numbers=pdecon.YComponent)
dedomain_2 = DeconstructDomain(Domain=bnd_2)  # -> Start, End
gradient_2 = Gradient(
    LowerLimit=dedomain_2.Start,
    UpperLimit=dedomain_2.End,
    Parameter=pdecon.YComponent,
    stops=[0: RGB(234, 38, 0), 0.25: RGB(234, 126, 0), 0.5: RGB(254, 244, 84), 0.75: RGB(173, 203, 249), 1: RGB(75, 107, 169)])
preview_2 = CustomPreview(Geometry=subsrf, Material=gradient_2)

crv_2 = Curve(slicer_2.crvs)
pt_22 = Point(slicer_2.pts)
divide_6 = DivideCurve(Curve=crv_2, Count=number_slider_7, Kinks=False)  # -> Points, Tangents, Parameters
split = SplitList(List=divide_6.Points, Index=division_3)  # -> ListA, ListB
divide_branches = DivideBranches(DataTree=divide_6.Points, DivisionPattern=[0, 1], RenumberPaths=False)  # -> Data0, Data1
pt_23 = Point(split.ListA)
pt_24 = Point(split.ListB)
shift = ShiftList(List=divide_branches.Data1, Shift=Slider(1, range=0..1), Wrap=True)
cps = ClosestPoints(Point=pt_4, Cloud=flatten(pt_23), Count=multiplication)  # -> ClosestPoint, CPIndex, Distance
merge_4 = Merge(Data1=simplify(divide_branches.Data0), Data2=simplify(shift))
cps_2 = ClosestPoints(Point=graft(pt_5), Cloud=flatten(pt_24), Count=multiplication)  # -> ClosestPoint, CPIndex, Distance
merge_5 = Merge(Data1=flatten(cps.ClosestPoint), Data2=flatten(cps_2.ClosestPoint))
ln = Line(StartPoint=graft(pt_4), EndPoint=cps.ClosestPoint)
ln_2 = Line(StartPoint=graft(pt_5), EndPoint=cps_2.ClosestPoint)
len_2 = Length(Curve=ln)
len_3 = Length(Curve=ln_2)
bnd_3 = Bounds(Numbers=len_2)
bnd_4 = Bounds(Numbers=len_3)
cp_3 = ClosestPoint(Point=graft(merge_4), Cloud=merge_5)  # -> ClosestPoint, CPIndex, Distance
remap = RemapNumbers(Value=ln, Source=bnd_3, Target=dom_2)  # -> Mapped, Clipped
remap_2 = RemapNumbers(Value=ln_2, Source=bnd_4, Target=dom_2)  # -> Mapped, Clipped
smaller = SmallerThan(FirstNumber=cp_3.Distance, SecondNumber=Slider(0.01, range=0..0.01))  # -> SmallerThan, OrEqualTo
trim = TrimTree(Tree=smaller.SmallerThan, Depth=1)
cull = CullPattern(List=merge_4, CullPattern=invert(trim))
cull_2 = CullPattern(List=divide_6.Tangents, CullPattern=trim)
cull_3 = CullPattern(List=merge_4, CullPattern=trim)
viewer = ParamViewer(cull_3)
rotate_2 = Rotate(Geometry=cull_2, Angle=degrees(Slider(90, range=0..100)), Plane=PlaneXY(0, 0, 0))  # -> Geometry, Transform
amp = Amplitude(Vector=rotate_2.Geometry, Amplitude=Slider(5, range=0..10))
move = Move(Geometry=cull_3, Motion=amp)  # -> Geometry, Transform
cp_4 = ClosestPoint(Point=cull_3, Cloud=merge_4)  # -> ClosestPoint, CPIndex, Distance
replace = ReplaceItems(List=merge_4, Item=move.Geometry, Indices=cp_4.CPIndex, Wrap=False)
dispatch_3 = Dispatch(List=replace, DispatchPattern=[True, False])  # -> ListA, ListB
crv_3 = Curve(crv_2)
pt_25 = Point(dispatch_3.ListA)
pt_26 = Point(dispatch_3.ListB)
cp_5 = ClosestPoint(Point=pt_26, Cloud=divide_6.Points)  # -> ClosestPoint, CPIndex, Distance

# ---- group: Final Geometry
weave_3 = Weave(Pattern=[0, 1], Stream0=pt_25, Stream1=cp_5.ClosestPoint, NullGaps=False)  # -> flatten(Weave)

# ---- group: Fabrication planes
pln = Plane(flatten(weave_3))

# ----
pln_2 = Plane(flatten(pln))
rotate_3 = Rotate(Geometry=pln_2, Angle=degrees(number_slider_4), Plane=pln_2)  # -> Geometry, Transform

# ---- group: Define commands
safe_speed = Slider(20, range=0..300)
# 1
number_slider_17 = Slider(20, range=0..100)
speed = Slider(12, range=0..300)
planes_wcs = Plane(rotate_3.Geometry)
python = PythonScript(planes_WCS=planes_wcs, dfillet=number_slider_17, speed=speed, safe_speed=safe_speed, safe_pt=rotate.Geometry)  # -> commands; inputs planes_WCS: list of Plane, speed: Int32, safe_pt: Plane
# ---------- python: Python ----------
import Rhino.Geometry as rg
from compas.geometry import Frame
from compas.geometry import Transformation
from scriptcontext import sticky as st


robot = st["robot"]
buffer = 0.5

commands = []

def generate_cmds(planes_WCS, dfillet, speed, safe_speed, safe_pt):

    # add safe_pt as a starting point
    tcp_WCS_safe_pt = Frame(safe_pt.Origin, safe_pt.XAxis, safe_pt.YAxis)

    tcp_RCS_safe_pt = robot.get_frame_in_RCS(tcp_WCS_safe_pt)
    cmd_safe_pt = list(tcp_RCS_safe_pt.point) + tcp_RCS_safe_pt.axis_angle_vector + [safe_speed, 0]
    commands.append(cmd_safe_pt)


    # TODO this must be optimized! matrix multiplication!

    for i, plane_WCS in enumerate(planes_WCS):
        tcp_WCS = Frame(plane_WCS.Origin, plane_WCS.XAxis, plane_WCS.YAxis)
        if i == 0 or i == len(planes_WCS) - 1:
            radius = 0.

        else:
            # calculate blend radius
            prev, current, next = planes_WCS[i-1].Origin, planes_WCS[i].Origin, planes_WCS[i+1].Origin
            # print((prev - current).Length/2 * buffer, (next - current).Length/2 * buffer, dfillet)
            radius = min((prev - current).Length/2 * buffer, (next - current).Length/2 * buffer, dfillet)
            radius = round(radius,5)
        print(radius)
        # print()


        tcp_RCS = robot.get_frame_in_RCS(tcp_WCS)
        cmd = list(tcp_RCS.point) + tcp_RCS.axis_angle_vector + [speed, radius]
        commands.append(cmd)


    # add safe_pt as an end point
    commands.append(cmd_safe_pt)
    return commands


commands = generate_cmds(planes_WCS, dfillet, speed, safe_speed, safe_pt)

print commands[0]
# ---------- end python ----------

# ----
pt_27 = Point(rotate_3.Geometry)

# ---- group: test_pt
pt_28 = Point(Point(24.81319733, 37.76746931, -41.49502575))
xy_2 = XYPlane(Origin=pt_27)
rotate_4 = Rotate(Geometry=xy_2, Angle=degrees(Slider(0, range=0..1000)), Plane=xy_2)  # -> Geometry, Transform

# ----
pln_3 = Plane(planes_wcs)

# ---- group: save_commands
py_4 = PythonScript()  # -> path
# ---------- py_4: Python ----------
import sys
import os

ghComp = ghenv.Component
ghDoc = ghComp.OnPingDocument()

# the full path of the gh file
path = ghDoc.FilePath
# the directory of the gh file
path = os.path.dirname(path)

path = os.path.abspath(os.path.join(path, ".."))

print path
# ---------- end py_4 ----------
move_filament_loading_pt = BooleanToggle(True)
continue_fabrication = BooleanToggle(True)
# 3
panel_16 = Panel(py_4)
save_json = Button()
commands = Data(python)
send_9 = PythonScript(
    path=panel_16,
    continue_fabrication=continue_fabrication,
    commands=commands,
    move_filament_loading_pt=move_filament_loading_pt,
    save_json=save_json,
    name_json="commands_group_05.json")  # -> out; inputs continue_fabrication: Int32, commands: list, move_filament_loading_pt: Boolean
# ---------- send_9: Python ----------
import json
import os

from mini_eggshell.ur_online_control.communication.msg_identifiers import *
from mini_eggshell.ur_online_control.utilities.lists import flatten_list
from time import sleep


#number of values per command to be formatted 
len_command = len(commands[0])
gh_commands = flatten_list(commands)


#to print in gh panel
print len_command, "values each command"
print len(gh_commands)/len_command, "commands." , len(gh_commands), "values"


if move_filament_loading_pt:
    print "Moving to filament loading point"
else:
    print "Skipping filament loading point"


data = {}
data['move_filament_loading_pt'] = move_filament_loading_pt
data['len_command'] = len_command
data['gh_commands'] = gh_commands


filename = os.path.join(path, name_json)
if save_json:
    with open(filename, 'w') as f:
        json.dump(data, f)
# ---------- end send_9 ----------

# ----
panel_17 = Panel(send_9)
item_2 = ListItem(List=pln_3, Index=0, Wrap=True)  # -> Item1, Item
pln_4 = Plane([item_2.Item1, item_2.Item])

# ----
# 2
# Visualisation
robot_2 = Data(robot)
pose_joints = Data(pose)
planes_wcs_2 = Plane(pln_4)

# ---- group: Calculate joint positions for path
# Add init joint states
joint_states = Data([-0.1728179112, -1.415058186, 1.813991282, -1.971940356, -1.571654205, -3.308720436])
init_configuration = Slider(2, range=0..7)
py_5 = PythonScript(robot=robot_2, planes_WCS=planes_wcs_2, configuration_idx=init_configuration, init_configuration=joint_states)  # -> configurations; inputs planes_WCS: list, configuration_idx: Int32, init_configuration: list
# ---------- py_5: Python ----------
from compas_ghpython import unload_modules
unload_modules('ur_online_control')
import Rhino.Geometry as rg
from compas.geometry import Frame 
from compas.geometry.xforms import Transformation
#from compas_ghpython import xdraw_frame
from ur_online_control.ur.kinematics import calculate_configurations_for_path, format_joint_positions


# TODO this must be optimized! matrix multiplication!
frames_tool0_RCS = []
for plane_WCS in planes_WCS:
    tcp_WCS = Frame(plane_WCS.Origin, plane_WCS.XAxis, plane_WCS.YAxis)
    tcp_RCS = robot.get_frame_in_RCS(tcp_WCS)
    frames_tool0_RCS.append(robot.get_tool0_frame_from_tcp_frame(tcp_RCS))
    

#configurations = calculate_configurations_for_path(frames_tool0_RCS, robot.params, init_configuration)
configurations = calculate_configurations_for_path(frames_tool0_RCS, robot, init_configuration)
print configurations
configurations = configurations[min([configuration_idx, len(configurations) - 1])]

def format(numbers, k=4):
    #numbers = format_joint_positions(numbers)
    return "[" + ", ".join([("%." + str(k) + "f") % n for n in numbers]) + "]"
# ---------- end py_5 ----------
start = Button()
stop_3 = Button()
step = Button()
counter = CountThroughList(L=py_5, start=start, stop=stop_3, step=step, step_back=back, reset=reset, interval=50)  # -> item; inputs L: list, start: Boolean, stop: Boolean, step_back: Boolean
# ---------- counter: Python ----------
from scriptcontext import sticky as st
from compas_ghpython import update_component


# store data in component
guid = str(ghenv.Component.InstanceGuid)
counter_key = "counter_" + guid
running_key = "running_" + guid

if counter_key not in st:
    st[counter_key] = 0

if running_key not in st:
    st[running_key] = False

if start:
    st[running_key] = True

if stop:
    st[running_key] = False

if step:
    if st[counter_key] < len(L) - 1:
        st[counter_key] += 1

if step_back:
    if st[counter_key] < len(L) - 1:
        st[counter_key] -= 1

if reset:
    st[counter_key] = 0

if len(L):
    item = L[st[counter_key]]

if st[running_key]:
    if st[counter_key] < len(L) - 1:
        st[counter_key] += 1
        update_component(ghenv, interval)
    else:
        st[counter_key] = 0
        st[running_key] = False
# ---------- end counter ----------

# ---- group: Define plane in WCS, calculate joint positions
pt_29 = Point(Point(-283.8412985, -342.877576, 297.4189147))
select_configuration = Slider(1, range=0..7)
xy_3 = XYPlane(Origin=pt_29)
plane_wcs = Plane(xy_3)
inverse = PythonScript(robot=robot_2, plane_WCS=plane_wcs, idx=select_configuration)  # -> configuration; inputs plane_WCS: Plane, idx: Int32
# ---------- inverse: Python ----------
import Rhino.Geometry as rg
from compas.geometry import Frame, Transformation
#from compas_ghpython import xdraw_frame

tcp_WCS = Frame(plane_WCS.Origin, plane_WCS.XAxis, plane_WCS.YAxis)

# transform frame to robot coordinate system
tcp_RCS = robot.get_frame_in_RCS(tcp_WCS)

# get the frame of tool0
tool0_RCS = robot.get_tool0_frame_from_tcp_frame(tcp_RCS)

# calculate solutions to frame
solutions = robot.inverse_kinematics(tool0_RCS)

if not len(solutions):
    q = [0,0,0,0,0,0]
else:
    idx = min(len(solutions) - 1, idx)
    q = solutions[idx]
    
print q

configuration = q
# ---------- end inverse ----------

# ---- group: Calculate joint positions for path / Shows joint positions along path
flip = BooleanToggle(True)
l2t = PythonScript(L=py_5, flip=flip)  # -> T; inputs L: list, flip: Boolean
# ---------- l2t: Python ----------
from compas_ghpython import list_to_ghtree
L = [l.joint_values for l in L]

if flip:
    L = zip(*L)
T = list_to_ghtree(L)
# ---------- end l2t ----------
graph_3 = QuickGraph(l2t, SortOrder=0)

# ---- group: Visualise
list_6 = ValueList({"0 forward, from angles": 0, "1 inverse, from one plane": 1, "2 inverse, from multiple planes": 2, "3 forward, from robot": 3}, selected="2 inverse, from multiple planes")
filter_2 = StreamFilter(Gate=list_6, Stream0=py_2, Stream1=inverse, Stream2=counter, Stream3=pose_joints)
configuration = Panel(filter_2)
mesh = Mesh(filter)
draw = PythonScript(robot=robot_2, configuration=filter_2, mesh=mesh, brep=filter, show_brep=show_brep)  # -> meshes, tool0_plane, tcp_plane, robot_brep; inputs mesh: list, brep: list
# ---------- draw: Python ----------
from compas_ghpython import unload_modules
unload_modules("ur_online_control")

#from compas_ghpython import xdraw_frame
from compas_ghpython import mesh_draw
from compas_ghpython.geometry.xforms import xform_from_transformation
from compas.geometry import Frame
from compas.geometry.xforms import Transformation
from mini_eggshell.ur_online_control.ur.robot import BaseConfiguration

import Rhino.Geometry as rg
import Rhino

def mesh_update_vertices(mesh, vertices):
    for i in range(len(vertices)):
        mesh.vertex[i].update({'x': vertices[i][0], 'y': vertices[i][1], 'z': vertices[i][2]})

if configuration:
    #print configuration
    #q = BaseConfiguration.from_joints(configuration)
    q = configuration
    print q
    print q.joint_values
    
    print robot.get_forward_transformations(q)
    R0, R1, R2, R3, R4, R5 = robot.get_forward_transformations(q)
    
    tool0_frame2 = robot.tool0_frame.transformed(R5)
    tcp_frame2 = Frame.from_transformation(Transformation.from_frame(tool0_frame2) * robot.transformation_tool0_tcp)
    
    print robot.transformation_tool0_tcp
    print robot.transformation_tcp_tool0
    print robot.transformation_tool0_tcp * robot.transformation_tcp_tool0
    print tcp_frame2
    tcp_frame2 = Frame.from_transformation(Transformation.from_frame(tool0_frame2) * robot.transformation_tcp_tool0)
    print tcp_frame2
    
    tool0_frame, tcp_frame = robot.get_transformed_tool_frames(R5)
    
    tool0_frame = tool0_frame2
    tcp_frame = tcp_frame2
    
    m0, m1, m2, m3, m4, m5 = mesh
    for i in range(6):
        exec("R%drg = xform_from_transformation(R%d)" % (i, i))
        exec("m%d.Transform(R%drg)" % (i, i))
    meshes = [m0, m1, m2, m3, m4, m5]
    print meshes
    mt = robot.tool.get_transformed_model(Transformation.from_frame(tool0_frame))
    
    if mt:
        meshes.extend(map(mesh_draw, mt))
    
    """
    m0, m1, m2, m3, m4, m5, tool0_frame, tcp_frame = robot.get_transformed_model(q)
    mt = robot.get_transformed_tool_model(tcp_frame)
    
    meshes = []
    meshes.append(mesh_draw(m0))
    meshes.append(mesh_draw(m1))
    meshes.append(mesh_draw(m2))
    meshes.append(mesh_draw(m3))
    meshes.append(mesh_draw(m4))
    meshes.append(mesh_draw(m5))
    if mt:
        meshes.append(mesh_draw(mt))
    
    """
    
#    tool0_plane = xdraw_frame(tool0_frame)
#    tcp_plane = xdraw_frame(tcp_frame)
    
    if show_brep:
        
        b0, b1, b2, b3, b4, b5 = brep
        
        b0.Transform(R0rg)
        b1.Transform(R1rg)
        b2.Transform(R2rg)
        b3.Transform(R3rg)
        b4.Transform(R4rg)
        b5.Transform(R5rg)
        
        robot_brep = [b0, b1, b2, b3, b4, b5]
# ---------- end draw ----------
tool0_plane = Plane(draw.tool0_plane)
tcp_plane = Plane(draw.tcp_plane)
robot_brep = Brep(draw.robot_brep)
draw_2 = RepresentPlaneAsLines(plane=tcp_plane, size=100)  # -> G, C
# ---------- draw_2: Python ----------
import Rhino.Geometry as rg
from System.Drawing import Color

if plane:

    G = []
    G.append(rg.Line(plane.Origin, size * plane.XAxis))
    G.append(rg.Line(plane.Origin, size * plane.YAxis))
    G.append(rg.Line(plane.Origin, size * plane.ZAxis))
    
    C = []
    C.append(Color.FromArgb(255, 0, 0))
    C.append(Color.FromArgb(0, 255, 0))
    C.append(Color.FromArgb(0, 0, 255))
# ---------- end draw_2 ----------
preview_3 = CustomPreview(Geometry=draw_2.G, Shader=draw_2.C)
preview_4 = CustomPreview(Geometry=draw.meshes, Shader=ColourSwatch(SwatchColor=RGBA(99, 94, 94, 96)))

# ----
pline_3 = PolyLine(Vertices=weave_3, Closed=False)

# ---- group: Send joint position directly to robot
panel_18 = Panel("move cartesian")
idx = Slider(0, range=0..100)
commands_2 = Data(python)
item_3 = ListItem(List=commands_2, Index=idx, Wrap=True)
list_7 = ValueList({"send all positions": 0, "send only one position": 1}, selected="send only one position")
filter_3 = StreamFilter(Gate=list_7, Stream0=commands_2, Stream1=item_3)
movel_4 = PythonScript(commands=filter_3, velocity=Slider(100, range=0..100))  # -> script; inputs commands: list
# ---------- movel_4: Python ----------
from scriptcontext import sticky as st

script_lines = []
for cmd in commands:
    #q, a=1.4, v=1.05, t=0, r=0)
    x, y, z, ax, ay, az, speed, radius = cmd
    script_lines.append("movel(p%s, v=%f, r=%f)" % (str([x/1000., y/1000., z/1000, ax, ay, az]), speed/1000., radius/1000.))

robot = st["robot"]
tool_angle_axis = list(robot.tool.tcp_frame.point) + robot.tool.tcp_frame.axis_angle_vector
x, y, z, ax, ay, az = tool_angle_axis

script = "def prog():\n"
script += "\ttextmsg(\">> program start\")\n"
script += "\tset_tcp(p%s)\n" % str([x/1000., y/1000., z/1000, ax, ay, az])
script += "".join(["\t%s\n" % line for line in script_lines])
script += "\ttextmsg(\"<< program end\")\n"
script += "end\n"
script += "prog()\n\n"

print script
# ---------- end movel_4 ----------
send_10 = Button()
send_11 = Send(script=movel_4, send=send_10)
panel_19 = Panel(send_11)

# ----
debrep = DeconstructBrep(Brep=fitloft)  # -> Faces, Edges, Vertices

# ---- group: Model Base Pt
item_4 = ListItem(List=debrep.Vertices, Index=0, Wrap=True)

# ----
vec2pt = Vector2Pt(PointA=item_4, PointB=pt_3, Unitize=False)  # -> Vector, Length
move_2 = Move(Geometry=fitloft, Motion=vec2pt.Vector)  # -> Geometry, Transform

# ---- group: Send joint position directly to robot
idx_2 = Slider(0, range=0..100)
panel_20 = Panel("move joints")
joint_positions = Data(py_5)
list_8 = ValueList({"send all positions": 0, "send only one position": 1}, selected="send only one position")
item_5 = ListItem(List=joint_positions, Index=idx_2, Wrap=True)
filter_4 = StreamFilter(Gate=list_8, Stream0=joint_positions, Stream1=item_5)
movej = PythonScript(joint_positions=filter_4, velocity=Slider(153, range=0..200))  # -> script; inputs joint_positions: list
# ---------- movej: Python ----------
script_lines = []

for position in joint_positions:
    script_lines.append("movej(%s, v=%f)" % (str(position), velocity/1000.))


script = "def prog():\n"
script += "\ttextmsg(\">> program start\")\n"
script += "".join(["\t%s\n" % line for line in script_lines])
script += "\ttextmsg(\"<< program end\")\n"
script += "end\n"
script += "prog()\n\n"


print script

#script = ""
# ---------- end movej ----------
send_12 = Button()

# ----
send_13 = Send(script=movej, send=send_12)

# ---- group: Send joint position directly to robot (continued)
panel_21 = Panel(send_13)

# ==== cluster Tools

# ---- group: clay_extruder
brep = Brep([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])
yaxis_line = Curve(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)
xaxis_line = Curve(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)
test_geometry = Geometry(brep)
brep_2 = Brep(test_geometry)
mesh = Mesh(test_geometry)
tool = Tool(meshes=mesh, breps=brep_2, xline=xaxis_line, yline=yaxis_line)

# ---- group: plastic_extruder
brep_3 = Brep([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])
xaxis_line_2 = Curve(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)
yaxis_line_2 = Curve(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)
test_geometry_2 = Geometry(brep_3)
mesh_2 = Mesh(test_geometry_2)
brep_4 = Brep(test_geometry_2)
tool_2 = Tool(meshes=mesh_2, breps=brep_4, xline=xaxis_line_2, yline=yaxis_line_2)

# ---- group: clay_extruder_SS
brep_5 = Brep([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])
yaxis_line_3 = Curve(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)
xaxis_line_3 = Curve(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)
test_geometry_3 = Geometry(brep_5)
brep_6 = Brep(test_geometry_3)
mesh_3 = Mesh(test_geometry_3)
tool_3 = Tool(meshes=mesh_3, breps=brep_6, xline=xaxis_line_3, yline=yaxis_line_3)

# ----
tool_id = ClusterInput()
tool_id_2 = Integer(tool_id)
filter = StreamFilter(Gate=tool_id_2, Stream1=tool_2, Stream2=tool, Stream3=tool_3)
py = PythonScript(tool=filter)  # -> tcp_frame, model
# ---------- py: Python ----------
from compas_ghpython import mesh_draw 

tcp_frame = tool.tcp_frame
model = map(mesh_draw, tool.model)
# ---------- end py ----------
tool_4 = Data(filter)
draw = PythonScript(frame=py.tcp_frame)  # -> G, C
# ---------- draw: Python ----------
import Rhino.Geometry as rg
from System.Drawing import Color

if not size:
    size = 100

if frame:
    plane = rg.Plane(rg.Point3d(*list(frame.point)), rg.Vector3d(*list(frame.xaxis)), rg.Vector3d(*list(frame.yaxis)))

    G = []
    G.append(rg.Line(plane.Origin, size * plane.XAxis))
    G.append(rg.Line(plane.Origin, size * plane.YAxis))
    G.append(rg.Line(plane.Origin, size * plane.ZAxis))
    
    C = []
    C.append(Color.FromArgb(255, 0, 0))
    C.append(Color.FromArgb(0, 255, 0))
    C.append(Color.FromArgb(0, 0, 255))
# ---------- end draw ----------
tool_5 = ClusterOutput(tool_4)
preview = CustomPreview(Geometry=draw.G, Shader=draw.C)
preview_2 = CustomPreview(Geometry=py.model, Shader=ColourSwatch(SwatchColor=RGB(141, 170, 178)))

# ==== cluster Send
script = ClusterInput()
send = ClusterInput()
send_2 = PythonScript(script=script, send=send)  # -> out
# ---------- send_2: Python ----------
import socket
from scriptcontext import sticky as st

ur_ip = st["ur_ip"]
ur_port = 30002

if send:
    s = socket.create_connection((ur_ip, ur_port), timeout=0.5) 
    s.send(script)
    s.close()
# ---------- end send_2 ----------
out = ClusterOutput(send_2)

# ==== cluster Tool
breps = ClusterInput()
meshes = ClusterInput()
meshes_2 = Mesh(meshes)
mjoin = MeshJoin(Meshes=meshes_2)
xline = ClusterInput()
yline = ClusterInput()
tool = PythonScript(meshes=mjoin, breps=breps, xline=xline, yline=yline)  # -> tool; inputs meshes: list of Mesh, breps: list of Brep
# ---------- tool: Python ----------
import Rhino.Geometry as rg
from compas.geometry import Frame
from ur_online_control.ur.tool import Tool
from compas.datastructures import Mesh
from compas_rhino.helpers import mesh_from_guid

xaxis = rg.Line(xline.PointAtStart, xline.PointAtEnd)
yaxis = rg.Line(yline.PointAtStart, yline.PointAtEnd)

if xaxis.From.DistanceTo(yaxis.From) < 0.01:
    origin = xaxis.From
    xaxis = xaxis.Direction
    yaxis = yaxis.Direction
elif xaxis.To.DistanceTo(yaxis.To) < 0.01:
    origin = xaxis.To
    xaxis = -xaxis.Direction
    yaxis = -yaxis.Direction
elif xaxis.From.DistanceTo(yaxis.To) < 0.01:
    origin = xaxis.From
    xaxis = xaxis.Direction
    yaxis = -yaxis.Direction
elif xaxis.To.DistanceTo(yaxis.From) < 0.01:
    origin = xaxis.To
    xaxis = -xaxis.Direction
    yaxis = yaxis.Direction

xaxis.Unitize()
yaxis.Unitize()

print origin
print xaxis
print yaxis

tcp_frame = Frame(origin, xaxis, yaxis)

tool = Tool(tcp_frame)
tool.model = [mesh_from_guid(Mesh, mesh) for mesh in meshes]
#tool.model_xyz = tool.model.xyz
tool.breps = breps
# ---------- end tool ----------
tool_2 = ClusterOutput(tool)
