# Grasshopper definition ur_online_control_gh_group_04.gh (Grasshopper 1.0.7)
# plug-ins: Pufferfish, Clipper, Bifocals, Spirale

# ---- group: Test mesh sim casting
mesh = Mesh(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)

# ---- group: Input mesh
# Polymorph part
mesh_2 = Mesh(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)

# ----
pt = Point(Point(181.2805986, 196.1561453, 0))  # disabled
number_slider = Slider(60, range=0..100)  # disabled

# ---- group: MOVE
pt_2 = Point(Point(181.2805986, 196.1561453, 0))  # disabled

# ----
pdecon = Deconstruct(Point=pt)  # -> XComponent, YComponent, ZComponent; disabled
pt_3 = ConstructPoint(XCoordinate=pdecon.XComponent, YCoordinate=pdecon.YComponent, ZCoordinate=number_slider)  # disabled
division = Division(A2=2, B3=3)

autoannotate = AutoAnnotate(enable=Toggle(True))  # inputs enable: Boolean, types: list
# ---------- autoannotate: Python ----------
"""
Adds annotations to internalized input parameters for all components on the canvas.
using the format `X=Y`. Completely reversible via toggling the `enable` input. 
Default enabled types are Boolean, Integer, Number, String, Interval, and Plane, 
connect a Value List to the `types` input to enable others.
"""
from Grasshopper.Kernel import Types, Parameters, GH_Component
from Grasshopper.Kernel.Special import GH_ValueList, GH_ValueListItem, GH_ValueListMode
this = ghenv.Component

# region RUN_ONCE_ONLY

# Crazy self-modifying hack to remove default parameters "x, y, a" if they have no wires connected
# this block of code between #region and #endregion will be commented out after the first time the code runs.

from Grasshopper.Kernel import GH_ParameterSide

reversible = False

if reversible:
    # comment out the region by surrounding it in triple quotes
    newcode = this.Code.replace("\n# region RUN_ONCE_ONLY", "\n# region RUN_ONCE_ONLY\n\"\"\"")
    newcode = newcode.replace("\n# endregion RUN_ONCE_ONLY", "\n\"\"\"# endregion RUN_ONCE_ONLY")
else:
    # cut the entire region out irreversibly
    newcode = this.Code.partition("\n# region RUN_ONCE_ONLY")[0] + this.Code.rpartition("\n# endregion RUN_ONCE_ONLY")[-1]


def callback(doc):
    for pos, pm in enumerate(list(this.Params.Input)):
        if pm.NickName in "xy" and pm.SourceCount == 0:
            this.DestroyParameter(GH_ParameterSide.Input, pos)
            this.Params.UnregisterInputParameter(pm)

    for pos, pm in enumerate(list(this.Params.Output)):
        if pm.NickName == "a" and pm.Recipients.Count == 0:
            this.DestroyParameter(GH_ParameterSide.Output, pos)
            this.Params.UnregisterOutputParameter(pm)

    if this.IsCodeInputLinked():
        this.CodeInputParam.Sources.Clear()
    this.CodeInputParam.Script_ClearPersistentData()
    this.CodeInputParam.SetPersistentData(newcode)
    this.VariableParameterMaintenance()


this.OnPingDocument().ScheduleSolution(1, callback)


def ensure_input(name, hint=None, access=0):
    if this.Params.Input.Find(lambda p: p.NickName == name):
        return

    def callback(doc):
        from Grasshopper.Kernel import GH_ParameterSide, GH_ParamAccess
        pos = this.Params.Input.Count
        pm = this.CreateParameter(GH_ParameterSide.Input, pos)
        pm.NickName = name
        default_hint = this.GetType().Assembly.GetType("GhPython.Component.NoChangeHint")()
        pm.TypeHint = default_hint if not isinstance(hint, Parameters.IGH_TypeHint) else hint
        pm.Access = GH_ParamAccess.ToObject(GH_ParamAccess, access)
        this.Params.RegisterInputParam(pm, pos)
        this.VariableParameterMaintenance()

    this.OnPingDocument().ScheduleSolution(1, callback)


ensure_input("enable", hint=Parameters.Hints.GH_BooleanHint_CS())
ensure_input("types", access=1)

# endregion RUN_ONCE_ONLY

ann_types = [Types.GH_Boolean, Types.GH_Integer, Types.GH_Number, Types.GH_String, Types.GH_Interval, Types.GH_Plane,
             Types.GH_Point, Types.GH_Vector, Types.GH_ComplexNumber, Types.GH_Colour, Types.GH_Time]
# first N types in the list to be enabled for annotation.
# connect value list for more options
default_idx = 6
# truncates the annotation if above N characters -
# prevents long strings from expanding the component width too much
maxlen = 20

this.Name = "AutoAnnotate"

types_param = this.Params.Input.Find(lambda p: p.NickName == "types")
types_param.Description = "Connect a Value List for more options"
vallist = types_param.Sources[0] if types_param.SourceCount == 1 else None
if isinstance(vallist, GH_ValueList):
    if len(ann_types) != vallist.ListItems.Count:
        # clear and rebuild the list
        vallist.ListMode = GH_ValueListMode.CheckList
        vallist.ListItems.Clear()
        for i, _type in enumerate(ann_types):
            typename = _type().TypeName
            item = GH_ValueListItem(typename, typename)
            item.Selected = (i < default_idx)
            vallist.ListItems.Insert(i, item)
        vallist.Attributes.ExpireLayout()
        vallist.Attributes.PerformLayout()
    ann_types = [t for t, b in zip(ann_types, vallist.SaveState()) if b == "Y"]
else:
    ann_types = ann_types[:default_idx]

for obj in this.OnPingDocument().Objects:
    if not isinstance(obj, GH_Component):
        continue
    has_changed = False
    for param in obj.Params.Input:
        if not hasattr(param, "PersistentData"):
            # less overhead than testing if assignable from generic type GH_PersistentParam[T]
            continue

        if isinstance(param, Parameters.Param_ScriptVariable) or param.Name == "code":
            # script variables depend on their nicknames, do not mess with them
            # also adding an exception for the "code" input of GhPython component
            continue

        try:
            assert enable
            assert param.SourceCount == 0
            assert param.PersistentDataCount == 1
            pers_data = param.PersistentData[0][0]
            assert pers_data.GetType() in ann_types
            data_repr = pers_data.ToString()
            if isinstance(pers_data, Types.GH_String):
                data_repr = '"{}"'.format(data_repr)
            if len(data_repr) > maxlen:
                data_repr = data_repr[:maxlen] + u"\u2026"  # ellipsis
            param.NickName = param.NickName.partition("=")[0] + "=" + data_repr
            has_changed = True
        except AssertionError:
            if "=" in param.NickName:
                param.NickName = param.NickName.partition("=")[0]
                has_changed = True

    if has_changed:
        obj.Attributes.ExpireLayout()
        obj.Attributes.PerformLayout()
# ---------- end autoannotate ----------

pt_4 = Point(pt_3)  # disabled

input = DataInput(
    Destination="C:\Users\emman\Documents\GIT\mini_eggshell\ur_online_control\design\group_04\week_2_infilled_prototype_2-1.ghdata",
    RelativePath="C:\Users\emman\Documents\GIT\mini_eggshell\ur_online_control\design\group_04\week_2_infilled_prototype_2-1.ghdata|..\design\group_04\week_2_infilled_prototype_2-1.ghdata",
    UpdateDelay=5)  # disabled
pt_5 = Point(Point(0, 0, 0))  # disabled
pt_6 = Point(Point(1.764484005, 342.009372, 0))  # disabled
vec2pt = Vector2Pt(PointA=pt_5, PointB=pt_6, Unitize=False)  # -> Vector, Length; disabled
number_slider_2 = Slider(24, range=0..100)  # disabled
move = Move(Geometry=input, Motion=vec2pt.Vector)  # -> Geometry, Transform; disabled
Z = UnitZ(Factor=number_slider_2)  # disabled
move_2 = Move(Geometry=move.Geometry, Motion=Z)  # -> Geometry, Transform; disabled
pt_7 = Point(move_2.Geometry)  # disabled
number_slider_3 = Slider(4000, range=0..10000)  # disabled
number_slider_4 = Slider(4000, range=0..10000)  # disabled
split = SplitList(List=flatten(pt_7), Index=number_slider_3)  # -> ListA, ListB; disabled
split_2 = SplitList(List=split.ListB, Index=number_slider_4)  # -> ListA, ListB; disabled
split_3 = SplitList(List=split_2.ListB, Index=number_slider_4)  # -> ListA, ListB; disabled

# ---- group: Tutorial geometry
# -10 is good start z for print
# layer height = 4
# for the mid size nozzle
panel = Panel("-181 bottom extruder")  # disabled
number_slider_5 = Slider(0, range=-100..200)  # disabled
number_slider_6 = Slider(-175, range=-500..350)  # disabled
panel_2 = Panel("-172")  # disabled
panel_3 = Panel("-10")  # disabled
number_slider_7 = Slider(10, range=0..100)  # disabled
number_slider_8 = Slider(5, range=0..100)  # disabled
pt_8 = ConstructPoint(XCoordinate=number_slider_5, YCoordinate=number_slider_6, ZCoordinate=panel_3)  # disabled
number_slider_9 = Slider(115, range=0..150)  # disabled
range = Range(D0To1=Domain(0, 1), Steps=number_slider_8)  # disabled
cir = Circle(Plane=pt_8, Radius=number_slider_9)  # disabled
series = Series(Start=0, Step=number_slider_7, Count=number_slider_8)  # disabled
Z_2 = UnitZ(Factor=series)  # disabled
integer_division = IntegerDivision(A=number_slider_7, B2=2)  # disabled
move_3 = Move(Geometry=cir, Motion=Z_2)  # -> Geometry, Transform; disabled
pipe = Pipe(Curve=move_3.Geometry, Radius=integer_division, Caps=1)  # -> flatten(Pipe); disabled
graph = GraphMapper(
    range,
    x0=0,
    x1=1,
    y0=0,
    y1=1,
    container_name="Sine",
    Equation_px=[0.06322468072, 1],
    Equation_py=[0.3642850518, 0.9405152202])  # disabled
panel_4 = Panel(Z_2)  # disabled
cap = CapHoles(Brep=pipe)  # disabled
area = Area(Geometry=move_3.Geometry)  # -> Area, Centroid; disabled
cull_i = CullIndex(List=graph, Indices=-1, WTrue=True)  # disabled
number_slider_10 = Slider(10, range=0..100)  # disabled
scale = Scale(Geometry=move_3.Geometry, Center=area.Centroid, Factor=cull_i)  # -> Geometry, Transform; disabled
divide = DivideCurve(Curve=scale.Geometry, Count=number_slider_10, KFalse=False)  # -> Points, Tangents, Parameters; disabled

# ---- group: Rotating circles quick and dirty
number_slider_11 = Slider(100, range=0..1000)  # disabled
number_slider_12 = Slider(60, range=0..1000)  # disabled
number_slider_13 = Slider(10, range=0..100)  # disabled
pt_9 = Point(Point(185.4777967, 55.77893947, 22))  # disabled
pdecon_2 = Deconstruct(Point=pt_9)  # -> XComponent, YComponent, ZComponent; disabled
pt_10 = ConstructPoint(XCoordinate=pdecon_2.XComponent, YCoordinate=pdecon_2.YComponent, ZCoordinate=number_slider_13)  # disabled
cyl = Cylinder(Base=pt_10, Radius=number_slider_12, Length=number_slider_11)  # disabled
mesh_3 = MeshBrep(
    Brep=cyl,
    Settings={GridMaxCount=0, GridMinCount=16, JaggedSeams=False, MaxEdgeLength=0, MinEdgeLength=0.0001, MinTolerance=0, Refine=True, RefineAngle=0, RelativeTolerance=0.65, SimplePlanes=True, Tolerance=0})  # disabled

# ---- group: Test spiral / Center point
# Center point
number_slider_14 = Slider(-10, range=-20..10)  # disabled
pt_11 = Point(Point(253.2165127, 53.33895303, 0))  # disabled
Z_3 = UnitZ(Factor=number_slider_14)  # disabled
move_4 = Move(Geometry=pt_11, Motion=Z_3)  # -> Geometry, Transform; disabled

# ---- group: Overhang tester
number_slider_15 = Slider(199, range=0..500)  # disabled
number_slider_16 = Slider(163, range=0..1000)  # disabled
number_slider_17 = Slider(100, range=0..100)  # disabled
pt_12 = Point(Point(-5.21856941, 93.65677316, 0))  # disabled
division_2 = Division(A=number_slider_15, B2=2)  # disabled
addition = Addition(A=number_slider_16, B=division_2)  # disabled
circle = CircleCNR(Center=pt_12, Normal=Vector(0, 0, 1), Radius=number_slider_16)  # disabled
Z_4 = UnitZ(Factor=number_slider_17)  # disabled
move_5 = Move(Geometry=pt_12, Motion=Z_4)  # -> Geometry, Transform; disabled
scale_2 = Scale(Center=Point(0, 0, 0), Factor=0.5)  # -> Geometry, Transform; disabled
circle_2 = CircleCNR(Center=move_5.Geometry, Normal=Vector(0, 0, 1), Radius=addition)  # disabled
end = EndPoints(Curve=circle)  # -> Start, End; disabled
end_2 = EndPoints(Curve=circle_2)  # -> Start, End; disabled
loft = Loft(
    Curves=[circle_2, circle],
    Options={Adjust=False, Closed=False, LoftEnds=0, LoftSimp=0, LoftType=0, Rebuild=10, Refit=0.01})  # disabled
vec2pt_2 = Vector2Pt(PointA=pt_12, PointB=end.Start, Unitize=False)  # -> Vector, Length; disabled
vec2pt_3 = Vector2Pt(PointA=end.Start, PointB=end_2.Start, Unitize=False)  # -> Vector, Length; disabled
vdis = VectorDisplay(Anchor=end.Start, Vector=vec2pt_3.Vector)  # disabled
angle = Angle(VectorA=vec2pt_2.Vector, VectorB=vec2pt_3.Vector)  # -> Angle, Reflex; disabled
deg = Degrees(Radians=angle.Angle)  # disabled
scale_3 = Scale(Geometry=loft, Center=Point(0, 0, 0), Factor=0.5)  # -> Geometry, Transform; disabled
panel_5 = Panel(deg)  # disabled

# ---- group: Infilled prototype
pt_13 = Point(Point(107.3565245, 84.56936952, 0))  # disabled
pt_14 = Point(Point(0, 0, 0))  # disabled
input_2 = DataInput(
    Destination="C:\Users\emman\Documents\GIT\mini_eggshell\ur_online_control\design\group_04\week_2_infilled_prototype_2-1.ghdata",
    RelativePath="C:\Users\emman\Documents\GIT\mini_eggshell\ur_online_control\design\group_04\week_2_infilled_prototype_2-1.ghdata|..\design\group_04\week_2_infilled_prototype_2-1.ghdata",
    UpdateDelay=5)  # disabled
vec2pt_4 = Vector2Pt(PointA=pt_14, PointB=pt_13, Unitize=False)  # -> Vector, Length; disabled
number_slider_18 = Slider(5, range=0..10)  # disabled
move_6 = Move(Geometry=input_2, Motion=vec2pt_4.Vector)  # -> Geometry, Transform; disabled
Z_5 = UnitZ(Factor=number_slider_18)  # disabled
move_7 = Move(Geometry=move_6.Geometry, Motion=Z_5)  # -> Geometry, Transform; disabled
pt_15 = Point(move_7.Geometry)  # disabled
number_slider_19 = Slider(2000, range=0..10000)  # disabled
split_4 = SplitList(List=flatten(pt_15), Index=number_slider_19)  # -> ListA, ListB; disabled
number_slider_20 = Slider(4000, range=0..10000)  # disabled
split_5 = SplitList(List=split_4.ListB, Index=number_slider_20)  # -> ListA, ListB; disabled
split_6 = SplitList(List=split_5.ListB, Index=number_slider_20)  # -> ListA, ListB; disabled

# ---- group: Leaning tower test / Centroid start pt print 2
pt_16 = Point(Point(284.518631, 201.1452026, 127.3320646))  # disabled

# ---- group: Leaning tower test / Centroid start pt print 1
pt_17 = Point(Point(284.518631, 172.1452026, 10.33206463))  # disabled

# ---- group: Leaning tower test
move_amount_in_x_per_layer_mm = Slider(1.5, range=0..10)  # disabled
curve_number_to_move_sidewards = Slider(0, range=0..100)  # disabled
distance_between_points = Slider(20, range=0..100)  # disabled
amount_of_layers = Slider(400, range=0..1000)  # disabled
layer_height = Slider(3, range=0..10)  # disabled
radius = Slider(58, range=0..1000)  # disabled
rtrig = RightTrigonometry(PLength=move_amount_in_x_per_layer_mm, QLength=layer_height)  # -> Alpha, Beta, PLength, QLength, RLength; disabled
number_slider_21 = Slider(90, range=0..100)  # disabled
deg_2 = Degrees(Radians=rtrig.Alpha)  # disabled
circle_3 = CircleCNR(Center=pt_17, Normal=Vector(0, 0, 1), Radius=radius)  # disabled
series_2 = Series(Start=0, Step=layer_height, Count=amount_of_layers)  # disabled
subtraction = Subtraction(A=number_slider_21, B=deg_2)  # disabled
Z_6 = UnitZ(Factor=series_2)  # disabled
panel_6 = Panel(subtraction)  # disabled
move_8 = Move(Geometry=circle_3, Motion=Z_6)  # -> Geometry, Transform; disabled
split_7 = SplitList(List=move_8.Geometry, Index=curve_number_to_move_sidewards)  # -> ListA, ListB; disabled
crv = Curve(split_7.ListB)  # disabled
lng = ListLength(List=crv)  # disabled
series_3 = Series(Start=0, Step=move_amount_in_x_per_layer_mm, Count=lng)  # disabled
Y = UnitY(Factor=series_3)  # disabled
crv_2 = Curve(split_7.ListA)  # disabled
move_9 = Move(Geometry=crv, Motion=Y)  # -> Geometry, Transform; disabled
number_slider_22 = Slider(20, range=0..40)  # disabled
number_slider_23 = Slider(40, range=0..100)  # disabled
merge = Merge(Data1=crv_2, Data2=move_9.Geometry)  # -> flatten(Result); disabled
split_8 = SplitList(List=merge, Index=number_slider_23)  # -> ListA, ListB; disabled
Z_7 = UnitZ(Factor=number_slider_22)  # disabled
divdist = DivideDistance(Curve=split_8.ListA, Distance=distance_between_points)  # -> Points, Tangents, Parameters; disabled
pline = PolyLine(Vertices=flatten(divdist.Points), CFalse=False)  # disabled
move_10 = Move(Geometry=divdist.Points, Motion=Z_7)  # -> Geometry, Transform; disabled
number_slider_24 = Slider(90, range=0..100)  # disabled
pln = Plane(move_10.Geometry)  # disabled
rotate = Rotate(Geometry=pln, Angle=degrees(number_slider_24), Plane=pln)  # -> Geometry, Transform; disabled

# ---- group: Test spiral / Main geometry
# Main geometry
number_slider_25 = Slider(30, range=0..100)  # disabled
number_slider_26 = Slider(2, range=0..10)  # disabled
Z_8 = UnitZ(Factor=1)  # disabled
spiral = Spirale(
    AxisStart=move_4.Geometry,
    AxisDirection=Z_8,
    HelixStart=Point(0, 1, 0),
    Pitch=number_slider_26,
    TurnCount=number_slider_25,
    R1=number_slider_25,
    R2=number_slider_25)  # disabled

# ---- group: Rotated tool test
crv_3 = Curve(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)
divdist_2 = DivideDistance(Curve=crv_3, Distance=Slider(2, range=0..10))  # -> Points, Tangents, Parameters
cdiv = Derivatives(Curve=crv_3, Parameter=divdist_2.Parameters)  # -> Point, FirstDerivative
circle_4 = CircleCNR(Center=divdist_2.Points, Normal=cdiv.FirstDerivative, Radius=Slider(20, range=0..20))
divdist_3 = DivideDistance(Curve=circle_4, Distance=Slider(5, range=0..10))  # -> Points, Tangents, Parameters
pl = PlaneNormal(Origin=divdist_3.Points, ZAxis=graft(cdiv.FirstDerivative))
pt_18 = Point(Point(0, 0, 0))
pt_19 = Point(Point(0, 1, 0))
vec2pt_5 = Vector2Pt(PointA=pt_18, PointB=pt_19, Unitize=False)  # -> Vector, Length
align = AlignPlane(Plane=pl, Direction=vec2pt_5.Vector)  # -> Plane, Angle
prot = RotatePlane(Plane=align.Plane, Angle=degrees(Slider(90, range=0..100)))

# ---- group: Test spiral / Start circle
# Start circle
cir_2 = Circle(Plane=move_4.Geometry, Radius=number_slider_25)  # disabled

# ---- group: Rotating circles quick and dirty / Settings
# Settings
distance_between_pts = Slider(10, range=0..50)  # disabled
number_slider_27 = Slider(6, range=-30..30)  # disabled
number_slider_28 = Slider(45, range=0..100)  # disabled
number_slider_29 = Slider(4.5, range=0..20)  # disabled

# ---- group: Test spiral / Make circle seam meet spiral
# Make circle seam meet spiral
number_slider_30 = Slider(90, range=0..1000)  # disabled
area_2 = Area(Geometry=cir_2)  # -> Area, Centroid; disabled
rotate_2 = Rotate(Geometry=cir_2, Angle=degrees(number_slider_30), Plane=area_2.Centroid)  # -> Geometry, Transform; disabled
explode = Explode(Curve=rotate_2.Geometry, Recursive=True)  # -> Segments, Vertices; disabled

# ---- group: Settings
distance_between_pts_2 = Slider(10, range=0..50)  # disabled
number_slider_31 = Slider(6, range=-30..30)  # disabled
number_slider_32 = Slider(45, range=0..100)  # disabled
number_slider_33 = Slider(4.5, range=0..20)  # disabled

# ---- group: Rotating circles quick and dirty
number_slider_34 = Slider(24, range=0..100)  # disabled

# ---- group: Tutorial geometry / mm3 to Litres
volume = Volume(Geometry=cap)  # -> Volume, Centroid; disabled
panel_7 = Panel("0.000001")  # disabled
multiplication = Multiplication(A=volume.Volume, B=panel_7)  # disabled
ma = MassAddition(Input=multiplication)  # -> Result, PartialResults; disabled
panel_8 = Panel(ma.Result)  # disabled

# ---- group: Rotating circles quick and dirty
# Polymorph slicer
cluster = Cluster_2(
    C=mesh_3,
    end_plane_rotation=number_slider_28,
    distance_between_points=distance_between_pts,
    distance_from_z0=number_slider_34,
    layer_height=number_slider_29)  # -> print_path, planes; disabled
pt_20 = Point(reverse(cluster.print_path))  # disabled

# ---- group: Test spiral
crv_4 = Curve(flatten([explode.Segments, spiral]))  # disabled
number_slider_35 = Slider(5, range=0..10)  # disabled
divdist_4 = DivideDistance(Curve=crv_4, Distance=number_slider_35)  # -> Points, Tangents, Parameters; disabled

# ---- group: Rotating circles quick and dirty / Visualization
# Visualization
pline_2 = PolyLine(Vertices=cluster.print_path, CFalse=False)  # disabled
explode_2 = Explode(Curve=pline_2, Recursive=True)  # -> Segments, Vertices; disabled

# ----
number_slider_36 = Slider(300, range=0..1000)
vec = VectorXYZ(XComponent=number_slider_36, YComponent=number_slider_36, ZComponent=0)  # -> Vector, Length
move_11 = Move(Geometry=prot, Motion=vec.Vector)  # -> Geometry, Transform

# ---- group: Settings
distance_between_pts_3 = Slider(5, range=0..50)  # disabled
number_slider_37 = Slider(6, range=-30..30)  # disabled
number_slider_38 = Slider(0, range=0..100)  # disabled
number_slider_39 = Slider(4, range=0..20)  # disabled

# ---- group: Leaning tower test / First print
pline_3 = PolyLine(
    Vertices=Tree({0;0}: [Point(342.518631, 172.1452026, 32.33206463), Point(339.0703551, 191.8456949, 32.33206463), Point(329.1355484, 209.2036791, 32.33206463), Point(313.8955197, 222.1551857, 32.33206463), Point(295.1624008, 229.1602021, 32.33206463), Point(275.1636731, 229.3857893, 32.33206463)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], {0;1}: [Point(342.518631, 172.1452026, 35.33206463), Point(339.0703551, 191.8456949, 35.33206463), Point(329.1355484, 209.2036791, 35.33206463), Point(313.8955197, 222.1551857, 35.33206463), Point(295.1624008, 229.1602021, 35.33206463), Point(275.1636731, 229.3857893, 35.33206463)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], {0;2}: [Point(342.518631, 172.1452026, 38.33206463), Point(339.0703551, 191.8456949, 38.33206463), Point(329.1355484, 209.2036791, 38.33206463), Point(313.8955197, 222.1551857, 38.33206463), Point(295.1624008, 229.1602021, 38.33206463), Point(275.1636731, 229.3857893, 38.33206463)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], {0;3}: [Point(342.518631, 172.1452026, 41.33206463), Point(339.0703551, 191.8456949, 41.33206463), Point(329.1355484, 209.2036791, 41.33206463), Point(313.8955197, 222.1551857, 41.33206463), Point(295.1624008, 229.1602021, 41.33206463), Point(275.1636731, 229.3857893, 41.33206463)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], {0;4}: [Point(342.518631, 172.1452026, 44.33206463), Point(339.0703551, 191.8456949, 44.33206463), Point(329.1355484, 209.2036791, 44.33206463), Point(313.8955197, 222.1551857, 44.33206463), Point(295.1624008, 229.1602021, 44.33206463), Point(275.1636731, 229.3857893, 44.33206463)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], {0;5}: [Point(342.518631, 172.1452026, 47.33206463), Point(339.0703551, 191.8456949, 47.33206463), Point(329.1355484, 209.2036791, 47.33206463), Point(313.8955197, 222.1551857, 47.33206463), Point(295.1624008, 229.1602021, 47.33206463), Point(275.1636731, 229.3857893, 47.33206463)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]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),
    CFalse=False)  # disabled

# ---- group: Rotating circles quick and dirty
number_slider_40 = Slider(180, range=0..1000)  # disabled
number_slider_41 = Slider(5000, range=0..100000)  # disabled
end_3 = EndPoints(Curve=pline_2)  # -> Start, End; disabled
rotate_3 = Rotate(Geometry=cluster.planes, Angle=degrees(number_slider_40), Plane=pt_10)  # -> Geometry, Transform; disabled
number_slider_42 = Slider(200, range=0..1000)  # disabled
split_9 = SplitList(List=reverse(rotate_3.Geometry), Index=number_slider_41)  # -> ListA, ListB; disabled
split_10 = SplitList(List=reverse(explode_2.Segments), Index=number_slider_41)  # -> ListA, ListB; disabled
Z_9 = UnitZ(Factor=number_slider_42)  # disabled
crv_5 = Curve(split_10.ListA)  # disabled
move_12 = Move(Geometry=split_9.ListA, Motion=Z_9)  # -> Geometry, Transform; disabled
X = UnitX(Factor=1)  # disabled
number_slider_43 = Slider(15, range=0..100)  # disabled
pln_2 = Plane(split_9.ListA)  # disabled
rev = Reverse(Vector=X)  # disabled
align_2 = AlignPlane(Plane=pln_2, Direction=rev)  # -> Plane, Angle; disabled
split_11 = SplitList(List=align_2.Plane, Index=number_slider_43)  # -> ListA, ListB; disabled
pln_3 = Plane(split_11.ListA)  # disabled

# ----
# Polymorph slicer
cluster_2 = Cluster(
    C=scale_3.Geometry,
    end_plane_rotation=number_slider_38,
    distance_between_points=distance_between_pts_3,
    distance_from_z0=number_slider_37,
    layer_height=number_slider_39)  # disabled
pt_21 = Point(reverse(cluster_2))  # disabled

# ---- group: Visualization
pline_4 = PolyLine(Vertices=cluster_2, CFalse=False)  # disabled
explode_3 = Explode(Curve=pline_4, Recursive=True)  # -> Segments, Vertices; disabled

# ----
number_slider_44 = Slider(45, range=0..100)
neg = Negative(Value=number_slider_44)
bool = Boolean("0")

# ----
# test_pt
# Origin
# Safety z offset
number_slider_45 = Slider(5, range=0..5)
Z_10 = UnitZ(Factor=number_slider_45)
pt_22 = Point(Point(0, 0, -12))
move_13 = Move(Geometry=pt_22, Motion=Z_10)  # -> Geometry, Transform
pt_23 = Point(Point(143.5449512, -50.24639294, 319.3127676))
xy = XYPlane(Origin=move_13.Geometry)
rotate_4 = Rotate(Geometry=xy, Angle=degrees(Slider(0, range=0..1000)), Plane=xy)  # -> Geometry, Transform

number_slider_46 = Slider(315, range=-360..360)

# ----
# 0a
# Check your IP address and set UR IP address
server_address = ValueList({"192.168.10.2", "192.168.10.11", "127.0.0.1"}, selected="192.168.10.11")
ur_ip = ValueList({"192.168.10.13", "192.168.10.11", "192.168.10.10", "127.0.0.1"}, selected="192.168.10.10")
server_port = Integer(30003)
globals = PythonScript(server_address=server_address, server_port=server_port, ur_ip=ur_ip)  # inputs server_port: Int32
# ---------- globals: Python ----------
from scriptcontext import sticky as st

st["server_address"] = server_address
st["server_port"] = server_port

st["ur_ip"] = ur_ip
# ---------- end globals ----------

# ----
# Check if UR is available
ping = Button()
py = PythonScript(ip=ur_ip, ping=ping)  # -> out
# ---------- py: Python ----------
from scriptcontext import sticky as st
from mini_eggshell.ur_online_control.ur_direct.utilities import is_available


guid = str(ghenv.Component.InstanceGuid)
txt_key = "txt_" + guid
if txt_key not in st:
    st[txt_key] = ""

if ping:
    
    available = is_available(ip)
    
    if available:
        st[txt_key] = "%s is up!" % ip
    else:
        st[txt_key] = "%s is down!" % ip

print st[txt_key]
# ---------- end py ----------
panel_9 = Panel(py)

bang = Button()
panel_10 = Panel("Unload libraries")
# Tool is rotated 90 degrees CCW in reality compared to visualization
unload = PythonScript(bang=bang)
# ---------- unload: Python ----------
from compas_ghpython import unload_modules

unload_modules("compas")
unload_modules("ur_online_control")
# ---------- end unload ----------

stop = Button()
get = Button()
get_2 = Button()
pose = PythonScript(get=get_2)  # -> pose_cartesian
# ---------- pose: Python ----------
from scriptcontext import sticky as st
from mini_eggshell.ur_online_control.ur_direct import get_current_pose_cartesian

server_address = st["server_address"]
server_port = 30005
ur_ip = st["ur_ip"]
robot = st["robot"]

tool_angle_axis = list(robot.tool.tcp_frame.point) + robot.tool.tcp_frame.axis_angle_vector
print tool_angle_axis

guid = str(ghenv.Component.InstanceGuid)
pose_cartesian_key = "pose_cartesian" + guid


if get:
    st[pose_cartesian_key] = get_current_pose_cartesian(server_address, server_port, ur_ip, tool_angle_axis)

if pose_cartesian_key not in st:
    pose_cartesian = []
else:
    pose_cartesian = st[pose_cartesian_key]
# ---------- end pose ----------
stop_2 = PythonScript(stop=stop)
# ---------- stop_2: Python ----------
from scriptcontext import sticky as st
from mini_eggshell.ur_online_control.ur_direct import stop as stop_robot

ur_ip = st["ur_ip"]

if stop:
    stop_robot(ur_ip)
# ---------- end stop_2 ----------
pose_2 = PythonScript(get=get)  # -> pose_joints
# ---------- pose_2: Python ----------
from scriptcontext import sticky as st
from mini_eggshell.ur_online_control.ur_direct import get_current_pose_joints
from mini_eggshell.ur_online_control.ur.robot import BaseConfiguration

server_address = st["server_address"]
server_port = 30005
ur_ip = st["ur_ip"]
robot = st["robot"]
tool_angle_axis = list(robot.tool.tcp_frame.point) + list(robot.tool.tcp_frame.axis_angle_vector)
print tool_angle_axis

guid = str(ghenv.Component.InstanceGuid)
pose_joints_key = "pose_joints" + guid

if get:
    st[pose_joints_key] = get_current_pose_joints(server_address, server_port, ur_ip, tool_angle_axis)
    
if pose_joints_key not in st:
    pose_joints = []
else:
    pose_joints = BaseConfiguration.from_joints(st[pose_joints_key])
# ---------- end pose_2 ----------
panel_11 = Panel(pose)
panel_12 = Panel(pose_2)

# ---- group: Origin
data = Data(["79.3845", "-766.842", "-435.007", "-0.69844", "1.52248", "0.732284"])

# ----
# 0b
# Direct UR control
vertical_pose = Number([-152.427, -780.635, 855.229, -1.1958, -1.22046, -1.20201])

wrist2 = Slider(0, range=-360..360)
base = Slider(90.163, range=-360..360)
shoulder = Slider(0, range=-360..360)
elbow = Slider(-102.857, range=-360..360)
wrist1 = Slider(0, range=-360..360)
wrist3 = Slider(0, range=-360..360)
ur1_q1_q6 = Data([base, shoulder, elbow, wrist1, wrist2, wrist3])

# ----
# Measure basis:
# 1. Clear the recorded poses
# 2. Move robot to origin and press "get pose"
# 3. Move robot to point in positive x-axis and press "get pose"
# 4. Move robot to an other point in your basis and press "get pose"
# (The farer away these positions are, the better)
# 
# 5. Alternatively change the order in the component calc base
# 6. Copy output into base component
# Calculate basis
list = ValueList({"origin, pt on positive x-axis, pt in xy plane": 0, "origin, pt on positive y-axis, pt in xy plane": 1}, selected="origin, pt on positive x-axis, pt in xy plane")
clear = Button()
rec = PythonScript(msg=pose, rec=get_2, clear=clear)  # -> rec; inputs msg: list
# ---------- rec: Python ----------
from scriptcontext import sticky as st

guid = str(ghenv.Component.InstanceGuid)
recorded_key =  "recorded_" + guid
just_cleared_key = "just_cleared_" + guid

if recorded_key not in st:
    st[recorded_key] = []

if just_cleared_key not in st:
    st[just_cleared_key] = False

if clear:
    st[recorded_key] = []
    st[just_cleared_key] = True
else:
    if len(msg):
        if msg != [None] and not st[just_cleared_key] and rec:
            st[recorded_key].append(msg)
    st[just_cleared_key] = False
        


rec = st[recorded_key]

print rec
# ---------- end rec ----------
calc_base = PythonScript(poses=rec, input_type=list)  # -> out; inputs poses: list
# ---------- calc_base: Python ----------
import Rhino.Geometry as rg
import math


if len(poses) > 2:
    
    O = poses[0]
    P1 = poses[1]
    P2 = poses[2]
    
    if input_type == 0:
        # origin, pt on positive x-axis, pt in xy plane
        origin = rg.Point3d(O[0], O[1], O[2])
        pt_on_xaxis = rg.Point3d(P1[0], P1[1], P1[2])
        pt_in_xyplane = rg.Point3d(P2[0], P2[1], P2[2])
        
        xaxis = pt_on_xaxis - origin
        xaxis.Unitize()
        
        v = pt_in_xyplane - origin
        zaxis = rg.Vector3d.CrossProduct(v, xaxis)
        zaxis.Unitize()
        
        # zaxis must look up!
        if math.acos(rg.Vector3d.ZAxis * zaxis) > math.acos(rg.Vector3d.ZAxis * -zaxis):
            zaxis = -zaxis
        
        yaxis = rg.Vector3d.CrossProduct(zaxis, xaxis)
    
    elif input_type == 1:
        # origin, pt on positive y-axis, pt in xy plane
        origin = rg.Point3d(O[0], O[1], O[2])
        pt_on_yaxis = rg.Point3d(P1[0], P1[1], P1[2])
        pt_in_xyplane = rg.Point3d(P2[0], P2[1], P2[2])
        
        yaxis = pt_on_yaxis - origin
        yaxis.Unitize()
        
        v = pt_in_xyplane - origin
        zaxis = rg.Vector3d.CrossProduct(v, yaxis)
        zaxis.Unitize()
        
        # zaxis must look up!
        if math.acos(rg.Vector3d.ZAxis * zaxis) > math.acos(rg.Vector3d.ZAxis * -zaxis):
            zaxis = -zaxis
        
        xaxis = rg.Vector3d.CrossProduct(yaxis, zaxis)
        
        
    print "Copy the following into base component:"
    print " "
    print "origin = [%.2f, %.2f, %.2f]" % tuple(list(origin))
    print "xaxis = [%.5f, %.5f, %.5f]" % tuple(list(xaxis))
    print "yaxis = [%.5f, %.5f, %.5f]" % tuple(list(yaxis))
    

#print rg.Vector3d.CrossProduct(rg.Vector3d.YAxis, rg.Vector3d.ZAxis)
#print rg.Vector3d.CrossProduct(rg.Vector3d.ZAxis, rg.Vector3d.XAxis)
# ---------- end calc_base ----------
panel_13 = Panel(rec)
panel_14 = Panel(calc_base)

# ---- group: Send commands
panel_15 = Panel("move vertical")
movel = PythonScript()  # -> script
# ---------- movel: Python ----------
from scriptcontext import sticky as st

robot = st["robot"]

tool_angle_axis = list(robot.tool.tcp_frame.point) + robot.tool.tcp_frame.axis_angle_vector
x, y, z, ax, ay, az = tool_angle_axis

script = "def prog():\n"
script += "\ttextmsg(\">> program start\")\n"
script += "\tset_tcp(p%s)\n" % str([x/1000., y/1000., z/1000, ax, ay, az])
script += "\tcurrent_pose = get_forward_kin()\n"
script += "\tmovel(p[current_pose[0], current_pose[1], current_pose[2], 0, 0, 0], a=0.1, v=0.1)\n"
script += "\ttextmsg(\"<< program end\")\n"
script += "end\n"
script += "prog()\n\n"

print script
# ---------- end movel ----------
send = Button()
send_2 = Send(script=movel, send=send)
panel_16 = Panel(send_2)

panel_17 = Panel("set digital out")
value = BooleanToggle(False)
number = Slider(0, range=0..10)
digital_out = PythonScript(number=number, value=value)  # -> script; inputs number: Int32, value: Boolean
# ---------- digital_out: Python ----------
script = "def prog():\n"
script += "\ttextmsg(\">> program start\")\n"
script += "\tset_digital_out(%i, %s)\n" % (int(number), str(value))
script += "\ttextmsg(\"<< program end\")\n"
script += "end\n"
script += "prog()\n\n"

print script
# ---------- end digital_out ----------
send_3 = Button()
send_4 = Send(script=digital_out, send=send_3)
panel_18 = Panel(send_4)

# ----
pdecon_3 = Deconstruct()  # -> XComponent, YComponent, ZComponent

# ---- group: Send commands
# move incremental in TCS
get_current_pose = Button()
list_2 = ValueList({"xaxis", "yaxis", "zaxis"}, selected="zaxis")
movel_2 = PythonScript(get=get_current_pose, step_size=Slider(5, range=-10..10), direction=list_2)  # -> script; inputs get: list
# ---------- movel_2: Python ----------
from scriptcontext import sticky as st
from compas.geometry import Frame
from compas.geometry import Point, Vector
from mini_eggshell.ur_online_control.ur_direct import get_current_pose_cartesian

server_address = st["server_address"]
server_port = 30005
ur_ip = st["ur_ip"]
robot = st["robot"]
tool_angle_axis = list(robot.tool.tcp_frame.point) + robot.tool.tcp_frame.axis_angle_vector
print tool_angle_axis

guid = str(ghenv.Component.InstanceGuid)
pose_cartesian_key = "pose_cartesian" + guid

if get:
    st[pose_cartesian_key] = get_current_pose_cartesian(server_address, server_port, ur_ip, tool_angle_axis)

if pose_cartesian_key not in st:
    pose_cartesian = []
    script = ""
else:
    pose_cartesian = st[pose_cartesian_key]

    robot = st["robot"]
    tool_angle_axis = list(robot.tool.tcp_frame.point) + robot.tool.tcp_frame.axis_angle_vector
    x, y, z, ax, ay, az = tool_angle_axis
    
    script = "def prog():\n"
    script += "\ttextmsg(\">> program start\")\n"
    script += "\tset_tcp(p%s)\n" % str([x/1000., y/1000., z/1000, ax, ay, az])
    script += "\tcurrent_pose = get_forward_kin()\n"
    
#    frame = Frame.from_pose_axis_angle_vector(pose_cartesian)
    frame = Frame.from_axis_angle_vector([ax, ay, az])
    frame.point = [x, y, z]

    if direction == "xaxis":
        next_vector = Vector(*frame.xaxis) * step_size
    elif direction == "yaxis":
        next_vector = Vector(*frame.yaxis) * step_size
    else: # direction == "zaxis":
        next_vector = Vector(*frame.zaxis) * step_size
    
    x, y, z = next_vector
    script += "\tmovel(p[current_pose[0] + %f, current_pose[1] + %f, current_pose[2] + %f, current_pose[3], current_pose[4], current_pose[5]], t=%f)\n" % (x/1000., y/1000., z/1000., step_size * 0.1)
    
    script += "\ttextmsg(\"<< program end\")\n"
    script += "end\n"
    script += "prog()\n\n"
    
    print script
# ---------- end movel_2 ----------
send_5 = Button()
send_6 = Send(script=movel_2, send=send_5)
panel_19 = Panel(send_6)

# move incremental in WCS
number_slider_47 = Slider(5, range=-10..10)
list_3 = ValueList({"xaxis", "yaxis", "zaxis"}, selected="zaxis")
movel_3 = PythonScript(step_size=number_slider_47, direction=list_3)  # -> script
# ---------- movel_3: Python ----------
from scriptcontext import sticky as st

robot = st["robot"]
tool_angle_axis = list(robot.tool.tcp_frame.point) + robot.tool.tcp_frame.axis_angle_vector
x, y, z, ax, ay, az = tool_angle_axis

script = "def prog():\n"
script += "\ttextmsg(\">> program start\")\n"
script += "\tset_tcp(p%s)\n" % str([x/1000., y/1000., z/1000, ax, ay, az])
script += "\tcurrent_pose = get_forward_kin()\n"


if direction == "xaxis":
    script += "\tmovel(p[current_pose[0] + %f, current_pose[1], current_pose[2], current_pose[3], current_pose[4], current_pose[5]], t=%f)\n" % (step_size/1000., step_size * 0.1)

elif direction == "yaxis":
    script += "\tmovel(p[current_pose[0], current_pose[1] + %f, current_pose[2], current_pose[3], current_pose[4], current_pose[5]], t=%f)\n" % (step_size/1000., step_size * 0.1)

else: # direction == "zaxis":
    script += "\tmovel(p[current_pose[0], current_pose[1], current_pose[2] + %f, current_pose[3], current_pose[4], current_pose[5]], t=%f)\n" % (step_size/1000., step_size * 0.1)

script += "\ttextmsg(\"<< program end\")\n"
script += "end\n"
script += "prog()\n\n"

print script
# ---------- end movel_3 ----------
send_7 = Button()
send_8 = Send(script=movel_3, send=send_7)
panel_20 = Panel(send_8)

# ---- group: Check the right order of the points
# Horisontally sliced tree, 2 branches, region union
move_amount_in_x_per_layer_mm_2 = Slider(1.5, range=0..10)
curve_number_to_move_sidewards_2 = Slider(5, range=0..100)
distance_between_points_2 = Slider(5, range=0..100)
amount_of_layers_2 = Slider(40, range=0..1000)
number_slider_48 = Slider(200, range=0..1000)
layer_height_2 = Slider(3, range=0..10)
radius_2 = Slider(40, range=0..1000)
pt_24 = ConstructPoint(XCoordinate=Slider(200, range=0..1000), YCoordinate=number_slider_48, ZCoordinate=0)
pt_25 = ConstructPoint(XCoordinate=Slider(260, range=0..1000), YCoordinate=number_slider_48, ZCoordinate=0)
circle_5 = CircleCNR(Center=pt_24, Normal=Vector(0, 0, 1), Radius=radius_2)
circle_6 = CircleCNR(Center=pt_25, Normal=Vector(0, 0, 1), Radius=radius_2)
series_4 = Series(Start=0, Step=layer_height_2, Count=amount_of_layers_2)
Z_11 = UnitZ(Factor=series_4)
move_14 = Move(Geometry=graft(circle_5), Motion=Z_11)  # -> Geometry, Transform
move_15 = Move(Geometry=graft(circle_6), Motion=Z_11)  # -> Geometry, Transform
split_12 = SplitList(List=move_14.Geometry, Index=curve_number_to_move_sidewards_2)  # -> ListA, ListB
split_13 = SplitList(List=move_15.Geometry, Index=curve_number_to_move_sidewards_2)  # -> ListA, ListB
crv_6 = Curve(split_12.ListA)
crv_7 = Curve(split_12.ListB)
crv_8 = Curve(split_13.ListA)
crv_9 = Curve(split_13.ListB)
lng_2 = ListLength(List=crv_9)
lng_3 = ListLength(List=crv_7)
series_5 = Series(Start=0, Step=move_amount_in_x_per_layer_mm_2, Count=lng_3)
series_6 = Series(Start=0, Step=move_amount_in_x_per_layer_mm_2, Count=lng_2)
X_2 = UnitX(Factor=series_5)
X_3 = UnitX(Factor=series_6)
rev_2 = Reverse(Vector=X_2)
move_16 = Move(Geometry=crv_9, Motion=X_3)  # -> Geometry, Transform
move_17 = Move(Geometry=crv_7, Motion=rev_2)  # -> Geometry, Transform
merge_2 = Merge(Data1=crv_8, Data2=move_16.Geometry)  # -> flatten(Result)
merge_3 = Merge(Data1=crv_6, Data2=move_17.Geometry)  # -> flatten(Result)
crv_10 = Curve(graft(merge_2))
crv_11 = Curve(graft(merge_3))
merge_4 = Merge(Data1=crv_11, Data2=crv_10)
runion = RegionUnion(Curves=merge_4)
isace = IsArcCircleEllipse(Curve=runion, Tolerance=1e-12)  # -> Arc, Circle, Ellipse
dispatch = Dispatch(List=runion, DispatchPattern=isace.Circle)  # -> ListA, ListB
item = ListItem(List=dispatch.ListA, Index=0, WTrue=True)  # -> Item, Item1
area_3 = Area(Geometry=item.Item)  # -> Area, Centroid
area_4 = Area(Geometry=item.Item1)  # -> Area, Centroid
avr = Average(Input=[area_3.Centroid, area_4.Centroid])
crv_cp = CurveClosestPoint(Point=avr, Curve=dispatch.ListA)  # -> Point, Parameter, Distance
clean = CleanTree(RemoveNulls=True, RemoveInvalid=True, RemoveEmpty=True, Tree=dispatch.ListB)

# ---- group: Check the right order of the points / Gives errors because of nulls but is OK
# Gives warning
# because of nulls but is OK
seam = Seam(Curve=dispatch.ListA, Seam=crv_cp.Parameter)  # -> simplify(graft(Curve))

# ---- group: Setup geometry
height = Slider(150, range=0..1000)
radius_pipe = Slider(20, range=0..100)
point = Point(Point(162.5565163, 6.469084979, 0))
unit_z = UnitZ(Factor=height)
number_slider_49 = Slider(100, range=0..100)
move_18 = Move(Geometry=point, Motion=unit_z)  # -> Geometry, Transform
circle_7 = Circle(Plane=point, Radius=Slider(90, range=0..100))
unit_z_2 = UnitZ(Factor=Slider(5, range=0..10))
move_19 = Move(Geometry=circle_7, Motion=unit_z_2)  # -> Geometry, Transform
surface = Surface(move_19.Geometry)

# ----
multiplication_2 = Multiplication(A=height, B=division)

# ---- group: Horisontal tree, 2 branches
move_amount_in_x_per_layer_mm_3 = Slider(1.5, range=0..10)  # disabled
curve_number_to_move_sidewards_3 = Slider(5, range=0..100)  # disabled
number_slider_50 = Slider(116, range=0..1000)  # disabled
distance_between_points_3 = Slider(20, range=0..100)  # disabled
amount_of_layers_3 = Slider(40, range=0..1000)  # disabled
layer_height_3 = Slider(3, range=0..10)  # disabled
radius_3 = Slider(58, range=0..1000)  # disabled
pdecon_4 = Deconstruct(Point=pt_4)  # -> XComponent, YComponent, ZComponent; disabled
addition_2 = Addition(A=pdecon_4.XComponent, B=number_slider_50)  # disabled
pt_26 = ConstructPoint(XCoordinate=pdecon_4.XComponent, YCoordinate=pdecon_4.YComponent, ZCoordinate=pdecon_4.ZComponent)  # disabled
pt_27 = ConstructPoint(XCoordinate=addition_2, YCoordinate=pdecon_4.YComponent, ZCoordinate=pdecon_4.ZComponent)  # disabled
rtrig_2 = RightTrigonometry(PLength=move_amount_in_x_per_layer_mm_3, QLength=layer_height_3)  # -> Alpha, Beta, PLength, QLength, RLength; disabled
number_slider_51 = Slider(90, range=0..100)  # disabled
deg_3 = Degrees(Radians=rtrig_2.Alpha)  # disabled
subtraction_2 = Subtraction(A=number_slider_51, B=deg_3)  # disabled
panel_21 = Panel(subtraction_2)  # disabled
number_slider_52 = Slider(29, range=0..40)  # disabled
Z_12 = UnitZ(Factor=number_slider_52)  # disabled
number_slider_53 = Slider(1700, range=0..1700)  # disabled
number_slider_54 = Slider(90, range=0..100)  # disabled

# ---- group: Horisontal tree, 2 branches / Base circles, translated vertically for the nb of layers
# Base circles, translated vertically for the nb of layers
circle_8 = CircleCNR(Center=pt_26, Normal=Vector(0, 0, 1), Radius=radius_3)  # disabled
circle_9 = CircleCNR(Center=pt_27, Normal=Vector(0, 0, 1), Radius=radius_3)  # disabled
series_7 = Series(Start=0, Step=layer_height_3, Count=amount_of_layers_3)  # disabled
series_8 = Series(Start=0, Step=layer_height_3, Count=amount_of_layers_3)  # disabled
Z_13 = UnitZ(Factor=series_8)  # disabled
Z_14 = UnitZ(Factor=series_7)  # disabled
move_20 = Move(Geometry=graft(circle_8), Motion=Z_14)  # -> Geometry, Transform; disabled
move_21 = Move(Geometry=graft(circle_9), Motion=Z_13)  # -> Geometry, Transform; disabled

# ---- group: Horisontal tree, 2 branches / Choose from which curve we start to "go to the side" and start translatin in x-direction
# Choose from which curve we start to "go to the side" and start translatin in x-direction
split_14 = SplitList(List=move_21.Geometry, Index=curve_number_to_move_sidewards_3)  # -> ListA, ListB; disabled
split_15 = SplitList(List=move_20.Geometry, Index=curve_number_to_move_sidewards_3)  # -> ListA, ListB; disabled
crv_12 = Curve(split_14.ListA)  # disabled
crv_13 = Curve(split_14.ListB)  # disabled
crv_14 = Curve(split_15.ListB)  # disabled
crv_15 = Curve(split_15.ListA)  # disabled
lng_4 = ListLength(List=crv_14)  # disabled
lng_5 = ListLength(List=crv_13)  # disabled
series_9 = Series(Start=0, Step=move_amount_in_x_per_layer_mm_3, Count=lng_4)  # disabled
series_10 = Series(Start=0, Step=move_amount_in_x_per_layer_mm_3, Count=lng_5)  # disabled
X_4 = UnitX(Factor=series_9)  # disabled
X_5 = UnitX(Factor=series_10)  # disabled
rev_3 = Reverse(Vector=X_4)  # disabled
move_22 = Move(Geometry=crv_14, Motion=rev_3)  # -> Geometry, Transform; disabled
move_23 = Move(Geometry=crv_13, Motion=X_5)  # -> Geometry, Transform; disabled

# ----
number_slider_55 = Slider(150, range=0..1000)  # disabled
number_slider_56 = Slider(100, range=0..100)  # disabled
number_slider_57 = Slider(40, range=0..100)  # disabled
number_slider_58 = Slider(5, range=0..10)  # disabled

unit_z_3 = UnitZ(Factor=number_slider_55)  # disabled
point_2 = Point(Point(-4.656011815, 6.469084979, 0))  # disabled
move_24 = Move(Geometry=point_2, Motion=unit_z_3)  # -> Geometry, Transform; disabled
number_slider_59 = Slider(3, range=0..10)  # disabled
circle_10 = Circle(Plane=move_24.Geometry, Radius=number_slider_56)  # disabled
divide_curve = DivideCurve(Curve=circle_10, Count=number_slider_59, KinksFalse=False)  # -> Points, Tangents, Parameters; disabled
number_slider_60 = Slider(90, range=0..100)  # disabled
boolean_toggle = BooleanToggle(True)  # disabled
line = Line(StartPoint=point_2, EndPoint=divide_curve.Points)  # disabled
circle_11 = Circle(Plane=point_2, Radius=number_slider_60)  # disabled
unit_z_4 = UnitZ(Factor=number_slider_58)  # disabled
pipe_2 = Pipe(Curve=line, Radius=number_slider_57, Caps=boolean_toggle)  # -> flatten(Pipe); disabled
move_25 = Move(Geometry=circle_11, Motion=unit_z_4)  # -> Geometry, Transform; disabled
panel_22 = Panel(pipe_2)  # disabled
solid_union = SolidUnion(Breps=pipe_2)  # disabled
brep = Brep(solid_union)  # disabled
surface_2 = Surface(move_25.Geometry)  # disabled
solid_difference = SolidDifference(BrepsA=brep, BrepsB=surface_2)  # disabled
brep_2 = Brep(solid_difference)  # disabled

number_slider_61 = Slider(24, range=0..100)  # disabled
mesh_brep = MeshBrep(
    Brep=brep_2,
    Settings={GridMaxCount=0, GridMinCount=16, JaggedSeams=False, MaxEdgeLength=0, MinEdgeLength=0.0001, MinTolerance=0, Refine=True, RefineAngle=0, RelativeTolerance=0.65, SimplePlanes=True, Tolerance=0})  # disabled

# ----
# Polymorph slicer
cluster_3 = Cluster_2(
    C=mesh_brep,
    end_plane_rotation=number_slider_32,
    distance_between_points=distance_between_pts_2,
    distance_from_z0=number_slider_61,
    layer_height=number_slider_33)  # -> print_path, planes; disabled
pt_28 = Point(reverse(cluster_3.print_path))  # disabled

# ---- group: Visualization
pline_5 = PolyLine(Vertices=cluster_3.print_path, CFalse=False)  # disabled
explode_4 = Explode(Curve=pline_5, Recursive=True)  # -> Segments, Vertices; disabled

# ----
number_slider_62 = Slider(180, range=0..1000)  # disabled
number_slider_63 = Slider(5000, range=0..100000)  # disabled
end_4 = EndPoints(Curve=pline_5)  # -> Start, End; disabled
rotate_5 = Rotate(Geometry=cluster_3.planes, Angle=degrees(number_slider_62), Plane=point_2)  # -> Geometry, Transform; disabled
number_slider_64 = Slider(200, range=0..1000)  # disabled
split_16 = SplitList(List=reverse(rotate_5.Geometry), Index=number_slider_63)  # -> ListA, ListB; disabled
split_17 = SplitList(List=reverse(explode_4.Segments), Index=number_slider_63)  # -> ListA, ListB; disabled
Z_15 = UnitZ(Factor=number_slider_64)  # disabled
crv_16 = Curve(split_17.ListA)  # disabled
move_26 = Move(Geometry=split_16.ListA, Motion=Z_15)  # -> Geometry, Transform; disabled
X_6 = UnitX(Factor=1)  # disabled
number_slider_65 = Slider(15, range=0..100)  # disabled
pln_4 = Plane(split_16.ListA)  # disabled
rev_4 = Reverse(Vector=X_6)  # disabled
align_3 = AlignPlane(Plane=pln_4, Direction=rev_4)  # -> Plane, Angle; disabled
split_18 = SplitList(List=align_3.Plane, Index=number_slider_65)  # -> ListA, ListB; disabled
pln_5 = Plane(split_18.ListA)  # disabled

# ---- group: input_geometry
geo = Geometry(brep_2)  # disabled

# ----
# 4Branch-Simple-
point_3 = Point(Point(7315.138414, -428.7410793, 5))
brep_3 = Brep(<brep referenced from the Rhino model>)
scale_4 = Scale(Geometry=brep_3, Center=point_3, Factor="2")  # -> Geometry, Transform
distance_between_points_mm = Slider(10, range=5..50)
layer_height_mm = Slider(3, range=0..10)
slice = BooleanToggle(True)
point_4 = Point(<point referenced from the Rhino model>)

# ---- group: input_geometry
geo_2 = Geometry(brep_3)

# ----
# 3Branch-Rotate+SImple-No Test
number_slider_66 = Slider(180, range=0..1000)
xz_plane = XZPlane(Origin=Point(0, 0, 0))
brep_4 = Brep(<brep referenced from the Rhino model>)
point_5 = Point(Point(226.7086963, 94.22146647, 5))
brep_5 = Brep(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)
rotate_6 = Rotate(Geometry=brep_5, Angle=degrees(number_slider_66), Plane=xz_plane)  # -> Geometry, Transform
brep_6 = Brep([rotate_6.Geometry, brep_5])
scale_5 = Scale(Geometry=brep_4, Center=point_5, Factor="2")  # -> Geometry, Transform
slice_2 = BooleanToggle(True)
layer_height_mm_2 = Slider(2, range=0..10)
point_6 = Point(<point referenced from the Rhino model>)

# ---- group: input_geometry
geo_3 = Geometry(brep_4)

# ----
slicer = GhPythonScript(slice=slice, input_geometry=geo_2, layer_height=layer_height_mm, distance_between_points=distance_between_points_mm)  # -> out, crvs, pts
# ---------- slicer: Python ----------
__author__ = "joburger"
__version__ = "2019.10.28"

import Rhino
import Rhino.Geometry as rg

import mini_eggshell.slicer.simple_slicer
reload(mini_eggshell.slicer.simple_slicer)

slicer = mini_eggshell.slicer.simple_slicer.Slicer(layer_height, distance_between_points)

if slice:
    if str(input_geometry.ObjectType) == "Mesh":
        print "Input geometry is of Mesh type"  
        crvs = slicer.create_contour_curves_from_mesh(input_geometry)
    elif str(input_geometry.ObjectType) == "Brep":
        print "Input geometry is of Brep type"
        crvs = slicer.create_contour_curves_from_brep(input_geometry)
    else:
        print "Input geometry not supported"
    
    pts = slicer.divide_curves_in_points()
# ---------- end slicer ----------

# ---- group: output_curves
crv_17 = Curve(slicer.crvs)

# ---- group: output_points
pt_29 = Point(slicer.pts)

# ----
point_order = PointOrder(Points=pt_29)
list_item = ListItem(List=pt_29, Index=Slider(0, range=0..100), WrapTrue=True)
move_to_point = MoveToPoint(Geometry=pt_29, PointA=list_item, PointB=point_4)  # -> Moved, Vector, Transform

number_slider_67 = Slider(2000, range=0..10000)
point_7 = Point(move_to_point.Moved)
split_list = SplitList(List=point_7, Index=number_slider_67)  # -> ListA, ListB
split_list_2 = SplitList(List=split_list.ListB, Index=number_slider_67)  # -> ListA, ListB
split_list_3 = SplitList(List=split_list_2.ListB, Index=number_slider_67)  # -> ListA, ListB

pline_6 = PolyLine(Vertices=point_7, CFalse=False)
len = Length(Curve=pline_6)
pt_30 = Point(split_list.ListA)

# ---- group: Setup geometry (continued)
circle_12 = Circle(Plane=move_18.Geometry, Radius=multiplication_2)
divide_curve_2 = DivideCurve(Curve=circle_12, Count=Slider(3, range=0..10), KinksFalse=False)  # -> Points, Tangents, Parameters
line_2 = Line(StartPoint=point, EndPoint=divide_curve_2.Points)  # -> flatten(Line)

list_item_2 = ListItem(List=line_2, Index0=0, WrapTrue=True)  # -> Item, Item1, Item2
curve = Curve(list_item_2.Item2)
flip_curve = FlipCurve(Curve=line_2, Guide=curve)  # -> Curve, Flag

pipe_3 = Pipe(Curve=flip_curve.Curve, Radius=radius_pipe, Caps=Toggle(False))  # -> flatten(Pipe)
solid_union_2 = SolidUnion(Breps=pipe_3)
brep_7 = Brep(solid_union_2)
solid_difference_2 = SolidDifference(BrepsA=brep_7, BrepsB=surface)
brep_8 = Brep(solid_difference_2)

# ----
deconstruct_brep = DeconstructBrep(Brep=brep_8)  # -> Faces, Edges, Vertices
surface_3 = Surface(deconstruct_brep.Faces)
curve_2 = Curve(deconstruct_brep.Edges)
point_8 = Point(deconstruct_brep.Vertices)
ghpython_script = GhPythonScript(pts=point_8, z_threshold=Slider(7, range=0..100))  # -> out, new_pt; inputs pts: list
# ---------- ghpython_script: Python ----------
__author__ = "admin"
__version__ = "2019.11.12"

import rhinoscriptsyntax as rs
import Rhino.Geometry as rg

new_pts = []

for i in range(len(pts)):
    x,y,z = rs.coerce3dpoint(pts[i])
    if 75 > z > 70 :
      new_pt = rg.Point3d(x,y,z+z_threshold)
# ---------- end ghpython_script ----------
circle_13 = Circle(Plane=ghpython_script.new_pt, Radius=Slider(120, range=0..1000))

point_on_curve = PointOnCurve(line_2, parameter=0.212)
plane = Plane(point_on_curve)
plane_2 = Plane(ghpython_script.new_pt)
line_plane = LinePlane(Line=line_2, Plane=plane)  # -> Point, ParamL, ParamP
end_points = EndPoints(Curve=line_2)  # -> Start, End
line_3 = Line(StartPoint=line_plane.Point, EndPoint=end_points.End)

split_brep = SplitBrep(Brep=brep_8, Cutter=circle_13)
list_item_3 = ListItem(List=split_brep, Index0=0, WrapTrue=True)  # -> Item, Item1
brep_9 = Brep(list_item_3.Item1)
brep_10 = Brep(list_item_3.Item)

# ---- group: input_geometry
geo_4 = Geometry(brep_9)

# ----
layer_height_mm_3 = Slider(2, range=0..10)
distance_between_points_mm_2 = Slider(5, range=1..40)
slice_3 = BooleanToggle(True)
slicer_2 = GhPythonScript(
    slice=slice_3,
    input_geometry=geo_4,
    layer_height=layer_height_mm_3,
    distance_between_points=distance_between_points_mm_2)  # -> out, crvs, pts; same code as slicer

# ---- group: output_points
pt_31 = Point(slicer_2.pts)

# ---- group: output_curves
crv_18 = Curve(slicer_2.crvs)

# ----
divide_length = DivideLength(Curve=line_3, Length=layer_height_mm_3)  # -> Points, Tangents, Parameters
explode_tree = ExplodeTree(Data=divide_length.Points)  # -> Branch0, Branch1, Branch2
list_length = ListLength(List=explode_tree.Branch0)
list_length_2 = ListLength(List=explode_tree.Branch1)
list_length_3 = ListLength(List=explode_tree.Branch2)
merge_5 = Merge(Data1=list_length, Data2=list_length_2, Data3=list_length_3)

series_11 = Series(Start=0, Step=expr("x*.75", layer_height_mm_3), Count=Slider(11, range=0..20))

# ----
# Angled circles, minimize clay buildup
# KEEP
number_slider_68 = Slider(40, range=0..100)
layer_height_control_of_bend = Slider(2, range=0..10)
max_angle_curve = Slider(45, range=0..100)
divide_curve_by_length = Slider(5, range=0..100)
shatter_control = Slider(0.2, range=0..1)
pt_32 = Point(Point(0, 0, 0))
amount_of_circles_on_top_of_bend = Slider(10, range=0..100)
bool_2 = Boolean("1")
bool_3 = Boolean("0")

slicer_3 = GhPythonScript(slice=slice_2, input_geometry=geo_3, layer_height=layer_height_mm_2, distance_between_points=Slider(10, range=0..10))  # -> out, crvs, pts; same code as slicer

# ---- group: output_curves
crv_19 = Curve(slicer_3.crvs)

# ---- group: output_points
pt_33 = Point(slicer_3.pts)

# ----
point_order_2 = PointOrder(Points=pt_33)
list_item_4 = ListItem(List=pt_33, Index=Slider(8175, range=0..9000), WrapTrue=True)
move_to_point_2 = MoveToPoint(Geometry=pt_33, PointA=list_item_4, PointB=point_5)  # -> Moved, Vector, Transform

number_slider_69 = Slider(2000, range=0..10000)
point_9 = Point(move_to_point_2.Moved)
split_list_4 = SplitList(List=point_9, Index=number_slider_69)  # -> ListA, ListB
split_list_5 = SplitList(List=split_list_4.ListB, Index=number_slider_69)  # -> ListA, ListB
split_list_6 = SplitList(List=split_list_5.ListB, Index=number_slider_69)  # -> ListA, ListB

# ---- group: Setup circles
circle_14 = CircleCNR(Center=pt_32, Normal=Vector(0, 0, 1), Radius=number_slider_68)
division_3 = Division(A=max_angle_curve, B=layer_height_control_of_bend)
series_12 = Series(Start=0, Step=layer_height_control_of_bend, Count=division_3)

# ----
area_5 = Area(Geometry=circle_14)  # -> Area, Centroid
rotate_7 = Rotate(Geometry=circle_14, Angle=degrees(Slider(180, range=0..1000)), Plane=area_5.Centroid)  # -> Geometry, Transform
end_5 = EndPoints(Curve=circle_14)  # -> Start, End

# ---- group: Setup circles (continued)
end_6 = EndPoints(Curve=rotate_7.Geometry)  # -> Start, End
xz = XZPlane(Origin=end_6.End)
rotate_8 = Rotate(Geometry=circle_14, Angle=degrees(series_12), Plane=xz)  # -> Geometry, Transform

# ---- group: Calculate layerheight
crv_20 = Curve(rotate_8.Geometry)
curvepoint = PointOnCurve(crv_20, parameter=0.5)
python = GhPythonScript(points=curvepoint)  # -> out, a; inputs points: list of Point3d
# ---------- python: Python ----------
__author__ = "a"
__version__ = "2019.11.11"

import Rhino.Geometry as rg

dists = []

for i, pt in enumerate(points):
    if i < len(points)-1:
        dists.append(pt.DistanceTo(points[i+1]))
        
a = dists
# ---------- end python ----------
avr_2 = Average(Input=python.a)
panel_23 = Panel(avr_2)

# ----
division_4 = Division(A=shatter_control, B=division_3)
neg_2 = Negative(Value=division_4)
series_13 = Series(Start=0.5, Step=neg_2, Count=division_3)  # -> graft(Series)
series_14 = Series(Start=0.5, Step=division_4, Count=division_3)  # -> graft(Series)
weave = Weave(Pattern=[0, 1], Stream0=series_13, Stream1=series_14, NullGaps=False)
shatter = Shatter(Curve=reparameterize(graft(rotate_8.Geometry)), Parameters=weave)
len_2 = Length(Curve=shatter)
sort = SortList(Keys=len_2, ValuesA=shatter)  # -> Keys, reverse(ValuesA)

# ---- group: Create frames
item_2 = ListItem(List=sort.ValuesA, Index=0, WTrue=True)
end_7 = EndPoints(Curve=item_2)  # -> Start, End
curvepoint_2 = PointOnCurve(item_2, parameter=0.5)
pl_3pt = Plane3Pt(PointA=curvepoint_2, PointB=end_7.End, PointC=end_7.Start)

# ---- group: Horisontal tree, 2 branches (continued)
merge_6 = Merge(Data1=crv_15, Data2=move_22.Geometry)  # disabled
merge_7 = Merge(Data1=crv_12, Data2=move_23.Geometry)  # disabled
panel_24 = Panel(merge_7)  # disabled

# ---- group: Horisontal tree, 2 branches / Rotate one circle
# Rotate one circle
number_slider_70 = Slider(180, range=0..1000)  # disabled
area_6 = Area(Geometry=merge_7)  # -> Area, Centroid; disabled
rotate_9 = Rotate(Geometry=merge_7, Angle=degrees(number_slider_70), Plane=area_6.Centroid)  # -> Geometry, Transform; disabled
flip = FlipCurve(Curve=rotate_9.Geometry)  # -> Curve, Flag; disabled

# ---- group: Horisontal tree, 2 branches (continued)
weave_2 = Weave(Pattern=[0, 1], Stream0=flatten(merge_6), Stream1=flatten(flip.Curve), NullGaps=False)  # disabled
divdist_5 = DivideDistance(Curve=weave_2, Distance=distance_between_points_3)  # -> Points, Tangents, Parameters; disabled
item_3 = ListItem(List=divdist_5.Points, Index=0, WTrue=True)  # disabled
move_27 = Move(Geometry=divdist_5.Points, Motion=Z_12)  # -> Geometry, Transform; disabled
ins = InsertItems(List=divdist_5.Points, Item=item_3, Indices=-1, WTrue=True)  # disabled
pln_6 = Plane(move_27.Geometry)  # disabled
pline_7 = PolyLine(Vertices=flatten(ins), CFalse=False)  # disabled
rotate_10 = Rotate(Geometry=pln_6, Angle=degrees(number_slider_54), Plane=pln_6)  # -> Geometry, Transform; disabled
item_4 = ListItem(List=flatten(divdist_5.Points), Index=number_slider_53, WTrue=True)  # disabled

# ----
cyl_2 = Cylinder(BWorldXY=PlaneXY(0, 0, 0), Radius=0.5, Length=1)  # disabled
brep_11 = Brep(<brep referenced from the Rhino model>)  # disabled
mesh_4 = Mesh(<mesh referenced from the Rhino model>)  # disabled
layer_height_mm_4 = Slider(10, range=0..10)  # disabled
distance_between_points_mm_3 = Slider(1, range=1..20)  # disabled
slice_4 = BooleanToggle(True)  # disabled
slicer_4 = GhPythonScript(slice=slice_4, input_geometry=geo, layer_height=layer_height_mm_4, distance_between_points=distance_between_points_mm_3)  # -> out, crvs, pts; disabled; same code as slicer
number_slider_71 = Slider(19, range=0..40)  # disabled
Z_16 = UnitZ(Factor=number_slider_71)  # disabled

# ---- group: output_points
pt_34 = Point(slicer_4.pts)  # disabled

# ---- group: output_curves
crv_21 = Curve(slicer_4.crvs)  # disabled

# ----
divide_length_2 = DivideLength(Curve=crv_21, Length=distance_between_points_mm_3)  # -> Points, Tangents, Parameters; disabled

pline_8 = PolyLine(Vertices=flatten(divide_length_2.Points), CFalse=False)  # disabled
move_28 = Move(Geometry=pt_34, Motion=Z_16)  # -> Geometry, Transform; disabled

# ---- group: Check the right order of the points (continued)
clean_2 = CleanTree(RemoveNulls=True, RemoveInvalid=True, RemoveEmpty=True, Tree=seam)
merge_8 = Merge(Data1=clean_2, Data2=simplify(clean))

divdist_6 = DivideDistance(Curve=merge_8, Distance=distance_between_points_2)  # -> simplify(Points), Tangents, Parameters
item_5 = ListItem(List=flatten(divdist_6.Points), Index=Slider(990, range=0..1000), WTrue=True)

# ---- group: Check the right order of the points / Base
# Base
path_mapper = PathMapper(divdist_6.Points, source="{a;0}", target="{a}")

# ---- group: Check the right order of the points / Tubes
# Tubes
path_mapper_2 = PathMapper(divdist_6.Points, source="{a;b;0}", target="{a;b}")

# ---- group: Check the right order of the points (continued)
merge_9 = Merge(Data1=path_mapper, Data2=path_mapper_2)

# ----
pt_35 = Point(merge_9)
cull = CullPattern(List=pt_35, CullPattern=[False, False, True, True])

# ----
# Travel every first pt in branches
panel_25 = Panel("0")
lng_6 = ListLength(List=path_mapper_2)
lng_7 = ListLength(List=path_mapper)
bool_4 = Boolean(panel_25)
bool_5 = Boolean("1")
repeat = RepeatData(Data=bool_4, Length=lng_7)  # -> simplify(Data)
repeat_2 = RepeatData(Data=bool_4, Length=expr("x-1", lng_6))
ins_2 = InsertItems(List=repeat_2, Item=bool_5, Indices=0, WTrue=True)  # -> simplify(List)
merge_10 = Merge(Data1=repeat, Data2=ins_2)

# ---- group: Travel every first pt in branch
panel_26 = Panel("1")  # disabled
panel_27 = Panel("0")  # disabled
lng_8 = ListLength(List=move_27.Geometry)  # disabled

# ----
bool_6 = Boolean(panel_27)  # disabled
bool_7 = Boolean(panel_26)  # disabled

# ---- group: Travel every first pt in branch (continued)
repeat_3 = RepeatData(Data=bool_6, Length=expr("x-1", lng_8))  # disabled
ins_3 = InsertItems(List=repeat_3, Item=bool_7, Indices=0, WTrue=True)  # disabled

# ----
panel_28 = Panel(ins_3)  # disabled

split_19 = SplitTree(Data=pl_3pt, Masks=flatten("{0;0;0;0}"))  # -> Positive, Negative
divlength = DivideLength(Curve=simplify(sort.ValuesA), Length=divide_curve_by_length)  # -> Points, Tangents, Parameters
split_20 = SplitTree(Data=divlength.Points, Masks=flatten("{*;(1, 2, ...)}"))  # -> Positive, Negative

# ---- group: Fix first plane
xy_2 = XYPlane(Origin=Point(0, 0, 0))
prot_2 = RotatePlane(Plane=xy_2, Angle=degrees(Slider(90, range=0..100)))
deplane = DeconstructPlane(Plane=prot_2)  # -> Origin, XAxis, YAxis, ZAxis
pl_2 = PlaneNormal(Origin=deplane.Origin, ZAxis=deplane.YAxis)
rotate_11 = Rotate(Geometry=prot_2, Angle=degrees(Slider(180, range=0..1000)), Plane=pl_2)  # -> Geometry, Transform
replace = ReplaceItems(List=split_19.Positive, Item=rotate_11.Geometry, Indices=0, WFalse=False)  # -> simplify(List)
path_mapper_3 = PathMapper(replace, source="{0;0;0;0;0}", target="{0}")

# ----
merge_11 = Merge(Data1=simplify(split_19.Negative), Data2=path_mapper_3)  # -> simplify(Result)
pl_origin = PlaneOrigin(Base=merge_11, Origin=split_20.Positive)
pl_origin_2 = PlaneOrigin(Base=merge_11, Origin=split_20.Negative)
merge_12 = Merge(Data1=pl_origin_2, Data2=pl_origin)
lng_9 = ListLength(List=pl_origin_2)
lng_10 = ListLength(List=pl_origin)
prot_3 = RotatePlane(Plane=merge_12, Angle=degrees(Slider(0, range=-90..90)))
order = PointOrder(Points=prot_3)
repeat_4 = RepeatData(Data=bool_3, Length=lng_9)
repeat_5 = RepeatData(Data=bool_2, Length=lng_10)
merge_13 = Merge(Data1=repeat_4, Data2=repeat_5)  # -> simplify(Result)

panel_29 = Panel(prot_3)
split_21 = SplitTree(Data=prot_3, Masks=flatten("{0;0}"))  # -> Positive, Negative
deplane_2 = DeconstructPlane(Plane=split_21.Positive)  # -> Origin, XAxis, YAxis, ZAxis
pl_3 = PlaneNormal(Origin=deplane_2.Origin, ZAxis=deplane_2.YAxis)
rotate_12 = Rotate(Geometry=split_21.Positive, Angle=degrees(Slider(180, range=0..1000)), Plane=pl_3)  # -> Geometry, Transform
prot_4 = RotatePlane(Plane=rotate_12.Geometry, Angle=degrees(Slider(90, range=0..100)))
merge_14 = Merge(Data1=prot_4, Data2=split_21.Negative)
cull_2 = CullPattern(List=merge_14, CullPattern=[False, False, True, True])
cull_i_2 = CullIndex(List=merge_14, Indices=-1, WTrue=True)
deplane_3 = DeconstructPlane(Plane=rotate_12.Geometry)  # -> Origin, XAxis, YAxis, ZAxis
cull_i_3 = CullIndex(List=merge_13, Indices=-1, WTrue=True)
vdis_2 = VectorDisplay(Anchor=deplane_3.Origin, Vector=deplane_3.ZAxis)

# ---- group: Setup location
X_7 = UnitX(Factor=Slider(250, range=0..800))
Y_2 = UnitY(Factor=Slider(200, range=0..300))
move_29 = Move(Geometry=flatten(cull_i_2), Motion=X_7)  # -> Geometry, Transform
move_30 = Move(Geometry=move_29.Geometry, Motion=Y_2)  # -> Geometry, Transform

# ---- group: Change number to resume print
split_22 = SplitList(List=move_30.Geometry, Index=Slider(0, range=0..10000))  # -> ListA, ListB

# ----
list_item_5 = ListItem(List=crv_18, Index0=0, WrapTrue=True)
boundary_surfaces = BoundarySurfaces(Edges=list_item_5)
area_7 = Area(Geometry=boundary_surfaces)  # -> Area, Centroid

scale_6 = Scale(Center=area_7.Centroid, Factor=0.5)  # -> Geometry, Transform

# ---- group: Add safe_pt
bounding_box = BoundingBox(Content=brep_8, PlaneWorldXY=PlaneXY(0, 0, 0))  # -> Box, Box_2
deconstruct_box = DeconstructBox(Box=bounding_box.Box_2)  # -> Plane, X, Y, Z
deconstruct_domain = DeconstructDomain(Domain=deconstruct_box.Z)  # -> Start, End
multiplication_3 = Multiplication(A=deconstruct_domain.End, B11=1.1)
unit_z_5 = UnitZ(Factor=multiplication_3)
move_31 = Move(Geometry=area_7.Centroid, Motion=unit_z_5)  # -> Geometry, Transform

# ---- group: Add safe_pt / Safe pt
point_10 = Point(move_31.Geometry)

# ----
# Nizar slicer
# Generate base
perp_frames = PerpFrames(Curve=graft(line_3), Count=merge_5, AlignTrue=True)  # -> Frames, Parameters
circle_15 = Circle(Plane=perp_frames.Frames, Radius=radius_pipe)
list_item_6 = ListItem(List=perp_frames.Frames, Index0=0, WrapTrue=True)
divide_length_3 = DivideLength(Curve=crv_18, Length=distance_between_points_mm_2)  # -> Points, Tangents, Parameters

# ---- group: Adjust seam
curve_closest_point = CurveClosestPoint(Point=area_7.Centroid, Curve=circle_15)  # -> Point, Parameter, Distance
seam_2 = Seam(Curve=circle_15, Seam=curve_closest_point.Parameter)
end_points_2 = EndPoints(Curve=seam_2)  # -> Start, End
list_item_7 = ListItem(List=seam_2, Index=Slider(53, range=0..60), WrapTrue=True)

# ----
item_6 = ListItem(List=seam_2, Index=0, WTrue=True)
item_7 = ListItem(List=perp_frames.Frames, Index=0, WTrue=True)
area_8 = Area(Geometry=item_6)  # -> Area, Centroid
pl_origin_3 = PlaneOrigin(Base=item_7, Origin=area_8.Centroid)
rotate_13 = Rotate(Geometry=item_6, Angle=degrees(Slider(180, range=0..1000)), Plane=pl_origin_3)  # -> Geometry, Transform
ins_4 = InsertItems(List=seam_2, Item=rotate_13.Geometry, Indices=1, WTrue=True)

divide_length_4 = DivideLength(Curve=ins_4, Length=distance_between_points_mm_2)  # -> simplify(Points), Tangents, Parameters

order_2 = PointOrder(Points=flatten(divide_length_4.Points))

# ---- group: Add safe_pt (continued)
trim_tree = TrimTree(Tree=divide_length_4.Points, Depth1=1)
insert_items = InsertItems(List=trim_tree, Item=point_10, Indices="-1", WrapTrue=True)

# ----
circle_16 = Circle(Plane=list_item_6, Radius=radius_pipe)
surface_4 = Surface(circle_16)
extrude = Extrude(Base=flatten(surface_4), Direction=line_3)

volume_2 = Volume(Geometry=extrude)  # -> Volume, Centroid
scale_7 = Scale(Geometry=extrude, Center=volume_2.Centroid, Factor=1.01)  # -> Geometry, Transform

ghpython_script_2 = GhPythonScript(breps=scale_7.Geometry, pts=divide_length_3.Points)  # -> out, pts; inputs breps: list of Brep, pts: list of Point3d
# ---------- ghpython_script_2: Python ----------
__author__ = "admin"
__version__ = "2019.11.12"
import Rhino.Geometry as rg

new_pts = []

for i, brep in enumerate(breps):
    for j in range(len(pts)):
        check = breps[i].IsPointInside(pts[j],0.01, False)
        if check == True:
            new_pts.append(pts[j])
            
for i in range(len(new_pts)):
    if new_pts[i] in pts:
        pts.remove(new_pts[i] )
# ---------- end ghpython_script_2 ----------
point_11 = Point(simplify(ghpython_script_2.pts))

crv_22 = Curve(circle_16)
area_9 = Area(Geometry=crv_22)  # -> Area, Centroid
avr_3 = Average(Input=flatten(area_9.Centroid))
crv_cp_2 = CurveClosestPoint(Point=avr_3, Curve=crv_22)  # -> Point, Parameter, Distance
seam_3 = Seam(Curve=crv_22, Seam=crv_cp_2.Parameter)
end_8 = EndPoints(Curve=seam_3)  # -> Start, End
rotate_14 = Rotate(Geometry=end_8.Start, Angle=degrees([number_slider_44, neg]), Plane=list_item_6)  # -> Geometry, Transform
conmesh = ConstructMesh(Vertices=flatten(rotate_14.Geometry), Faces={A=0, B=1, C=2, D=3})
medges = MeshEdges(Mesh=conmesh)  # -> NakedEdges, InteriorEdges, NonManifoldEdges
join = JoinCurves(Curves=medges.NakedEdges, Preserve=False)
polyoffset = PolylineOffset(
    Polylines=join,
    Distance=series_11,
    PlnNullPlane=Plane(origin=(0, 0, 0), x=(0, 0, 0), y=(0, 0, 0)),
    Tolerance=0.01,
    ClosedFillet=1,
    OpenFillet=1,
    Miter=2)  # -> Contour, Holes
crv_23 = Curve(polyoffset.Holes)
divdist_7 = DivideDistance(Curve=crv_23, Distance=distance_between_points_mm_2)  # -> simplify(Points), Tangents, Parameters
path_mapper_4 = PathMapper(divdist_7.Points, source="{a}", target="{1;a}")
lng_11 = ListLength(List=path_mapper_4)
repeat_6 = RepeatData(Data=bool, Length=lng_11)
trim = TrimTree(Tree=repeat_6, Depth=2)
panel_30 = Panel(trim)

point_12 = Point(simplify(insert_items))

# ----
# Triple branches, Nizar's setup
pl_origin_4 = PlaneOrigin(Base=simplify(perp_frames.Frames), Origin=insert_items)  # -> simplify(Plane)
xy_3 = XYPlane(Origin=point_11)
path_mapper_5 = PathMapper(xy_3, source="{a}", target="{0;a}")

prot_5 = RotatePlane(Plane=pl_origin_4, Angle=degrees(-90))
split_23 = SplitList(List=prot_5, Index=Slider(1000, range=0..10000))  # -> ListA, ListB
pln_7 = Plane(simplify(split_23.ListA))

path_mapper_6 = PathMapper(pln_7, source="{a}", target="{2;a}")
merge_15 = Merge(Data1=path_mapper_5, Data2=path_mapper_6)

pt_36 = Point(merge_15)

# ---- group: Travel on longer moves
python_2 = GhPythonScript(points=path_mapper_5)  # -> out, distance_next_pt; inputs points: list of Point3d
# ---------- python_2: Python ----------
__author__ = "tetov"
__version__ = "2019.11.14"

import Rhino.Geometry as rg

distances = []

for i, pt in enumerate(points):
    if i != len(points)-1:
        dist = pt.DistanceTo(points[i+1])
        
    else:
        dist = pt.DistanceTo(points[1])
    distances.append(dist)
        
distance_next_pt = distances
# ---------- end python_2 ----------
num = Number(python_2.distance_next_pt)
larger = LargerThan(FirstNumber=num, SecondNumber=expr("x*2", distance_between_points_mm_2))  # -> LargerThan, OrEqualTo
shift = ShiftList(List=larger.LargerThan, Shift=-1, WTrue=True)  # -> flatten(List)

# ----
# Travel last pt for first branch
# Travel first & last for rest
panel_31 = Panel("0")
lng_12 = ListLength(List=path_mapper_6)
bool_8 = Boolean(panel_31)
panel_32 = Panel("{0}")
bool_9 = Boolean("1")
repeat_7 = RepeatData(Data=bool_8, Length=lng_12)  # -> simplify(Data)
lng_13 = ListLength(List=repeat_7)  # -> expr("x-1", Length)
lng_14 = ListLength()  # -> expr("x-1", Length)
ins_5 = InsertItems(List=lng_13, Item="0", Indices=0, WTrue=True)
replace_2 = ReplaceItems(Item=bool_9, Indices=lng_14, WTrue=True)
replace_3 = ReplaceItems(List=repeat_7, Item=bool_9, Indices=ins_5, WTrue=True)  # -> simplify(List)
trim_2 = TrimTree(Tree=replace_2, Depth=1)
merge_16 = Merge(Data1=trim_2, Data2=simplify(replace_3))  # -> flatten(Result)
path_mapper_7 = PathMapper(merge_16, source="{a}", target="{a+2}")

merge_17 = Merge(Data1=path_mapper_4, Data2=merge_15)
trim_3 = TrimTree(Tree=merge_17, Depth=1)

# ---- group: Output travel
merge_18 = Merge(Data1=simplify(shift), Data2=path_mapper_7, Data3=trim)

# ---- group: Output geo
pln_8 = Plane(trim_3)

# ----
# Setup height
number_slider_72 = Slider(40, range=0..40)
Z_17 = UnitZ(Factor=number_slider_72)
move_32 = Move(Geometry=flatten(split_22.ListB), Motion=Z_17)  # -> Geometry, Transform
number_slider_73 = Slider(135, range=-360..360)

# ---- group: Fabrication planes
pln_9 = Plane(flatten(move_32.Geometry))

# ----
pln_10 = Plane(flatten(pln_9))
rotate_15 = Rotate(Geometry=pln_10, Angle=degrees(number_slider_73), Plane=pln_10)  # -> Geometry, Transform

# ----
# safe_pt
number_slider_74 = Slider(180, range=0..1000)
pt_37 = Point(Point(268.5856153, 328.9320659, 281.5630479))
xy_4 = XYPlane(Origin=pt_37)
rotate_16 = Rotate(Geometry=xy_4, Angle=degrees(number_slider_73), Plane=xy_4)  # -> Geometry, Transform

# ---- group: Create commands
safe_speed = Slider(25, range=0..300)
speed = Slider(25, range=0..300)
planes_wcs = Plane(rotate_15.Geometry)
python_3 = PythonScript(
    planes_WCS=planes_wcs,
    travel=flatten(cull_i_3),
    dfillet=Slider(50, range=0..100),
    speed=speed,
    safe_speed=safe_speed,
    safe_pt=rotate_16.Geometry)  # -> commands; inputs planes_WCS: list of Plane, travel: list, speed: Int32, safe_pt: Plane
# ---------- python_3: Python ----------
import Rhino.Geometry as rg
from compas.geometry import Frame
from compas.geometry import Transformation
from scriptcontext import sticky as st


robot = st["robot"]
import Rhino.Geometry as rg
from compas.geometry import Frame
from compas.geometry import Transformation
from scriptcontext import sticky as st


robot = st["robot"]
buffer = 0.5

commands = []

def generate_cmds(planes_WCS, travel, dfillet, speed, safe_speed, safe_pt):

    # add safe_pt as a starting point
    tcp_WCS_safe_pt = Frame(safe_pt.Origin, safe_pt.XAxis, safe_pt.YAxis)

    tcp_RCS_safe_pt = robot.get_frame_in_RCS(tcp_WCS_safe_pt)
    cmd_safe_pt = list(tcp_RCS_safe_pt.point) + tcp_RCS_safe_pt.axis_angle_vector + [safe_speed, 0, True]
    commands.append(cmd_safe_pt)


    # TODO this must be optimized! matrix multiplication!

    for i, plane_WCS in enumerate(planes_WCS):
        tcp_WCS = Frame(plane_WCS.Origin, plane_WCS.XAxis, plane_WCS.YAxis)
        if i == 0 or i == len(planes_WCS) - 1:
            radius = 0.

        else:
            # calculate blend radius
            prev, current, next = planes_WCS[i-1].Origin, planes_WCS[i].Origin, planes_WCS[i+1].Origin
            # print((prev - current).Length/2 * buffer, (next - current).Length/2 * buffer, dfillet)
            radius = min((prev - current).Length/2 * buffer, (next - current).Length/2 * buffer, dfillet)
            radius = round(radius,5)
        print(radius)
        # print()


        tcp_RCS = robot.get_frame_in_RCS(tcp_WCS)
        cmd = list(tcp_RCS.point) + tcp_RCS.axis_angle_vector + [speed, radius, travel[i]]

        commands.append(cmd)


    # add safe_pt as an end point
    commands.append(cmd_safe_pt)
    return commands

if len(travel) in range(0,1):
    travel = [False] * len(planes_WCS)
elif len(travel) != len(planes_WCS):
    raise ValueError('Mismatch between numbers of planes and travel booleans')

commands = generate_cmds(planes_WCS, travel, dfillet, speed, safe_speed, safe_pt)

print commands[0]
# ---------- end python_3 ----------

# ----
dispatch_2 = Dispatch(List=rotate_15.Geometry, DispatchPattern=flatten(cull_i_3))  # -> ListA, ListB

# ---- group: Create commands
py_2 = PythonScript()  # -> path
# ---------- py_2: Python ----------
import sys
import os

ghComp = ghenv.Component
ghDoc = ghComp.OnPingDocument()

# the full path of the gh file
path = ghDoc.FilePath
# the directory of the gh file
path = os.path.dirname(path)

path = os.path.abspath(os.path.join(path, ".."))

print path
# ---------- end py_2 ----------
continue_fabrication = BooleanToggle(True)
panel_33 = Panel(py_2)
save_json = Button()
start_safe_pt = BooleanToggle(False)
commands = Data(python_3)
send_9 = PythonScript(
    path=panel_33,
    continue_fabrication=continue_fabrication,
    commands=commands,
    start_at_safe_pt=start_safe_pt,
    save_json=save_json,
    name_json="commands_group_04.json")  # -> out; inputs continue_fabrication: Int32, commands: list, start_at_safe_pt: Boolean
# ---------- send_9: Python ----------
import json
import os

from mini_eggshell.ur_online_control.communication.msg_identifiers import *
from mini_eggshell.ur_online_control.utilities.lists import flatten_list
from time import sleep

#number of values per command to be formatted 
len_command = len(commands[0])
gh_commands = flatten_list(commands)


#to print in gh panel
print len_command, "values each command"
print len(gh_commands)/len_command, "commands." , len(gh_commands), "values"

if start_at_safe_pt is None: start_at_safe_pt = True

if start_at_safe_pt:
    print "Starting at safe point"
else:
    print "Starting at first frame of geometry"


data = {}
data['start_at_safe_pt'] = start_at_safe_pt
data['len_command'] = len_command
data['gh_commands'] = gh_commands


filename = os.path.join(path, name_json)
if save_json:
    with open(filename, 'w') as f:
        json.dump(data, f)
# ---------- end send_9 ----------

# 3
# 1
pln_11 = Plane(planes_wcs)
panel_34 = Panel(send_9)
item_8 = ListItem(List=pln_11, Index=0, WTrue=True)  # -> Item1, Item, Item1_2
merge_19 = Merge(Data1=rotate_16.Geometry, Data2=pln_11)
pln_12 = Plane([item_8.Item, item_8.Item1_2])

# ----
preview = CustomPreview(Geometry=dispatch_2.ListB, Material=ColourSwatch(SwatchColor=RGB(0, 98, 255)))
order_3 = PointOrder(Points=rotate_15.Geometry)
preview_2 = CustomPreview(Geometry=dispatch_2.ListA, Material=ColourSwatch(SwatchColor=RGB(0, 255, 111)))

# ---- group: Send commands / Send joint position directly to robot
panel_35 = Panel("move cartesian")
idx = Slider(0, range=0..100)
commands_2 = Data(python_3)
item_9 = ListItem(List=commands_2, Index=idx, WTrue=True)
list_4 = ValueList({"send all positions": 0, "send only one position": 1}, selected="send only one position")
filter = StreamFilter(Gate=list_4, Stream0=commands_2, Stream1=item_9)
movel_4 = PythonScript(commands=filter, velocity=Slider(100, range=0..100))  # -> script; inputs commands: list
# ---------- movel_4: Python ----------
from scriptcontext import sticky as st

script_lines = []
for cmd in commands:
    #q, a=1.4, v=1.05, t=0, r=0)
    x, y, z, ax, ay, az, speed, radius = cmd
    script_lines.append("movel(p%s, v=%f, r=%f)" % (str([x/1000., y/1000., z/1000, ax, ay, az]), speed/1000., radius/1000.))

robot = st["robot"]
tool_angle_axis = list(robot.tool.tcp_frame.point) + robot.tool.tcp_frame.axis_angle_vector
x, y, z, ax, ay, az = tool_angle_axis

script = "def prog():\n"
script += "\ttextmsg(\">> program start\")\n"
script += "\tset_tcp(p%s)\n" % str([x/1000., y/1000., z/1000, ax, ay, az])
script += "".join(["\t%s\n" % line for line in script_lines])
script += "\ttextmsg(\"<< program end\")\n"
script += "end\n"
script += "prog()\n\n"

print script
# ---------- end movel_4 ----------
send_10 = Button()
send_11 = Send(script=movel_4, send=send_10)
panel_36 = Panel(send_11)

# ----
# Settings
# 1. load robot model
# 2. set tool
# 3. set basis
# 1. load robot model
# 2. set tool
# 3. set basis
nozzle_distance_from_holder = Slider(50.7, range=0..100)
list_5 = ValueList({"no_tool": 0, "plastic_extruder": 1, "clay_extruder": 2, "clay_extruder_SS": 3, "clay_extruder_SS_alu": 4}, selected="clay_extruder_SS")
base_2 = PythonScript()  # -> base_frame, base
# ---------- base_2: Python ----------
from compas.geometry import Frame

"""
origin = [0, 0, 0]
xaxis = [1, 0, 0]
yaxis = [0, 1, 0]


origin = [-313.92, -147.58, 13.79]
xaxis = [0.00000, -1.00000, 0.00000]
yaxis = [1.00000, 0.00000, 0.00000]
"""

#axis    Y         Z                        X

origin = [-14.89, -373.34, -469.74]
xaxis = [-0.00473, -0.99998, -0.00304]
yaxis = [0.99998, -0.00474, 0.00418]

base_frame = Frame(list(origin), list(xaxis), list(yaxis))

base = "base = " + str(origin) + "\n"
# ---------- end base_2 ----------
panel_37 = Panel(base_2.base)
list_6 = ValueList({"UR5", "UR10"}, selected="UR5")

subtraction_3 = Subtraction(A=nozzle_distance_from_holder, B=number_slider_72)

tools = Tools(tool_id=list_5, nozzle_distance_from_holder=subtraction_3)
robot = PythonScript(model=list_6, tool=tools, base_frame=base_2.base_frame)  # -> robot
# ---------- robot: Python ----------
from mini_eggshell.ur_online_control.ur.ur10 import UR10
from mini_eggshell.ur_online_control.ur.ur5 import UR5
from scriptcontext import sticky as st

if model == "UR5":
    robot = UR5()
elif model == "UR10":
    robot = UR10()

if tool:
    robot.set_tool(tool)
if base_frame:
    robot.set_base(base_frame)

st["robot"] = robot
# ---------- end robot ----------

# ----
# 2
# Visualisation
planes_wcs_2 = Plane(pln_12)
robot_2 = Data(robot)
pose_joints = Data(pose_2)

# ----
# Add init joint states
joint_states = Data([-0.1728179112, -1.415058186, 1.813991282, -1.971940356, -1.571654205, -3.308720436])
init_configuration = Slider(2, range=0..7)
py_3 = PythonScript(robot=robot_2, planes_WCS=planes_wcs_2, configuration_idx=init_configuration, init_configuration=joint_states)  # -> configurations; inputs planes_WCS: list, configuration_idx: Int32, init_configuration: list
# ---------- py_3: Python ----------
from compas_ghpython import unload_modules
unload_modules('ur_online_control')
import Rhino.Geometry as rg
from compas.geometry import Frame 
from compas.geometry.xforms import Transformation
#from compas_ghpython import xdraw_frame
from ur_online_control.ur.kinematics import calculate_configurations_for_path, format_joint_positions


# TODO this must be optimized! matrix multiplication!
frames_tool0_RCS = []
for plane_WCS in planes_WCS:
    tcp_WCS = Frame(plane_WCS.Origin, plane_WCS.XAxis, plane_WCS.YAxis)
    tcp_RCS = robot.get_frame_in_RCS(tcp_WCS)
    frames_tool0_RCS.append(robot.get_tool0_frame_from_tcp_frame(tcp_RCS))
    

#configurations = calculate_configurations_for_path(frames_tool0_RCS, robot.params, init_configuration)
configurations = calculate_configurations_for_path(frames_tool0_RCS, robot, init_configuration)
print configurations
configurations = configurations[min([configuration_idx, len(configurations) - 1])]

def format(numbers, k=4):
    #numbers = format_joint_positions(numbers)
    return "[" + ", ".join([("%." + str(k) + "f") % n for n in numbers]) + "]"
# ---------- end py_3 ----------
start = Button()
stop_3 = Button()
step = Button()
back = Button()
reset = Button()
counter = CountThroughList(L=py_3, start=start, stop=stop_3, step=step, step_back=back, reset=reset, interval=50)  # -> item; inputs L: list, start: Boolean, stop: Boolean, step_back: Boolean
# ---------- counter: Python ----------
from scriptcontext import sticky as st
from compas_ghpython import update_component


# store data in component
guid = str(ghenv.Component.InstanceGuid)
counter_key = "counter_" + guid
running_key = "running_" + guid

if counter_key not in st:
    st[counter_key] = 0

if running_key not in st:
    st[running_key] = False

if start:
    st[running_key] = True

if stop:
    st[running_key] = False

if step:
    if st[counter_key] < len(L) - 1:
        st[counter_key] += 1

if step_back:
    if st[counter_key] < len(L) - 1:
        st[counter_key] -= 1

if reset:
    st[counter_key] = 0

if len(L):
    item = L[st[counter_key]]

if st[running_key]:
    if st[counter_key] < len(L) - 1:
        st[counter_key] += 1
        update_component(ghenv, interval)
    else:
        st[counter_key] = 0
        st[running_key] = False
# ---------- end counter ----------

pt_38 = Point(Point(-283.8412985, -342.877576, 297.4189147))
select_configuration = Slider(1, range=0..7)
xy_5 = XYPlane(Origin=pt_38)
plane_wcs = Plane(xy_5)
inverse = PythonScript(robot=robot_2, plane_WCS=plane_wcs, idx=select_configuration)  # -> configuration; inputs plane_WCS: Plane, idx: Int32
# ---------- inverse: Python ----------
import Rhino.Geometry as rg
from compas.geometry import Frame, Transformation
#from compas_ghpython import xdraw_frame

tcp_WCS = Frame(plane_WCS.Origin, plane_WCS.XAxis, plane_WCS.YAxis)

# transform frame to robot coordinate system
tcp_RCS = robot.get_frame_in_RCS(tcp_WCS)

# get the frame of tool0
tool0_RCS = robot.get_tool0_frame_from_tcp_frame(tcp_RCS)

# calculate solutions to frame
solutions = robot.inverse_kinematics(tool0_RCS)

if not len(solutions):
    q = [0,0,0,0,0,0]
else:
    idx = min(len(solutions) - 1, idx)
    q = solutions[idx]
    
print q

configuration = q
# ---------- end inverse ----------

# ---- group: Shows joint positions along path
flip_2 = BooleanToggle(True)
l2t = PythonScript(L=py_3, flip=flip_2)  # -> T; inputs L: list, flip: Boolean
# ---------- l2t: Python ----------
from compas_ghpython import list_to_ghtree
L = [l.joint_values for l in L]

if flip:
    L = zip(*L)
T = list_to_ghtree(L)
# ---------- end l2t ----------
graph_2 = QuickGraph(l2t, SortOrder=0)

# ---- group: robot model brep
py_4 = PythonScript(model=list_6)  # -> n
# ---------- py_4: Python ----------
if model == "UR5":
    n = 0
if model == "UR10":
    n = 1

print n
# ---------- end py_4 ----------
ur10_brep = UR10Brep([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])
ur5_brep = UR5Brep([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])
show_brep = BooleanToggle(False)
filter_2 = StreamFilter(Gate=py_4, Stream0=ur5_brep, Stream1=ur10_brep)

# ----
py_5 = GhPythonScript(joint_values=ur1_q1_q6)  # -> configuration; inputs joint_values: list
# ---------- py_5: Python ----------
import math
from ur_online_control.ur.robot import BaseConfiguration

configuration = BaseConfiguration.from_joints([math.radians(d) for d in joint_values])
# ---------- end py_5 ----------
list_7 = ValueList({"0 forward, from angles": 0, "1 inverse, from one plane": 1, "2 inverse, from multiple planes": 2, "3 forward, from robot": 3}, selected="2 inverse, from multiple planes")
filter_3 = StreamFilter(Gate=list_7, Stream0=py_5, Stream1=inverse, Stream2=counter, Stream3=pose_joints)
configuration = Panel(filter_3)
mesh_5 = Mesh(filter_2)
draw = PythonScript(robot=robot_2, configuration=filter_3, mesh=mesh_5, brep=filter_2, show_brep=show_brep)  # -> meshes, tool0_plane, tcp_plane, robot_brep; inputs mesh: list, brep: list
# ---------- draw: Python ----------
from compas_ghpython import unload_modules
unload_modules("ur_online_control")

#from compas_ghpython import xdraw_frame
from compas_ghpython import mesh_draw
from compas_ghpython.geometry.xforms import xform_from_transformation
from compas.geometry import Frame
from compas.geometry.xforms import Transformation
from mini_eggshell.ur_online_control.ur.robot import BaseConfiguration

import Rhino.Geometry as rg
import Rhino

def mesh_update_vertices(mesh, vertices):
    for i in range(len(vertices)):
        mesh.vertex[i].update({'x': vertices[i][0], 'y': vertices[i][1], 'z': vertices[i][2]})

if configuration:
    #print configuration
    #q = BaseConfiguration.from_joints(configuration)
    q = configuration
    print q
    print q.joint_values
    
    print robot.get_forward_transformations(q)
    R0, R1, R2, R3, R4, R5 = robot.get_forward_transformations(q)
    
    tool0_frame2 = robot.tool0_frame.transformed(R5)
    tcp_frame2 = Frame.from_transformation(Transformation.from_frame(tool0_frame2) * robot.transformation_tool0_tcp)
    
    print robot.transformation_tool0_tcp
    print robot.transformation_tcp_tool0
    print robot.transformation_tool0_tcp * robot.transformation_tcp_tool0
    print tcp_frame2
    tcp_frame2 = Frame.from_transformation(Transformation.from_frame(tool0_frame2) * robot.transformation_tcp_tool0)
    print tcp_frame2
    
    tool0_frame, tcp_frame = robot.get_transformed_tool_frames(R5)
    
    tool0_frame = tool0_frame2
    tcp_frame = tcp_frame2
    
    m0, m1, m2, m3, m4, m5 = mesh
    for i in range(6):
        exec("R%drg = xform_from_transformation(R%d)" % (i, i))
        exec("m%d.Transform(R%drg)" % (i, i))
    meshes = [m0, m1, m2, m3, m4, m5]
    print meshes
    mt = robot.tool.get_transformed_model(Transformation.from_frame(tool0_frame))
    
    if mt:
        meshes.extend(map(mesh_draw, mt))
    
    """
    m0, m1, m2, m3, m4, m5, tool0_frame, tcp_frame = robot.get_transformed_model(q)
    mt = robot.get_transformed_tool_model(tcp_frame)
    
    meshes = []
    meshes.append(mesh_draw(m0))
    meshes.append(mesh_draw(m1))
    meshes.append(mesh_draw(m2))
    meshes.append(mesh_draw(m3))
    meshes.append(mesh_draw(m4))
    meshes.append(mesh_draw(m5))
    if mt:
        meshes.append(mesh_draw(mt))
    
    """
    
#    tool0_plane = xdraw_frame(tool0_frame)
#    tcp_plane = xdraw_frame(tcp_frame)
    
    if show_brep:
        
        b0, b1, b2, b3, b4, b5 = brep
        
        b0.Transform(R0rg)
        b1.Transform(R1rg)
        b2.Transform(R2rg)
        b3.Transform(R3rg)
        b4.Transform(R4rg)
        b5.Transform(R5rg)
        
        robot_brep = [b0, b1, b2, b3, b4, b5]
# ---------- end draw ----------
robot_brep = Brep(draw.robot_brep)
tool0_plane = Plane(draw.tool0_plane)
tcp_plane = Plane(draw.tcp_plane)
draw_2 = RepresentPlaneAsLines(plane=tcp_plane, size=100)  # -> G, C
# ---------- draw_2: Python ----------
import Rhino.Geometry as rg
from System.Drawing import Color

if plane:

    G = []
    G.append(rg.Line(plane.Origin, size * plane.XAxis))
    G.append(rg.Line(plane.Origin, size * plane.YAxis))
    G.append(rg.Line(plane.Origin, size * plane.ZAxis))
    
    C = []
    C.append(Color.FromArgb(255, 0, 0))
    C.append(Color.FromArgb(0, 255, 0))
    C.append(Color.FromArgb(0, 0, 255))
# ---------- end draw_2 ----------
preview_3 = CustomPreview(Geometry=draw_2.G, Shader=draw_2.C)
preview_4 = CustomPreview(Geometry=draw.meshes, Shader=ColourSwatch(SwatchColor=RGBA(99, 94, 94, 96)))

mesh_6 = Mesh(draw.meshes)
item_10 = ListItem(List=mesh_6, Index=-1, WTrue=True)
bbox = BoundingBox(Content=mesh_6, PWorldXY=PlaneXY(0, 0, 0), UnionBox=True)  # -> Box, Box_2
debox = DeconstructBox(Box=bbox.Box)  # -> Plane, X, Y, Z
panel_38 = Panel(debox.Z)

# ---- group: Send commands / Send joint position directly to robot
idx_2 = Slider(0, range=0..100)
panel_39 = Panel("move joints")
joint_positions = Data(py_3)
list_8 = ValueList({"send all positions": 0, "send only one position": 1}, selected="send only one position")
item_11 = ListItem(List=joint_positions, Index=idx_2, WTrue=True)
filter_4 = StreamFilter(Gate=list_8, Stream0=joint_positions, Stream1=item_11)
movej = PythonScript(joint_positions=filter_4, velocity=Slider(153, range=0..200))  # -> script; inputs joint_positions: list
# ---------- movej: Python ----------
script_lines = []

for position in joint_positions:
    script_lines.append("movej(%s, v=%f)" % (str(position), velocity/1000.))


script = "def prog():\n"
script += "\ttextmsg(\">> program start\")\n"
script += "".join(["\t%s\n" % line for line in script_lines])
script += "\ttextmsg(\"<< program end\")\n"
script += "end\n"
script += "prog()\n\n"


print script

#script = ""
# ---------- end movej ----------
send_12 = Button()

# ---- group: Send commands
send_13 = Send(script=movej, send=send_12)

# ---- group: Send commands / Send joint position directly to robot (continued)
panel_40 = Panel(send_13)

# ==== cluster Send
script = ClusterInput()
send = ClusterInput()
send_2 = PythonScript(script=script, send=send)  # -> out
# ---------- send_2: Python ----------
import socket
from scriptcontext import sticky as st

ur_ip = st['ur_ip']
ur_port = 30002

if send:
    s = socket.create_connection((ur_ip, ur_port), timeout=0.5) 
    s.send(script)
    s.close()
# ---------- end send_2 ----------
out = ClusterOutput(send_2)

# ==== cluster Tools
nozzle_distance_from_holder = ClusterInput()
tool_id = ClusterInput()
number_slider = Slider(180, range=0..1000)

# ---- group: plastic_extruder
brep = Brep([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])
xaxis_line = Curve(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)
yaxis_line = Curve(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)
test_geometry = Geometry(brep)
mesh = Mesh(test_geometry)
brep_2 = Brep(test_geometry)
tool = Tool(meshes=mesh, breps=brep_2, G=xaxis_line, G_2=yaxis_line)

# ---- group: no_tool
brep_3 = Brep(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)
yaxis_line_2 = Curve(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)
xaxis_line_2 = Curve(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)
test_geometry_2 = Geometry(brep_3)
mesh_2 = Mesh(test_geometry_2)
brep_4 = Brep(test_geometry_2)
tool_2 = Tool(meshes=mesh_2, breps=brep_4, G=xaxis_line_2, G_2=yaxis_line_2)

# ---- group: clay_extruder
brep_5 = Brep([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])
yaxis_line_3 = Curve(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)
xaxis_line_3 = Curve(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)
test_geometry_3 = Geometry(brep_5)
mesh_3 = Mesh(test_geometry_3)
brep_6 = Brep(test_geometry_3)
tool_3 = Tool(meshes=mesh_3, breps=brep_6, G=xaxis_line_3, G_2=yaxis_line_3)

# ---- group: clay_extruder_SS
brep_7 = Brep([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])
yaxis_line_4 = Curve(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)
xaxis_line_4 = Curve(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)
test_geometry_4 = Geometry(brep_7)
mesh_4 = Mesh(test_geometry_4)
brep_8 = Brep(test_geometry_4)
tool_4 = Tool(meshes=mesh_4, breps=brep_8, G=xaxis_line_4, G_2=yaxis_line_4, nozzle_distance_from_holder=nozzle_distance_from_holder)

# ----
tool_id_2 = Integer(tool_id)

# ---- group: clay_extruder_SS_alu_can
brep_9 = Brep([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])
xaxis_line_5 = Curve(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)
yaxis_line_5 = Curve(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)

# ----
rotate = Rotate(Geometry=brep_9, Angle=degrees(number_slider), Plane=PlaneXY(0, 0, 0))  # -> Geometry, Transform
rotate_2 = Rotate(Geometry=xaxis_line_5, Angle=degrees(number_slider), Plane=PlaneXY(0, 0, 0))  # -> Geometry, Transform
rotate_3 = Rotate(Geometry=yaxis_line_5, Angle=degrees(number_slider), Plane=PlaneXY(0, 0, 0))  # -> Geometry, Transform

# ---- group: clay_extruder_SS_alu_can (continued)
test_geometry_5 = Geometry(rotate.Geometry)
mesh_5 = Mesh(test_geometry_5)
brep_10 = Brep(test_geometry_5)
tool_5 = Tool(
    meshes=mesh_5,
    breps=brep_10,
    G=rotate_2.Geometry,
    G_2=rotate_3.Geometry,
    nozzle_distance_from_holder=nozzle_distance_from_holder)

# ----
filter = StreamFilter(Gate=tool_id_2, Stream1=tool, Stream2=tool_3, Stream3=tool_4, Stream4=tool_5)
py = PythonScript(tool=filter)  # -> tcp_frame, model
# ---------- py: Python ----------
from compas_ghpython import mesh_draw 

tcp_frame = tool.tcp_frame
model = map(mesh_draw, tool.model)
# ---------- end py ----------
tool_6 = Data(filter)
draw = PythonScript(frame=py.tcp_frame)  # -> G, C
# ---------- draw: Python ----------
import Rhino.Geometry as rg
from System.Drawing import Color

if not size:
    size = 100

if frame:
    plane = rg.Plane(rg.Point3d(*list(frame.point)), rg.Vector3d(*list(frame.xaxis)), rg.Vector3d(*list(frame.yaxis)))

    G = []
    G.append(rg.Line(plane.Origin, size * plane.XAxis))
    G.append(rg.Line(plane.Origin, size * plane.YAxis))
    G.append(rg.Line(plane.Origin, size * plane.ZAxis))
    
    C = []
    C.append(Color.FromArgb(255, 0, 0))
    C.append(Color.FromArgb(0, 255, 0))
    C.append(Color.FromArgb(0, 0, 255))
# ---------- end draw ----------
tool_7 = ClusterOutput(tool_6)
preview = CustomPreview(Geometry=draw.G, Shader=draw.C)
preview_2 = CustomPreview(Geometry=py.model, Shader=ColourSwatch(SwatchColor=RGB(141, 170, 178)))

# ==== cluster Cluster
distance_between_points = ClusterInput()
distance_from_z0 = ClusterInput()
end_plane_rotation = ClusterInput()
layer_height = ClusterInput()
C = ClusterInput()
bbox = BoundingBox(Content=C, PWorldXY=PlaneXY(0, 0, 0))  # -> Box, Box_2
debrep = DeconstructBrep(Brep=bbox.Box)  # -> reverse(Faces), Edges, Vertices

debox = DeconstructBox(Box=bbox.Box)  # -> Plane, X, Y, Z
dedomain = DeconstructDomain(Domain=debox.Y)  # -> Start, End
dedomain_2 = DeconstructDomain(Domain=debox.X)  # -> Start, End
dedomain_3 = DeconstructDomain(Domain=debox.Z)  # -> Start, End
max = Maximum(A=dedomain_2.End, B=dedomain.End)
min = Minimum(A=dedomain_2.Start, B=dedomain.Start)
abs = Absolute(Value=dedomain_3.Start)
abs_2 = Absolute(Value=min)
addition = Addition(A=abs, B=dedomain_3.End)
addition_2 = Addition(A=abs_2, B=max)
multiplication = Multiplication(A=addition, B15=1.5)
multiplication_2 = Multiplication(A=addition_2, B15=1.5)
division = Division(A=multiplication, B=layer_height)
round = Round(Number=division)  # -> Nearest, Floor, Ceiling
Z = UnitZ(Factor=1)
spiral = Spirale(
    AxisStart=Point(0, 0, 0),
    AxisDirection=Z,
    HelixStart=Point(0, 1, 0),
    Pitch=layer_height,
    TurnCount=round.Floor,
    R1=multiplication_2,
    R2=multiplication_2)

area = Area(Geometry=debrep.Faces)  # -> Area, Centroid
scale = Scale(Geometry=debrep.Faces, Center=area.Centroid, Factor=Slider(2, range=0..10))  # -> Geometry, Transform
item = ListItem(List=scale.Geometry, Index=0, WTrue=True)  # -> Item, Item1

srf = Surface(item.Item1)
Z_2 = UnitZ(Factor=distance_from_z0)
move = Move(Geometry=srf, Motion=Z_2)  # -> Geometry, Transform

debrep_2 = DeconstructBrep(Brep=move.Geometry)  # -> Faces, Edges, Vertices
item_2 = ListItem(List=debrep_2.Vertices, Index=0, WTrue=True)  # -> Item, Item1, Item2, Item3
crv = Curve(spiral)
bbox_2 = BoundingBox(Content=crv, PWorldXY=PlaneXY(0, 0, 0))  # -> Box, Box_2
mesh = Mesh(C)
bbox_3 = BoundingBox(Content=mesh, PWorldXY=PlaneXY(0, 0, 0))  # -> Box, Box_2
xy = XYPlane(Origin=Point(0, 0, 0))
xz = XZPlane(Origin=Point(0, 0, 0))
volume = Volume(Geometry=bbox_3.Box_2)  # -> Volume, Centroid

area_2 = Area(Geometry=item.Item)  # -> Area, Centroid
neg = Negative(Value=end_plane_rotation)
xz_2 = XZPlane(Origin=area_2.Centroid)
rotate = Rotate(Geometry=item.Item, Angle=degrees(neg), Plane=xz_2)  # -> Geometry, Transform
Z_3 = UnitZ(Factor=Slider(23, range=0..100))

neg_2 = Negative(Value=Z_3)

move_2 = Move(Geometry=rotate.Geometry, Motion=neg_2)  # -> Geometry, Transform

debrep_3 = DeconstructBrep(Brep=move_2.Geometry)  # -> Faces, Edges, Vertices
item_3 = ListItem(List=debrep_3.Vertices, Index=0, WTrue=True)  # -> Item, Item1, Item2, Item3
tbox = TwistedBox(
    CornerA=item_3.Item,
    CornerB=item_3.Item1,
    CornerC=item_3.Item2,
    CornerD=item_3.Item3,
    CornerE=item_2.Item,
    CornerF=item_2.Item1,
    CornerG=item_2.Item2,
    CornerH=item_2.Item3)
morph = BoxMorph(Geometry=crv, Reference=bbox_2.Box, Target=tbox)
rotate_2 = Rotate(Geometry=xy, Angle=degrees(neg), Plane=xz)  # -> Geometry, Transform
divlength = DivideLength(Curve=morph, Length=distance_between_points)  # -> Points, Tangents, Parameters
lng = ListLength(List=divlength.Points)
vec2pt = Vector2Pt(PointA=divlength.Points, PointB=volume.Centroid, Unitize=False)  # -> Vector, Length
range = Range(D0To1=Domain(0, 1), Steps=lng)
devec = DeconstructVector(Vector=vec2pt.Vector)  # -> XComponent, YComponent, ZComponent
twn2plns = TweenTwoPlanes(PlaneA=xy, PlaneB=rotate_2.Geometry, Factor=range, Quaternion=True)
vec = VectorXYZ(XComponent=devec.XComponent, YComponent=devec.YComponent, ZComponent=0)  # -> Vector, Length
rev = ReverseList(List=twn2plns)
pl_origin = PlaneOrigin(Base=rev, Origin=divlength.Points)
align = AlignPlane(Plane=pl_origin, Direction=vec.Vector)  # -> Plane, Angle
deplane = DeconstructPlane(Plane=align.Plane)  # -> Origin, XAxis, YAxis, ZAxis
project = ProjectPoint(Point=divlength.Points, Direction=deplane.XAxis, Geometry=mesh)  # -> Point, Index
print_path = ClusterOutput(project.Point)

# ==== cluster Cluster_2
distance_between_points = ClusterInput()
distance_from_z0 = ClusterInput()
end_plane_rotation = ClusterInput()
layer_height = ClusterInput()
C = ClusterInput()
bbox = BoundingBox(Content=C, PWorldXY=PlaneXY(0, 0, 0))  # -> Box, Box_2
debrep = DeconstructBrep(Brep=bbox.Box)  # -> reverse(Faces), Edges, Vertices

debox = DeconstructBox(Box=bbox.Box)  # -> Plane, X, Y, Z
dedomain = DeconstructDomain(Domain=debox.Y)  # -> Start, End
dedomain_2 = DeconstructDomain(Domain=debox.X)  # -> Start, End
dedomain_3 = DeconstructDomain(Domain=debox.Z)  # -> Start, End
max = Maximum(A=dedomain_2.End, B=dedomain.End)
min = Minimum(A=dedomain_2.Start, B=dedomain.Start)
abs = Absolute(Value=dedomain_3.Start)
abs_2 = Absolute(Value=min)
addition = Addition(A=abs, B=dedomain_3.End)
addition_2 = Addition(A=abs_2, B=max)
multiplication = Multiplication(A=addition, B15=1.5)
multiplication_2 = Multiplication(A=addition_2, B15=1.5)
division = Division(A=multiplication, B=layer_height)
round = Round(Number=division)  # -> Nearest, Floor, Ceiling
Z = UnitZ(Factor=1)
spiral = Spirale(
    AxisStart=Point(0, 0, 0),
    AxisDirection=Z,
    HelixStart=Point(0, 1, 0),
    Pitch=layer_height,
    TurnCount=round.Floor,
    R1=multiplication_2,
    R2=multiplication_2)

area = Area(Geometry=debrep.Faces)  # -> Area, Centroid
scale = Scale(Geometry=debrep.Faces, Center=area.Centroid, Factor=Slider(2, range=0..10))  # -> Geometry, Transform
item = ListItem(List=scale.Geometry, Index=0, WTrue=True)  # -> Item, Item1

srf = Surface(item.Item1)
Z_2 = UnitZ(Factor=distance_from_z0)
move = Move(Geometry=srf, Motion=Z_2)  # -> Geometry, Transform

debrep_2 = DeconstructBrep(Brep=move.Geometry)  # -> Faces, Edges, Vertices
item_2 = ListItem(List=debrep_2.Vertices, Index=0, WTrue=True)  # -> Item, Item1, Item2, Item3
crv = Curve(spiral)
bbox_2 = BoundingBox(Content=crv, PWorldXY=PlaneXY(0, 0, 0))  # -> Box, Box_2
mesh = Mesh(C)
bbox_3 = BoundingBox(Content=mesh, PWorldXY=PlaneXY(0, 0, 0))  # -> Box, Box_2
xy = XYPlane(Origin=Point(0, 0, 0))
xz = XZPlane(Origin=Point(0, 0, 0))
volume = Volume(Geometry=bbox_3.Box_2)  # -> Volume, Centroid

area_2 = Area(Geometry=item.Item)  # -> Area, Centroid
neg = Negative(Value=end_plane_rotation)
xz_2 = XZPlane(Origin=area_2.Centroid)
rotate = Rotate(Geometry=item.Item, Angle=degrees(neg), Plane=xz_2)  # -> Geometry, Transform
Z_3 = UnitZ(Factor=Slider(23, range=0..100))

neg_2 = Negative(Value=Z_3)

move_2 = Move(Geometry=rotate.Geometry, Motion=neg_2)  # -> Geometry, Transform

debrep_3 = DeconstructBrep(Brep=move_2.Geometry)  # -> Faces, Edges, Vertices
item_3 = ListItem(List=debrep_3.Vertices, Index=0, WTrue=True)  # -> Item, Item1, Item2, Item3
tbox = TwistedBox(
    CornerA=item_3.Item,
    CornerB=item_3.Item1,
    CornerC=item_3.Item2,
    CornerD=item_3.Item3,
    CornerE=item_2.Item,
    CornerF=item_2.Item1,
    CornerG=item_2.Item2,
    CornerH=item_2.Item3)
morph = BoxMorph(Geometry=crv, Reference=bbox_2.Box, Target=tbox)
rotate_2 = Rotate(Geometry=xy, Angle=degrees(neg), Plane=xz)  # -> Geometry, Transform
divlength = DivideLength(Curve=morph, Length=distance_between_points)  # -> Points, Tangents, Parameters
lng = ListLength(List=divlength.Points)
vec2pt = Vector2Pt(PointA=divlength.Points, PointB=volume.Centroid, Unitize=False)  # -> Vector, Length
range = Range(D0To1=Domain(0, 1), Steps=lng)
devec = DeconstructVector(Vector=vec2pt.Vector)  # -> XComponent, YComponent, ZComponent
twn2plns = TweenTwoPlanes(PlaneA=xy, PlaneB=rotate_2.Geometry, Factor=range, Quaternion=True)
vec = VectorXYZ(XComponent=devec.XComponent, YComponent=devec.YComponent, ZComponent=0)  # -> Vector, Length
rev = ReverseList(List=twn2plns)
pl_origin = PlaneOrigin(Base=rev, Origin=divlength.Points)
align = AlignPlane(Plane=pl_origin, Direction=vec.Vector)  # -> Plane, Angle
deplane = DeconstructPlane(Plane=align.Plane)  # -> Origin, XAxis, YAxis, ZAxis
project = ProjectPoint(Point=divlength.Points, Direction=deplane.XAxis, Geometry=mesh)  # -> Point, Index
pl_origin_2 = PlaneOrigin(Base=align.Plane, Origin=project.Point)
print_path = ClusterOutput(project.Point)
planes = ClusterOutput(pl_origin_2)

# ==== cluster Tool
nozzle_distance_from_holder = ClusterInput()
meshes = ClusterInput()
breps = ClusterInput()
G = ClusterInput()
G_2 = ClusterInput()
subtraction = Subtraction(A=nozzle_distance_from_holder, B5085=50.85)
null = NullItem(Item=nozzle_distance_from_holder)  # -> NullFlags, InvalidFlags, Description
filter = StreamFilter(Gate=null.NullFlags, Stream0=subtraction, Stream1="0")
Z = UnitZ(Factor=filter)
meshes_2 = Mesh(meshes)
mjoin = MeshJoin(Meshes=meshes_2)
move = Move(Geometry=G_2, Motion=Z)  # -> Geometry, Transform
move_2 = Move(Geometry=G, Motion=Z)  # -> Geometry, Transform
tool = PythonScript(meshes=mjoin, breps=breps, xline=move_2.Geometry, yline=move.Geometry)  # -> tool; inputs meshes: list of Mesh, breps: list of Brep
# ---------- tool: Python ----------
import Rhino.Geometry as rg
from compas.geometry import Frame
from ur_online_control.ur.tool import Tool
from compas.datastructures import Mesh
from compas_rhino.helpers import mesh_from_guid

xaxis = rg.Line(xline.PointAtStart, xline.PointAtEnd)
yaxis = rg.Line(yline.PointAtStart, yline.PointAtEnd)

if xaxis.From.DistanceTo(yaxis.From) < 0.01:
    origin = xaxis.From
    xaxis = xaxis.Direction
    yaxis = yaxis.Direction
elif xaxis.To.DistanceTo(yaxis.To) < 0.01:
    origin = xaxis.To
    xaxis = -xaxis.Direction
    yaxis = -yaxis.Direction
elif xaxis.From.DistanceTo(yaxis.To) < 0.01:
    origin = xaxis.From
    xaxis = xaxis.Direction
    yaxis = -yaxis.Direction
elif xaxis.To.DistanceTo(yaxis.From) < 0.01:
    origin = xaxis.To
    xaxis = -xaxis.Direction
    yaxis = yaxis.Direction

xaxis.Unitize()
yaxis.Unitize()

print origin
print xaxis
print yaxis

tcp_frame = Frame(origin, xaxis, yaxis)

tool = Tool(tcp_frame)
tool.model = [mesh_from_guid(Mesh, mesh) for mesh in meshes]
#tool.model_xyz = tool.model.xyz
tool.breps = breps
# ---------- end tool ----------
tool_2 = ClusterOutput(tool)
